# Grasshopper definition 0920.gh (Grasshopper 1.0.7)
# plug-ins: Bifocals

curve = Curve(<curve referenced from the Rhino model>)
brep = Brep(<brep referenced from the Rhino model>)
# no data
curve_2 = Curve()
# with data
curve_3 = Curve(<curve referenced from the Rhino model>)
# not preview
curve_4 = Curve(<curve referenced from the Rhino model>)
# disabled
curve_5 = Curve(<curve referenced from the Rhino model>)  # disabled
# srf
surface = Surface(<surface referenced from the Rhino model>)
curve_6 = Curve(<curve referenced from the Rhino model>)
curve_7 = Curve(<curve referenced from the Rhino model>)
curve_8 = Curve(<curve referenced from the Rhino model>)
surface_2 = Surface(<surface referenced from the Rhino model>)
# rotate
brep_2 = Brep(<brep referenced from the Rhino model>)
end_points = EndPoints(Curve=curve)  # -> Start, End
brep_3 = Brep(<brep referenced from the Rhino model>)
curve_9 = Curve(<curve referenced from the Rhino model>)
# divide crv
curve_10 = Curve(<curve referenced from the Rhino model>)
# divide srf
surface_3 = Surface(<surface referenced from the Rhino model>)
# scale
surface_4 = Surface(<surface referenced from the Rhino model>)
# srf (loft)
loft = Loft(
    Curves=[curve_7, curve_8, curve_6],
    Options={Adjust=False, Closed=False, LoftEnds=0, LoftSimp=0, LoftType=0, Rebuild=10, Refit=0.01})
volume = Volume(Geometry=brep_2)  # -> Volume, Centroid
volume_2 = Volume(Geometry=brep_3)  # -> Volume, Centroid
divide_domain² = DivideDomain²(Domain=surface_2, UCount=Slider(11, range=0..100), VCount=Slider(12, range=0..100))
divide_domain²_2 = DivideDomain²(Domain=surface_3, UCount=Slider(7, range=0..10), VCount=Slider(8, range=0..10))
divide_curve = DivideCurve(Curve=curve_9, Count=Slider(7, range=0..10), Kinks=False)  # -> Points, Tangents, Parameters
divide_curve_2 = DivideCurve(Curve=curve_10, Count=Slider(7, range=0..10), Kinks=False)  # -> Points, Tangents, Parameters
divide_domain²_3 = DivideDomain²(Domain=surface_4, UCount=Slider(11, range=0..100), VCount=Slider(12, range=0..100))
rotate = Rotate(Geometry=brep_2, Angle=degrees(Slider(46, range=0..100)), Plane=volume.Centroid)  # -> Geometry, Transform
vector_2pt = Vector2Pt(PointA=end_points.Start, PointB=end_points.End, Unitize=False)  # -> Vector, Length
move = Move(Geometry=brep, Motion=vector_2pt.Vector)  # -> Geometry, Transform
isotrim = Isotrim(Surface=surface_3, Domain=divide_domain²_2)
isotrim_2 = Isotrim(Surface=surface_4, Domain=divide_domain²_3)
isotrim_3 = Isotrim(Surface=surface_2, Domain=divide_domain²)
scale = Scale(Geometry=brep_3, Center=volume_2.Centroid, Factor=Slider(1.865, range=0..10))  # -> Geometry, Transform
line = Line(StartPoint=divide_curve_2.Points, EndPoint=divide_curve.Points)
area = Area(Geometry=isotrim_3)  # -> Area, Centroid
area_2 = Area(Geometry=isotrim_2)  # -> Area, Centroid
rotate_2 = Rotate(Geometry=isotrim_3, Angle=degrees(Slider(30, range=0..100)), Plane=area.Centroid)  # -> Geometry, Transform
scale_2 = Scale(Geometry=isotrim_2, Center=area_2.Centroid, Factor=Slider(0.638, range=0..1))  # -> Geometry, Transform
