# Grasshopper definition 0925.gh (Grasshopper 1.0.7)
# plug-ins: Bifocals

# surface
curve = Curve(<curve referenced from the Rhino model>)
curve_2 = Curve(<curve referenced from the Rhino model>)
# move
brep = Brep(<brep referenced from the Rhino model>)
# vector
brep_2 = Brep(<brep referenced from the Rhino model>)
# no data
curve_3 = Curve()
# with data
curve_4 = Curve(<curve referenced from the Rhino model>)
# not preview
curve_5 = Curve(<curve referenced from the Rhino model>)
# disabled
curve_6 = Curve(<curve referenced from the Rhino model>)  # disabled
# srf
surface = Surface(<surface referenced from the Rhino model>)
curve_7 = Curve(<curve referenced from the Rhino model>)
curve_8 = Curve(<curve referenced from the Rhino model>)
curve_9 = Curve(<curve referenced from the Rhino model>)
# 4point srf
point = Point(<point referenced from the Rhino model>)
point_2 = Point(<point referenced from the Rhino model>)
point_3 = Point(<point referenced from the Rhino model>)
point_4 = Point(<point referenced from the Rhino model>)

random = Random(Range=Domain(0, 1), Number=1, Seed=2)
range = Range(Domain=Domain(0, 1), Steps=10)
# number generator
series = Series(Start=0, Step=1, Count=10)

curve_10 = Curve(<curve referenced from the Rhino model>)
curve_11 = Curve(<curve referenced from the Rhino model>)
curve_12 = Curve(<curve referenced from the Rhino model>)
curve_13 = Curve(<curve referenced from the Rhino model>)
curve_14 = Curve(<curve referenced from the Rhino model>)
curve_15 = Curve(<curve referenced from the Rhino model>)
curve_16 = Curve(<curve referenced from the Rhino model>)
curve_17 = Curve(<curve referenced from the Rhino model>)
curve_18 = Curve(<curve referenced from the Rhino model>)
curve_19 = Curve(<curve referenced from the Rhino model>)
# range
brep_3 = Brep(<brep referenced from the Rhino model>)
# series
brep_4 = Brep(<brep referenced from the Rhino model>)
surface_2 = Surface(<surface referenced from the Rhino model>)
# rotate
brep_5 = Brep(<brep referenced from the Rhino model>)
curve_20 = Curve(<curve referenced from the Rhino model>)
brep_6 = Brep(<brep referenced from the Rhino model>)
curve_21 = Curve(<curve referenced from the Rhino model>)
# random
brep_7 = Brep(<brep referenced from the Rhino model>)
# divide crv
curve_22 = Curve(<curve referenced from the Rhino model>)
# divide srf
surface_3 = Surface(<surface referenced from the Rhino model>)
end_points = EndPoints(Curve=curve)  # -> Start, End
surface_4 = Surface(<surface referenced from the Rhino model>)
# scale
surface_5 = Surface(<surface referenced from the Rhino model>)
end_points_2 = EndPoints(Curve=curve_2)  # -> Start, End
end_points_3 = EndPoints(Curve=curve_10)  # -> Start, End
end_points_4 = EndPoints(Curve=curve_12)  # -> Start, End
# srf (loft)
loft = Loft(
    Curves=[curve_8, curve_9, curve_7],
    Options={Adjust=False, Closed=False, LoftEnds=0, LoftSimp=0, LoftType=0, Rebuild=10, Refit=0.01})
volume = Volume(Geometry=brep_5)  # -> Volume, Centroid
end_points_5 = EndPoints(Curve=curve_20)  # -> Start, End
volume_2 = Volume(Geometry=brep_6)  # -> Volume, Centroid
_4point_surface = _4PointSurface(CornerA=point, CornerB=point_2, CornerC=point_3, CornerD=point_4)
boundary_surfaces = BoundarySurfaces(Edges=[curve_14, curve_15, curve_16, curve_17])
curve_23 = Curve(<curve referenced from the Rhino model>)
number_slider = Slider(62, range=0..100)
number_slider_2 = Slider(78, range=0..100)
network_surface = NetworkSurface(CurvesU=[curve_18, curve_19], CurvesV=[curve_11, curve_13], Continuity=2)
divide_domain² = DivideDomain²(Domain=surface_2, UCount=Slider(11, range=0..100), VCount=Slider(12, range=0..100))
curve_24 = Curve(<curve referenced from the Rhino model>)
series_2 = Series(Start=0, Step=Slider(20, range=0..100), Count=Slider(15, range=0..100))
unit_z = UnitZ(Factor=Slider(100, range=0..100))
divide_domain²_2 = DivideDomain²(Domain=surface_3, UCount=Slider(7, range=0..10), VCount=Slider(8, range=0..10))
divide_curve = DivideCurve(Curve=curve_21, Count=Slider(7, range=0..10), Kinks=False)  # -> Points, Tangents, Parameters
divide_curve_2 = DivideCurve(Curve=curve_22, Count=Slider(7, range=0..10), Kinks=False)  # -> Points, Tangents, Parameters
divide_domain²_3 = DivideDomain²(Domain=surface_5, UCount=Slider(11, range=0..100), VCount=Slider(12, range=0..100))
divide_domain²_4 = DivideDomain²(Domain=surface_4, UCount=Slider(11, range=0..100), VCount=Slider(12, range=0..100))
vector_2pt = Vector2Pt(PointA=end_points_2.Start, PointB=end_points_2.End, Unitize=False)  # -> Vector, Length
rotate = Rotate(Geometry=brep_5, Angle=degrees(Slider(46, range=0..100)), Plane=volume.Centroid)  # -> Geometry, Transform
vector_2pt_2 = Vector2Pt(PointA=end_points_3.Start, PointB=end_points_3.End, Unitize=False)  # -> Vector, Length
vector_2pt_3 = Vector2Pt(PointA=end_points.Start, PointB=end_points.End, Unitize=False)  # -> Vector, Length
vector_2pt_4 = Vector2Pt(PointA=end_points_4.Start, PointB=end_points_4.End, Unitize=False)  # -> Vector, Length
construct_domain = ConstructDomain(DomainStart=Slider(0, range=0..100), DomainEnd=Slider(300, range=0..1000))
series_3 = Series(Start=0, Step=Slider(52, range=0..100), Count=Slider(7, range=0..10))
vector_2pt_5 = Vector2Pt(PointA=end_points_5.Start, PointB=end_points_5.End, Unitize=False)  # -> Vector, Length
isotrim = Isotrim(Surface=surface_3, Domain=divide_domain²_2)
isotrim_2 = Isotrim(Surface=surface_5, Domain=divide_domain²_3)
isotrim_3 = Isotrim(Surface=surface_4, Domain=divide_domain²_4)
construct_domain_2 = ConstructDomain(DomainStart=Slider(0, range=0..100), DomainEnd=Slider(300, range=0..1000))
move = Move(Geometry=brep, Motion=vector_2pt_3.Vector)  # -> Geometry, Transform

construct_domain_3 = ConstructDomain(DomainStart=Slider(0.2, range=0..1), DomainEnd=Slider(0.8, range=0..1))
random_2 = Random(Range=construct_domain_3, Number=Slider(132, range=0..1000), Seed=2)

isotrim_4 = Isotrim(Surface=surface_2, Domain=divide_domain²)
scale = Scale(Geometry=brep_6, Center=volume_2.Centroid, Factor=Slider(1.865, range=0..10))  # -> Geometry, Transform
panel = Panel(network_surface)
unit_z_2 = UnitZ(Factor=series_2)
line = Line(StartPoint=divide_curve_2.Points, EndPoint=divide_curve.Points)
area = Area(Geometry=isotrim_3)  # -> Area, Centroid
move_2 = Move(Geometry=curve_23, Motion=unit_z)  # -> Geometry, Transform
addition = Addition(A=number_slider_2, B=number_slider)
area_2 = Area(Geometry=isotrim_4)  # -> Area, Centroid
amplitude = Amplitude(
    Vector=vector_2pt.Vector,
    Amplitude=[Slider(172, range=0..1000), number_slider, Slider(250, range=0..1000), number_slider_2, addition])
move_3 = Move(Geometry=brep_2, Motion=amplitude)  # -> Geometry, Transform
move_4 = Move(Geometry=curve_24, Motion=unit_z_2)  # -> Geometry, Transform
area_3 = Area(Geometry=isotrim_2)  # -> Area, Centroid
panel_2 = Panel(series_3)
amplitude_2 = Amplitude(Vector=vector_2pt_4.Vector, Amplitude=series_3)
range_2 = Range(Domain=construct_domain, Steps=Slider(7, range=0..10))
amplitude_3 = Amplitude(Vector=vector_2pt_2.Vector, Amplitude=range_2)
random_3 = Random(Range=construct_domain_2, Number=Slider(7, range=0..100), Seed=2)
amplitude_4 = Amplitude(Vector=vector_2pt_5.Vector, Amplitude=random_3)
move_5 = Move(Geometry=brep_3, Motion=amplitude_3)  # -> Geometry, Transform
move_6 = Move(Geometry=brep_4, Motion=amplitude_2)  # -> Geometry, Transform
scale_2 = Scale(Geometry=isotrim_3, Center=area.Centroid, Factor=Slider(0.978, range=0..1))  # -> Geometry, Transform
move_7 = Move(Geometry=brep_7, Motion=amplitude_4)  # -> Geometry, Transform
rotate_2 = Rotate(Geometry=isotrim_4, Angle=degrees(Slider(30, range=0..100)), Plane=area_2.Centroid)  # -> Geometry, Transform
scale_3 = Scale(Geometry=isotrim_2, Center=area_3.Centroid, Factor=Slider(0.638, range=0..1))  # -> Geometry, Transform
panel_3 = Panel(range_2)
area_4 = Area(Geometry=move_4.Geometry)  # -> Area, Centroid
construct_domain_4 = ConstructDomain(DomainStart=Slider(0, range=0..100), DomainEnd=Slider(54, range=0..1000))
panel_4 = Panel(random_3)
scale_4 = Scale(Geometry=isotrim_3, Center=area.Centroid, Factor=random_2)  # -> Geometry, Transform
area_5 = Area(Geometry=move_2.Geometry)  # -> Area, Centroid
unit_y = UnitY(Factor=Slider(31, range=0..1000))
extrude = Extrude(Base=scale_2.Geometry, Direction=unit_y)
range_3 = Range(Domain=construct_domain_4, Steps=Slider(14, range=0..100))
rotate_3 = Rotate(Geometry=move_2.Geometry, Angle=degrees(Slider(70, range=0..100)), Plane=area_5.Centroid)  # -> Geometry, Transform
rotate_4 = Rotate(Geometry=move_4.Geometry, Angle=degrees(range_3), Plane=area_4.Centroid)  # -> Geometry, Transform
unit_y_2 = UnitY(Factor=Slider(31, range=0..1000))
extrude_2 = Extrude(Base=scale_4.Geometry, Direction=unit_y_2)
loft_2 = Loft(
    Curves=[curve_23, rotate_3.Geometry],
    Options={Adjust=False, Closed=False, LoftEnds=0, LoftSimp=0, LoftType=0, Rebuild=10, Refit=0.01})
panel_5 = Panel(range_3)
loft_3 = Loft(
    Curves=rotate_4.Geometry,
    Options={Adjust=False, Closed=False, LoftEnds=0, LoftSimp=0, LoftType=0, Rebuild=10, Refit=0.01})
