# Grasshopper definition 0927.gh (Grasshopper 1.0.7)
# plug-ins: Bifocals

surface = Surface(<surface referenced from the Rhino model>)
divide_domain² = DivideDomain²(Domain=surface, UCount=Slider(11, range=0..100), VCount=Slider(12, range=0..100))
isotrim = Isotrim(Surface=surface, Domain=divide_domain²)
construct_domain = ConstructDomain(DomainStart=Slider(0.2, range=0..1), DomainEnd=Slider(0.9, range=0..1))
area = Area(Geometry=isotrim)  # -> Area, Centroid
random = Random(Range=construct_domain, Number=Slider(132, range=0..1000), Seed=2)
scale = Scale(Geometry=isotrim, Center=area.Centroid, Factor=random)  # -> Geometry, Transform
scale_2 = Scale(Geometry=isotrim, Center=area.Centroid, Factor=Slider(0.987, range=0..1))  # -> Geometry, Transform
panel = Panel(random)
unit_y = UnitY(Factor=Slider(80, range=0..100))
extrude = Extrude(Base=scale_2.Geometry, Direction=unit_y)
extrude_2 = Extrude(Base=scale.Geometry, Direction=unit_y)
solid_difference = SolidDifference(BrepsA=extrude, BrepsB=extrude_2)
