# Grasshopper definition 1004.gh (Grasshopper 1.0.7)
# plug-ins: Bifocals

# list item
number_slider = Slider(10, range=0..10)
# branch
number_slider_2 = Slider(9, range=0..10)
# index
# branch
brep = Brep([<brep referenced from the Rhino model> x14])
# index
rectangular = Rectangular(
    Plane=PlaneXY(0, 0, 0),
    SizeX=number_slider,
    SizeY=number_slider,
    ExtentX=Slider(7, range=0..10),
    ExtentY=number_slider_2)  # -> Cells, Points
curve = Curve(<curve referenced from the Rhino model>)
curve_2 = Curve(<curve referenced from the Rhino model>)
curve_3 = Curve(<curve referenced from the Rhino model>)
loft = Loft(
    Curves=[curve, curve_2, curve_3],
    Options={Adjust=False, Closed=False, LoftEnds=0, LoftSimp=0, LoftType=0, Rebuild=10, Refit=0.01})
param_viewer = ParamViewer(brep)
panel = Panel(rectangular.Cells)
param_viewer_2 = ParamViewer(rectangular.Cells)
panel_2 = Panel(brep)
divide_domain² = DivideDomain²(Domain=loft, UCount=Slider(11, range=0..100), VCount=Slider(12, range=0..100))
isotrim = Isotrim(Surface=loft, Domain=divide_domain²)

area = Area(Geometry=rectangular.Cells)  # -> Area, Centroid
point_list = PointList(Points=area.Centroid, Size=Slider(5, range=0..10))

volume = Volume(Geometry=brep)  # -> Volume, Centroid
point_list_2 = PointList(Points=volume.Centroid, Size=Slider(5, range=0..10))

construct_domain = ConstructDomain(DomainStart=Slider(0, range=0..100), DomainEnd=Slider(131, range=0..1000))
panel_3 = Panel(isotrim)
list_item = ListItem(List=brep, Index=Slider(3, range=0..10), Wrap=True)
list_item_2 = ListItem(List=rectangular.Cells, Index=Slider(3, range=0..10), Wrap=True)
area_2 = Area(Geometry=isotrim)  # -> Area, Centroid
random = Random(Range=construct_domain, Number=Slider(50, range=0..100), Seed=Slider(23, range=0..100))
list_item_3 = ListItem(List=isotrim, Index=random, Wrap=True)
point_list_3 = PointList(Points=area_2.Centroid, Size=Slider(2, range=0..10))
construct_domain_2 = ConstructDomain(DomainStart=Slider(0.2, range=0..1), DomainEnd=Slider(0.8, range=0..1))
area_3 = Area(Geometry=list_item_3)  # -> Area, Centroid
random_2 = Random(Range=construct_domain_2, Number=Slider(50, range=0..100), Seed=Slider(23, range=0..100))
# normal - 서피스의 수직방향 벡터
scale = Scale(Geometry=list_item_3, Center=area_3.Centroid, Factor=random_2)  # -> Geometry, Transform
surface = Surface(<surface referenced from the Rhino model>)
md_slider = MDSlider(
    SliderMode=0,
    slider_value=Point(0.5213533727, 0.4952318145, 0.5),
    x_domain=Domain(0, 1),
    y_domain=Domain(0, 1),
    z_domain=Domain(0, 1))
evaluate_surface = EvaluateSurface(Surface=reparameterize(scale.Geometry), Point=md_slider)  # -> Point, Normal, UDirection, VDirection, Frame
amplitude = Amplitude(Vector=evaluate_surface.Normal, Amplitude=Slider(5, range=0..100))
negative = Negative(Value=amplitude)
extrude = Extrude(Base=scale.Geometry, Direction=negative)

amplitude_2 = Amplitude(Vector=evaluate_surface.Normal, Amplitude=Slider(10, range=0..100))
negative_2 = Negative(Value=amplitude_2)
vector_display = VectorDisplay(Anchor=evaluate_surface.Point, Vector=negative_2)
