# Grasshopper definition 1011-1.gh (Grasshopper 1.0.7)
# plug-ins: Bifocals

md_slider = MDSlider(
    SliderMode=0,
    slider_value=Point(0.7252510815, 0.6018650706, 0.5),
    x_domain=Domain(0, 1),
    y_domain=Domain(0, 1),
    z_domain=Domain(0, 1))
md_slider_2 = MDSlider(
    SliderMode=0,
    slider_value=Point(0.7252510815, 0.6018650706, 0.5),
    x_domain=Domain(0, 1),
    y_domain=Domain(0, 1),
    z_domain=Domain(0, 1))
# attractor point
surface = Surface(<surface referenced from the Rhino model>)
surface_2 = Surface(<surface referenced from the Rhino model>)
divide_domain² = DivideDomain²(Domain=surface, UCount=Slider(11, range=0..100), VCount=Slider(12, range=0..100))
evaluate_surface = EvaluateSurface(Surface=reparameterize(surface), Point=md_slider)  # -> Point, Normal, UDirection, VDirection, Frame
divide_domain²_2 = DivideDomain²(Domain=surface_2, UCount=Slider(11, range=0..100), VCount=Slider(12, range=0..100))
evaluate_surface_2 = EvaluateSurface(Surface=reparameterize(surface_2), Point=md_slider_2)  # -> Point, Normal, UDirection, VDirection, Frame
isotrim = Isotrim(Surface=surface, Domain=divide_domain²)
isotrim_2 = Isotrim(Surface=surface_2, Domain=divide_domain²_2)
area = Area(Geometry=isotrim)  # -> Area, Centroid
distance = Distance(PointA=evaluate_surface.Point, PointB=area.Centroid)
area_2 = Area(Geometry=isotrim_2)  # -> Area, Centroid
distance_2 = Distance(PointA=evaluate_surface_2.Point, PointB=area_2.Centroid)

# ----
# remap - 주어진 숫자의 배율을 유지한테 원하는 범위로 재설정
bounds = Bounds(Numbers=distance)
construct_domain = ConstructDomain(DomainStart=Slider(0.2, range=0..1), DomainEnd=Slider(0.9, range=0..1))
remap_numbers = RemapNumbers(Value=distance, Source=bounds, Target=construct_domain)  # -> Mapped, Clipped

# ----
# remap - 주어진 숫자의 배율을 유지한테 원하는 범위로 재설정
bounds_2 = Bounds(Numbers=distance_2)
construct_domain_2 = ConstructDomain(DomainStart=Slider(0.9, range=0..1), DomainEnd=Slider(0.2, range=0..1))
remap_numbers_2 = RemapNumbers(Value=distance_2, Source=bounds_2, Target=construct_domain_2)  # -> Mapped, Clipped

panel = Panel(distance)
panel_2 = Panel(distance_2)
scale = Scale(Geometry=isotrim, Center=area.Centroid, Factor=remap_numbers.Mapped)  # -> Geometry, Transform
scale_2 = Scale(Geometry=isotrim_2, Center=area_2.Centroid, Factor=remap_numbers_2.Mapped)  # -> Geometry, Transform
panel_3 = Panel(remap_numbers.Mapped)
panel_4 = Panel(remap_numbers_2.Mapped)

bounds_3 = Bounds(Numbers=distance)
construct_domain_3 = ConstructDomain(DomainStart=Slider(15, range=0..100), DomainEnd=Slider(120, range=0..1000))
remap_numbers_3 = RemapNumbers(Value=distance, Source=bounds_3, Target=construct_domain_3)  # -> Mapped, Clipped

number_slider = Slider(34, range=0..100)
number_slider_2 = Slider(34, range=0..100)

bounds_4 = Bounds(Numbers=distance_2)
construct_domain_4 = ConstructDomain(DomainStart=Slider(120, range=0..1000), DomainEnd=Slider(15, range=0..100))
remap_numbers_4 = RemapNumbers(Value=distance_2, Source=bounds_4, Target=construct_domain_4)  # -> Mapped, Clipped

panel_5 = Panel(bounds_4)
unit_z = UnitZ(Factor=remap_numbers_3.Mapped)
unit_z_2 = UnitZ(Factor=remap_numbers_4.Mapped)
extrude = Extrude(Base=scale.Geometry, Direction=unit_z)
extrude_2 = Extrude(Base=scale_2.Geometry, Direction=unit_z_2)
panel_6 = Panel(construct_domain_4)
