# Grasshopper definition 1011.gh (Grasshopper 1.0.7)

number_slider = Slider(10, range=0..10)
# graft
graft_tree = GraftTree(IncludeEmptyLists=True, IncludeNullItems=True)
# flattern
flatten_tree = FlattenTree(Path="{0}")
rectangular = Rectangular(
    Plane=PlaneXY(0, 0, 0),
    SizeX=number_slider,
    SizeY=number_slider,
    ExtentX=Slider(7, range=0..10),
    ExtentY=Slider(8, range=0..10))  # -> Cells, Points
area = Area(Geometry=rectangular.Cells)  # -> Area, Centroid
# flattern  - branch 하나로 합친다
flatten_tree_2 = FlattenTree(Tree=rectangular.Cells, Path="{0}")
point_list = PointList(Points=area.Centroid, Size=Slider(5, range=0..10))
area_2 = Area(Geometry=flatten_tree_2)  # -> Area, Centroid
panel = Panel(rectangular.Cells)
point_list_2 = PointList(Points=area_2.Centroid, Size=Slider(5, range=0..10))
panel_2 = Panel(flatten_tree_2)
list_item = ListItem(List=rectangular.Cells, Index=Slider(3, range=0..10), Wrap=True)
list_item_2 = ListItem(List=flatten_tree_2, Index=Slider(3, range=0..10), Wrap=True)
number_slider_2 = Slider(10, range=0..10)
rectangular_2 = Rectangular(
    Plane=PlaneXY(0, 0, 0),
    SizeX=number_slider_2,
    SizeY=number_slider_2,
    ExtentX=Slider(7, range=0..10),
    ExtentY=Slider(8, range=0..10))  # -> Cells, Points
# graft - branch로 나눈다
# branch - 명령어를 실행하면 branch 마다 별도로 적용된다
param_viewer = ParamViewer(rectangular_2.Cells)
curve = Curve(<curve referenced from the Rhino model>)
divide_curve = DivideCurve(Curve=curve, Count=10, Kinks=False)  # -> Points, Tangents, Parameters
area_3 = Area(Geometry=rectangular_2.Cells)  # -> Area, Centroid
graft_tree_2 = GraftTree(Tree=rectangular_2.Cells, IncludeEmptyLists=True, IncludeNullItems=True)
param_viewer_2 = ParamViewer(graft_tree_2)
area_4 = Area(Geometry=graft_tree_2)  # -> Area, Centroid
point_list_3 = PointList(Points=area_3.Centroid, Size=Slider(5, range=0..10))
panel_3 = Panel(divide_curve.Points)
point_list_4 = PointList(Points=area_4.Centroid, Size=Slider(5, range=0..10))
list_item_3 = ListItem(List=graft_tree_2, Index=Slider(3, range=0..10), Wrap=True)
list_item_4 = ListItem(List=divide_curve.Points, Index=Slider(18, range=0..20), Wrap=True)
list_item_5 = ListItem(Index=0, Wrap=True)
