# Grasshopper definition 1016-1.gh (Grasshopper 1.0.7)
# plug-ins: Bifocals

curve = Curve(<curve referenced from the Rhino model>)
surface = Surface(<surface referenced from the Rhino model>)
divide_domain² = DivideDomain²(Domain=surface, UCount=Slider(11, range=0..100), VCount=Slider(12, range=0..100))
isotrim = Isotrim(Surface=surface, Domain=divide_domain²)
area = Area(Geometry=isotrim)  # -> Area, Centroid
number_slider = Slider(0.567, range=0..1)
construct_domain = ConstructDomain(DomainStart=Slider(0.2, range=0..1), DomainEnd=Slider(0.9, range=0..1))
number_slider_2 = Slider(68, range=0..100)
construct_domain_2 = ConstructDomain(DomainStart=Slider(0, range=0..100), DomainEnd=Slider(90, range=0..100))
md_slider = MDSlider(SliderMode=0, slider_value=Point(0.5, 0.5, 0.5), x_domain=Domain(0, 1), y_domain=Domain(0, 1), z_domain=Domain(0, 1))
evaluate_curve = EvaluateCurve(Curve=reparameterize(curve), Parameter=Slider(1, range=0..1))  # -> Point, Tangent, Angle
sphere = Sphere(Base=evaluate_curve.Point, Radius=Slider(71, range=0..100))
distance = Distance(PointA=evaluate_curve.Point, PointB=area.Centroid)
panel = Panel(distance)
bounds = Bounds(Numbers=distance)
remap_numbers = RemapNumbers(Value=distance, Source=bounds, Target=construct_domain)  # -> Mapped, Clipped
scale = Scale(Geometry=isotrim, Center=area.Centroid, Factor=remap_numbers.Mapped)  # -> Geometry, Transform
bounds_2 = Bounds(Numbers=distance)
panel_2 = Panel(remap_numbers.Mapped)
remap_numbers_2 = RemapNumbers(Value=distance, Source=bounds_2, Target=construct_domain_2)  # -> Mapped, Clipped
rotate = Rotate(Geometry=scale.Geometry, Angle=degrees(remap_numbers_2.Mapped), Plane=area.Centroid)  # -> Geometry, Transform
evaluate_surface = EvaluateSurface(Surface=reparameterize(rotate.Geometry), Point=md_slider)  # -> Point, Normal, UDirection, VDirection, Frame
bounds_3 = Bounds(Numbers=distance)
construct_domain_3 = ConstructDomain(DomainStart=Slider(11, range=0..100), DomainEnd=Slider(60, range=0..100))
number_slider_3 = Slider(30, range=0..100)
remap_numbers_3 = RemapNumbers(Value=distance, Source=bounds_3, Target=construct_domain_3)  # -> Mapped, Clipped
amplitude = Amplitude(Vector=evaluate_surface.Normal, Amplitude=remap_numbers_3.Mapped)
extrude = Extrude(Base=rotate.Geometry, Direction=amplitude)
