# Grasshopper definition 1016.gh (Grasshopper 1.0.7)
# plug-ins: Bifocals

number_slider = Slider(10, range=0..10)
number_slider_2 = Slider(10, range=0..10)
number_slider_3 = Slider(10, range=0..10)
number_slider_4 = Slider(10, range=0..10)
point = Point(<point referenced from the Rhino model>)
point_2 = Point(<point referenced from the Rhino model>)
point_3 = Point(<point referenced from the Rhino model>)
rectangular = Rectangular(Plane=point, SizeX=number_slider, SizeY=number_slider, ExtentX=Slider(7, range=0..10), ExtentY=Slider(8, range=0..10))  # -> Cells, Points
rectangular_2 = Rectangular(
    Plane=PlaneXY(0, 0, 0),
    SizeX=number_slider_2,
    SizeY=number_slider_2,
    ExtentX=Slider(7, range=0..10),
    ExtentY=Slider(8, range=0..10))  # -> Cells, Points
rectangular_3 = Rectangular(
    Plane=point_2,
    SizeX=number_slider_3,
    SizeY=number_slider_3,
    ExtentX=Slider(7, range=0..10),
    ExtentY=Slider(8, range=0..10))  # -> Cells, Points
rectangular_4 = Rectangular(
    Plane=point_3,
    SizeX=number_slider_4,
    SizeY=number_slider_4,
    ExtentX=Slider(7, range=0..10),
    ExtentY=Slider(8, range=0..10))  # -> Cells, Points
param_viewer = ParamViewer(rectangular_2.Cells)
area = Area(Geometry=rectangular.Cells)  # -> Area, Centroid
area_2 = Area(Geometry=rectangular_4.Cells)  # -> Area, Centroid
flatten_tree = FlattenTree(Tree=rectangular_2.Cells, Path="{0}")
graft_tree = GraftTree(Tree=rectangular_2.Cells, IncludeEmptyLists=True, IncludeNullItems=True)
area_3 = Area(Geometry=rectangular_3.Cells)  # -> Area, Centroid
param_viewer_2 = ParamViewer(graft_tree)
panel = Panel(rectangular_2.Cells)
panel_2 = Panel(flatten_tree)
panel_3 = Panel(graft_tree)
scale = Scale(Geometry=rectangular.Cells, Center=area.Centroid, Factor=Slider(0.819, range=0..1))  # -> Geometry, Transform
scale_2 = Scale(Geometry=rectangular_4.Cells, Center=area_2.Centroid, Factor=Slider(0.819, range=0..1))  # -> Geometry, Transform
scale_3 = Scale(Geometry=rectangular_3.Cells, Center=area_3.Centroid, Factor=Slider(0.819, range=0..1))  # -> Geometry, Transform
graft_tree_2 = GraftTree(Tree=scale.Geometry, IncludeEmptyLists=True, IncludeNullItems=True)
panel_4 = Panel(scale_2.Geometry)
flatten_tree_2 = FlattenTree(Tree=scale_3.Geometry, Path="{0}")
param_viewer_3 = ParamViewer(graft_tree_2)
panel_5 = Panel(graft_tree_2)
series = Series(Start=Slider(2, range=0..10), Step=Slider(2, range=0..10), Count=Slider(56, range=0..100))
series_2 = Series(Start=Slider(2, range=0..10), Step=Slider(2, range=0..10), Count=Slider(8, range=0..100))
series_3 = Series(Start=Slider(2, range=0..10), Step=Slider(2, range=0..10), Count=Slider(56, range=0..100))
unit_z = UnitZ(Factor=series)
unit_z_2 = UnitZ(Factor=series_2)
unit_z_3 = UnitZ(Factor=series_3)
# 데이터 매칭
panel_6 = Panel(unit_z_2)
# branch 로 나누워진 데이터
# 하나의 branch 로 합쳐진 데이터
# A
# 
# B
# 
# C
# 
# D
extrude = Extrude(Base=scale_2.Geometry, Direction=unit_z_2)
panel_7 = Panel(series)
# 데이터 매칭
extrude_2 = Extrude(Base=flatten_tree_2, Direction=unit_z_3)
# 하나의 branch 로 합쳐진 데이터
# 하나의 branch 로 합쳐진 데이터
# A
# 
# B
# 
# C
# 
# D
panel_8 = Panel(series_3)
# A
# 
# B
# 
# C
# 
# D
panel_9 = Panel(series_2)
# 데이터 매칭
# branch 로 나누워진 데이터
# branch 로 나누워진 데이터
# A
# 
# B
# 
# C
# 
# D
# A
# 
# B
# 
# C
# 
# D
extrude_3 = Extrude(Base=graft_tree_2, Direction=graft(unit_z))
# A
# 
# B
# 
# C
# 
# D
panel_10 = Panel(unit_z)
