# Grasshopper definition 1018-1.gh (Grasshopper 1.0.7)
# plug-ins: LunchBox, Bifocals

surface = Surface(<surface referenced from the Rhino model>)
# 우클릭 reparameterize
curve = Curve(<curve referenced from the Rhino model>)
curve_2 = Curve(<curve referenced from the Rhino model>)
hexagon_cells = HexagonCells(Surface=surface, UDivisions=Slider(17, range=0..100), VDivisions=Slider(11, range=0..100), TParameter=0.25)  # -> HexagonCells, Centers
area = Area(Geometry=hexagon_cells.HexagonCells)  # -> Area, Centroid
end_points = EndPoints(Curve=curve_2)  # -> Start, End
point = Point(end_points.Start)

construct_domain = ConstructDomain(DomainStart=Slider(0.2, range=0..1), DomainEnd=Slider(0.9, range=0..1))

construct_domain_2 = ConstructDomain(DomainStart=Slider(0, range=0..100), DomainEnd=Slider(90, range=0..100))

md_slider = MDSlider(SliderMode=0, slider_value=Point(0.5, 0.5, 0.5), x_domain=Domain(0, 1), y_domain=Domain(0, 1), z_domain=Domain(0, 1))
construct_domain_3 = ConstructDomain(DomainStart=Slider(5, range=0..100), DomainEnd=Slider(40, range=0..100))
number_slider = Slider(30, range=0..100)

evaluate_curve = EvaluateCurve(Curve=reparameterize(curve), Parameter=Slider(0.01, range=0.01..0.99))  # -> Point, Tangent, Angle
line = Line(StartPoint=area.Centroid, EndPoint=evaluate_curve.Point)
sphere = Sphere(Base=evaluate_curve.Point, Radius=Slider(50, range=0..100))
angle = Angle(VectorA=curve_2, VectorB=line)  # -> Angle, Reflex
degrees = Degrees(Radians=angle.Angle)

bounds = Bounds(Numbers=degrees)
remap_numbers = RemapNumbers(Value=degrees, Source=bounds, Target=construct_domain)  # -> Mapped, Clipped
scale = Scale(Geometry=hexagon_cells.HexagonCells, Center=area.Centroid, Factor=remap_numbers.Mapped)  # -> Geometry, Transform

panel = Panel(degrees)

bounds_2 = Bounds(Numbers=degrees)
remap_numbers_2 = RemapNumbers(Value=degrees, Source=bounds_2, Target=construct_domain_2)  # -> Mapped, Clipped
rotate = Rotate(Geometry=scale.Geometry, Angle=degrees(remap_numbers_2.Mapped), Plane=area.Centroid)  # -> Geometry, Transform

evaluate_surface = EvaluateSurface(Surface=reparameterize(rotate.Geometry), Point=md_slider)  # -> Point, Normal, UDirection, VDirection, Frame
bounds_3 = Bounds(Numbers=degrees)
remap_numbers_3 = RemapNumbers(Value=degrees, Source=bounds_3, Target=construct_domain_3)  # -> Mapped, Clipped
amplitude = Amplitude(Vector=evaluate_surface.Normal, Amplitude=remap_numbers_3.Mapped)
extrude = Extrude(Base=rotate.Geometry, Direction=amplitude)
cap_holes = CapHoles(Brep=extrude)
