# Grasshopper definition 1018.gh (Grasshopper 1.0.7)
# plug-ins: Bifocals, LunchBox

number_slider = Slider(11, range=0..100)
number_slider_2 = Slider(12, range=0..100)
curve = Curve(<curve referenced from the Rhino model>)
curve_2 = Curve(<curve referenced from the Rhino model>)
surface = Surface(<surface referenced from the Rhino model>)
end_points = EndPoints(Curve=curve_2)  # -> Start, End
evaluate_curve = EvaluateCurve(Curve=reparameterize(curve), Parameter=Slider(0, range=0..1))  # -> Point, Tangent, Angle
point = Point(end_points.End)
hexagon_cells = HexagonCells(Surface=surface, UDivisions=number_slider, VDivisions=number_slider_2, TParameter=0.25)  # -> HexagonCells, Centers
divide_domain² = DivideDomain²(Domain=surface, UCount=number_slider, VCount=number_slider_2)
isotrim = Isotrim(Surface=surface, Domain=divide_domain²)
sphere = Sphere(Base=evaluate_curve.Point, Radius=Slider(71, range=0..100))
area = Area(Geometry=hexagon_cells.HexagonCells)  # -> Area, Centroid
line = Line(StartPoint=area.Centroid, EndPoint=point)
line_2 = Line(StartPoint=area.Centroid, EndPoint=evaluate_curve.Point)
distance = Distance(PointA=evaluate_curve.Point, PointB=area.Centroid)
angle = Angle(VectorA=line, VectorB=line_2)  # -> Angle, Reflex
degrees = Degrees(Radians=angle.Angle)
panel = Panel(degrees)
bounds = Bounds(Numbers=degrees)
number_slider_3 = Slider(0.567, range=0..1)
construct_domain = ConstructDomain(DomainStart=Slider(0.2, range=0..1), DomainEnd=Slider(0.9, range=0..1))
remap_numbers = RemapNumbers(Value=degrees, Source=bounds, Target=construct_domain)  # -> Mapped, Clipped
scale = Scale(Geometry=hexagon_cells.HexagonCells, Center=area.Centroid, Factor=remap_numbers.Mapped)  # -> Geometry, Transform
number_slider_4 = Slider(68, range=0..100)
bounds_2 = Bounds(Numbers=degrees)
panel_3 = Panel(remap_numbers.Mapped)
construct_domain_2 = ConstructDomain(DomainStart=Slider(0, range=0..100), DomainEnd=Slider(90, range=0..100))
remap_numbers_2 = RemapNumbers(Value=degrees, Source=bounds_2, Target=construct_domain_2)  # -> Mapped, Clipped
rotate = Rotate(Geometry=scale.Geometry, Angle=degrees(remap_numbers_2.Mapped), Plane=area.Centroid)  # -> Geometry, Transform
md_slider = MDSlider(SliderMode=0, slider_value=Point(0.5, 0.5, 0.5), x_domain=Domain(0, 1), y_domain=Domain(0, 1), z_domain=Domain(0, 1))
evaluate_surface = EvaluateSurface(Surface=reparameterize(rotate.Geometry), Point=md_slider)  # -> Point, Normal, UDirection, VDirection, Frame
bounds_3 = Bounds(Numbers=degrees)
construct_domain_3 = ConstructDomain(DomainStart=Slider(11, range=0..100), DomainEnd=Slider(60, range=0..100))
number_slider_5 = Slider(30, range=0..100)
remap_numbers_3 = RemapNumbers(Value=degrees, Source=bounds_3, Target=construct_domain_3)  # -> Mapped, Clipped
amplitude = Amplitude(Vector=evaluate_surface.Normal, Amplitude=remap_numbers_3.Mapped)
extrude = Extrude(Base=rotate.Geometry, Direction=amplitude)
cap_holes = CapHoles(Brep=extrude)
