# Grasshopper definition 1023.gh (Grasshopper 1.0.7)
# plug-ins: Bifocals

brep = Brep(<brep referenced from the Rhino model>)
# bounding box
surface = Surface(<surface referenced from the Rhino model>)
bounding_box = BoundingBox(Content=brep, Plane=PlaneXY(0, 0, 0))  # -> Box, Box_2
curve = Curve(<curve referenced from the Rhino model>)
md_slider = MDSlider(SliderMode=0, slider_value=Point(0.5, 0.5, 0.5), x_domain=Domain(0, 1), y_domain=Domain(0, 1), z_domain=Domain(0, 1))
unit_z = UnitZ(Factor=Slider(15, range=0..100))
divide_domain² = DivideDomain²(Domain=surface, UCount=Slider(11, range=0..100), VCount=Slider(11, range=0..100))
surface_2 = Surface(<surface referenced from the Rhino model>)
evaluate_surface = EvaluateSurface(Surface=reparameterize(surface), Point=md_slider)  # -> Point, Normal, UDirection, VDirection, Frame
move = Move(Geometry=curve, Motion=unit_z)  # -> Geometry, Transform
isotrim = Isotrim(Surface=surface, Domain=divide_domain²)
divide_domain²_2 = DivideDomain²(Domain=surface_2, UCount=Slider(11, range=0..100), VCount=Slider(12, range=0..100))
area = Area(Geometry=isotrim)  # -> Area, Centroid
explode = Explode(Curve=move.Geometry, Recursive=True)  # -> Segments, Vertices
distance = Distance(PointA=area.Centroid, PointB=evaluate_surface.Point)
isotrim_2 = Isotrim(Surface=surface_2, Domain=divide_domain²_2)
bounds = Bounds(Numbers=distance)
negative = Negative(Value=Slider(15, range=0..100))
evaluate_curve = EvaluateCurve(Curve=reparameterize(explode.Segments), Parameter=Slider(0.5, range=0..1))  # -> Point, Tangent, Angle
construct_domain = ConstructDomain(DomainStart=Slider(10, range=0..100), DomainEnd=Slider(50, range=0..100))
surface_box = SurfaceBox(Surface=surface, Domain=divide_domain², Height=negative)
remap_numbers = RemapNumbers(Value=distance, Source=bounds, Target=construct_domain)  # -> Mapped, Clipped
interpolate = Interpolate(Vertices=evaluate_curve.Point, Degree=3, Periodic=Toggle(True), KnotStyle=1)  # -> Curve, Length, Domain
box_morph = BoxMorph(Geometry=brep, Reference=bounding_box.Box, Target=surface_box)
area_2 = Area(Geometry=interpolate.Curve)  # -> Area, Centroid
move_2 = Move(Geometry=interpolate.Curve, Motion=unit_z)  # -> Geometry, Transform
scale = Scale(Geometry=interpolate.Curve, Center=area_2.Centroid, Factor=Slider(0.408, range=0..1))  # -> Geometry, Transform
area_3 = Area(Geometry=move_2.Geometry)  # -> Area, Centroid
scale_2 = Scale(Geometry=move_2.Geometry, Center=area_3.Centroid, Factor=Slider(0.846, range=0..1))  # -> Geometry, Transform
scale_3 = Scale(Geometry=scale.Geometry, Center=area_2.Centroid, Factor=Slider(0.736, range=0..1))  # -> Geometry, Transform
loft = Loft(
    Curves=flatten([curve, scale.Geometry, move_2.Geometry]),
    Options={Adjust=False, Closed=False, LoftEnds=0, LoftSimp=0, LoftType=0, Rebuild=10, Refit=0.01})
loft_2 = Loft(
    Curves=[scale_2.Geometry, scale_3.Geometry],
    Options={Adjust=False, Closed=False, LoftEnds=0, LoftSimp=0, LoftType=0, Rebuild=10, Refit=0.01})
loft_3 = Loft(
    Curves=[scale_2.Geometry, move_2.Geometry],
    Options={Adjust=False, Closed=False, LoftEnds=0, LoftSimp=0, LoftType=0, Rebuild=10, Refit=0.01})
brep_join = BrepJoin(Breps=flatten([loft_3, loft, loft_2]))  # -> Breps, Closed
bounding_box_2 = BoundingBox(Content=brep_join.Breps, Plane=PlaneXY(0, 0, 0))  # -> Box, Box_2
surface_box_2 = SurfaceBox(Surface=surface_2, Domain=divide_domain²_2, Height=Slider(11, range=0..100))
box_morph_2 = BoxMorph(Geometry=brep_join.Breps, Reference=bounding_box_2.Box, Target=surface_box_2)
