# Grasshopper definition 1025.gh (Grasshopper 1.0.7)
# plug-ins: Bifocals, LunchBox

rectangle = Rectangle(Plane=PlaneXY(0, 0, 0), XSize=Slider(25000, range=0..100000), YSize=Slider(250, range=0..1000), Radius=0)  # -> Rectangle, Length
number_slider = Slider(20, range=0..100)
curve = Curve(rectangle.Rectangle)
point = Point(<point referenced from the Rhino model>)
rotate = Rotate(Geometry=curve, Angle=degrees(Slider(90, range=0..100)), Plane=PlaneXY(0, 0, 0))  # -> Geometry, Transform
sphere = Sphere(Base=point, Radius=Slider(5000, range=0..10000))
diamond_panels = DiamondPanels(Surface=sphere, UDivisions=number_slider, VDivisions=number_slider)  # -> DiamondPanels, TriPanels
number_slider_2 = Slider(10000, range=0..10000)
curve_2 = Curve(<curve referenced from the Rhino model>)
boundary_surfaces = BoundarySurfaces(Edges=curve_2)

construct_domain = ConstructDomain(DomainStart=Slider(3118, range=0..10000), DomainEnd=Slider(23000, range=0..100000))
range = Range(Domain=construct_domain, Steps=Slider(7, range=0..10))
unit_y = UnitY(Factor=range)
move = Move(Geometry=curve, Motion=unit_y)  # -> Geometry, Transform

construct_domain_2 = ConstructDomain(DomainStart=Slider(3118, range=0..10000), DomainEnd=Slider(23000, range=0..100000))
range_2 = Range(Domain=construct_domain_2, Steps=Slider(7, range=0..10))
unit_x = UnitX(Factor=range_2)
move_2 = Move(Geometry=rotate.Geometry, Motion=unit_x)  # -> Geometry, Transform

deconstruct_brep = DeconstructBrep(Brep=diamond_panels.DiamondPanels)  # -> Faces, Edges, Vertices
range_3 = Range(Domain=Slider(37000, range=0..100000), Steps=Slider(9, range=0..100))
divide_domain² = DivideDomain²(Domain=sphere, UCount=Slider(11, range=0..100), VCount=Slider(12, range=0..100))
isotrim = Isotrim(Surface=sphere, Domain=divide_domain²)
deconstruct_brep_2 = DeconstructBrep(Brep=boundary_surfaces)  # -> Faces, Edges, Vertices
curve_3 = Curve(<curve referenced from the Rhino model>)
divide_domain²_2 = DivideDomain²(Domain=boundary_surfaces, UCount=10, VCount=10)
isotrim_2 = Isotrim(Surface=boundary_surfaces, Domain=divide_domain²_2)
list_item = ListItem(List=deconstruct_brep_2.Vertices, Index=Slider(1, range=0..10), Wrap=True)  # -> Item, Item1
vector_2pt = Vector2Pt(PointA=list_item.Item, PointB=list_item.Item1, Unitize=False)  # -> Vector, Length
amplitude = Amplitude(Vector=vector_2pt.Vector, Amplitude=range_3)
construct_domain² = ConstructDomain²(UMin=Slider(0.056, range=0..1), UMax=Slider(1, range=0..1), VMin=Slider(0.104, range=0..1), VMax=Slider(1, range=0..1))
number_slider_3 = Slider(20, range=0..100)
deconstruct_brep_3 = DeconstructBrep(Brep=isotrim_2)  # -> Faces, Edges, Vertices
isotrim_3 = Isotrim(Surface=reparameterize(isotrim), Domain=construct_domain²)
move_3 = Move(Geometry=curve_3, Motion=amplitude)  # -> Geometry, Transform

area = Area(Geometry=isotrim)  # -> Area, Centroid
scale = Scale(Geometry=isotrim, Center=area.Centroid, Factor=Slider(0.719, range=0..1))  # -> Geometry, Transform

md_slider = MDSlider(SliderMode=0, slider_value=Point(0.5, 0.5, 0.5), x_domain=Domain(0, 1), y_domain=Domain(0, 1), z_domain=Domain(0, 1))
value_list = ValueList({"One": 1, "Two": 2, "Three": 2² - 1, "Four": Sqrt(16)}, selected="One")
list_item_2 = ListItem(List=flatten(deconstruct_brep_3.Vertices), Index=0, Wrap=True)
diamond_panels_2 = DiamondPanels(Surface=sphere, UDivisions=number_slider_3, VDivisions=number_slider_3)  # -> DiamondPanels, TriPanels
surface_split = SurfaceSplit(Surface=boundary_surfaces, Curves=move_3.Geometry)
unit_z = UnitZ(Factor=Slider(20000, range=0..100000))
extrude = Extrude(Base=[move.Geometry, move_2.Geometry], Direction=unit_z)
line_sdl = LineSDL(Start=list_item_2, Direction=Vector(0, 0, 1), Length=1)
evaluate_surface = EvaluateSurface(Surface=reparameterize(isotrim_3), Point=md_slider)  # -> Point, Normal, UDirection, VDirection, Frame
area_2 = Area(Geometry=diamond_panels_2.DiamondPanels)  # -> Area, Centroid
surface = Surface(<surface referenced from the Rhino model>)
split_brep = SplitBrep(Brep=extrude, Cutter=surface)
amplitude_2 = Amplitude(Vector=evaluate_surface.Normal, Amplitude=Slider(100, range=0..1000))
scale_2 = Scale(Geometry=diamond_panels_2.DiamondPanels, Center=area_2.Centroid, Factor=0.5)  # -> Geometry, Transform
extrude_2 = Extrude(Base=isotrim_3, Direction=amplitude_2)
solid_difference = SolidDifference(BrepsA=sphere, BrepsB=isotrim_3)
panel = Panel(split_brep)
param_viewer = ParamViewer(split_brep)
list_item_3 = ListItem(List=split_brep, Index=Slider(0, range=0..100), Wrap=True)
