# Grasshopper definition 0913.gh (Grasshopper 1.0.7)

brep = Brep(<brep referenced from the Rhino model>)
point = Point(<point referenced from the Rhino model>)
point_2 = Point([<point referenced from the Rhino model> x105])
vector_2pt = Vector2Pt(PointA=point, PointB=point_2, Unitize=False)  # -> Vector, Length
move = Move(Geometry=brep, Motion=vector_2pt.Vector)  # -> Geometry, Transform
