# Grasshopper definition 0918 건디응.gh (Grasshopper 1.0.7)

point = Point(<point referenced from the Rhino model>)
point_2 = Point([<point referenced from the Rhino model> x106])
brep = Brep(<brep referenced from the Rhino model>)
vector_2pt = Vector2Pt(PointA=point, PointB=point_2, Unitize=False)  # -> Vector, Length
move = Move(Geometry=brep, Motion=vector_2pt.Vector)  # -> Geometry, Transform
