# Grasshopper definition 0920.gh (Grasshopper 1.0.7)

# No Data
curve = Curve()
# not preview
curve_2 = Curve(<curve referenced from the Rhino model>)
# With Data
curve_3 = Curve(<curve referenced from the Rhino model>)
# disabled
curve_4 = Curve(<curve referenced from the Rhino model>)
surface = Surface(<surface referenced from the Rhino model>)
brep = Brep(<brep referenced from the Rhino model>)
volume = Volume(Geometry=brep)  # -> Volume, Centroid
curve_5 = Curve(<curve referenced from the Rhino model>)
curve_6 = Curve(<curve referenced from the Rhino model>)
curve_7 = Curve(<curve referenced from the Rhino model>)
surface_2 = Surface(<surface referenced from the Rhino model>)
curve_8 = Curve(<curve referenced from the Rhino model>)
curve_9 = Curve(<curve referenced from the Rhino model>)
brep_2 = Brep(<brep referenced from the Rhino model>)
volume_2 = Volume(Geometry=brep_2)  # -> Volume, Centroid
surface_3 = Surface(<surface referenced from the Rhino model>)
curve_10 = Curve(<curve referenced from the Rhino model>)
brep_3 = Brep(<brep referenced from the Rhino model>)
surface_4 = Surface(<surface referenced from the Rhino model>)
end_points = EndPoints(Curve=curve_10)  # -> Start, End
divide_domain² = DivideDomain²(Domain=surface_2, UCount=Slider(7, range=0..10), VCount=Slider(8, range=0..10))
loft = Loft(
    Curves=[curve_6, curve_7, curve_5],
    Options={Adjust=False, Closed=False, LoftEnds=0, LoftSimp=0, LoftType=0, Rebuild=10, Refit=0.01})
divide_domain²_2 = DivideDomain²(Domain=surface_3, UCount=Slider(11, range=0..100), VCount=Slider(12, range=0..100))
divide_domain²_3 = DivideDomain²(Domain=surface_4, UCount=Slider(11, range=0..100), VCount=Slider(12, range=0..100))
divide_curve = DivideCurve(Curve=curve_8, Count=Slider(7, range=0..10), Kinks=False)  # -> Points, Tangents, Parameters
divide_curve_2 = DivideCurve(Curve=curve_9, Count=Slider(7, range=0..10), Kinks=False)  # -> Points, Tangents, Parameters
scale = Scale(Geometry=brep, Center=volume.Centroid, Factor=Slider(0.7, range=0..1))  # -> Geometry, Transform
vector_2pt = Vector2Pt(PointA=end_points.Start, PointB=end_points.End, Unitize=False)  # -> Vector, Length
move = Move(Geometry=brep_3, Motion=vector_2pt.Vector)  # -> Geometry, Transform
rotate = Rotate(Geometry=brep_2, Angle=degrees(Slider(45, range=0..100)), Plane=volume_2.Centroid)  # -> Geometry, Transform
isotrim = Isotrim(Surface=surface_3, Domain=divide_domain²_2)
isotrim_2 = Isotrim(Surface=surface_2, Domain=divide_domain²)
isotrim_3 = Isotrim(Surface=surface_4, Domain=divide_domain²_3)
line = Line(StartPoint=divide_curve.Points, EndPoint=divide_curve_2.Points)
area = Area(Geometry=isotrim_3)  # -> Area, Centroid
area_2 = Area(Geometry=isotrim)  # -> Area, Centroid
scale_2 = Scale(Geometry=isotrim_3, Center=area.Centroid, Factor=Slider(0.7, range=0..1))  # -> Geometry, Transform
scale_3 = Scale(Geometry=isotrim, Center=area_2.Centroid, Factor=Slider(0.789, range=0..1))  # -> Geometry, Transform
rotate_2 = Rotate(Geometry=scale_2.Geometry, Angle=degrees(Slider(173, range=0..1000)), Plane=area.Centroid)  # -> Geometry, Transform
