# Grasshopper definition 0925.gh (Grasshopper 1.0.7)

brep = Brep(<brep referenced from the Rhino model>)
brep_2 = Brep(<brep referenced from the Rhino model>)
curve = Curve(<curve referenced from the Rhino model>)
brep_3 = Brep(<brep referenced from the Rhino model>)
brep_4 = Brep(<brep referenced from the Rhino model>)
curve_2 = Curve(<curve referenced from the Rhino model>)
curve_3 = Curve(<curve referenced from the Rhino model>)
curve_4 = Curve(<curve referenced from the Rhino model>)
curve_5 = Curve(<curve referenced from the Rhino model>)
curve_6 = Curve(<curve referenced from the Rhino model>)
point = Point(<point referenced from the Rhino model>)
point_2 = Point(<point referenced from the Rhino model>)
point_3 = Point(<point referenced from the Rhino model>)
point_4 = Point(<point referenced from the Rhino model>)
curve_7 = Curve(<curve referenced from the Rhino model>)
curve_8 = Curve(<curve referenced from the Rhino model>)
curve_9 = Curve(<curve referenced from the Rhino model>)
curve_10 = Curve(<curve referenced from the Rhino model>)
curve_11 = Curve(<curve referenced from the Rhino model>)
curve_12 = Curve(<curve referenced from the Rhino model>)
curve_13 = Curve(<curve referenced from the Rhino model>)
# No Data
curve_14 = Curve()
# not preview
curve_15 = Curve(<curve referenced from the Rhino model>)
# With Data
curve_16 = Curve(<curve referenced from the Rhino model>)
# disabled
curve_17 = Curve(<curve referenced from the Rhino model>)
curve_18 = Curve(<curve referenced from the Rhino model>)
curve_19 = Curve(<curve referenced from the Rhino model>)
number_slider = Slider(5000, range=0..10000)
surface = Surface(<surface referenced from the Rhino model>)
brep_5 = Brep(<brep referenced from the Rhino model>)
volume = Volume(Geometry=brep_5)  # -> Volume, Centroid
curve_20 = Curve(<curve referenced from the Rhino model>)
curve_21 = Curve(<curve referenced from the Rhino model>)
curve_22 = Curve(<curve referenced from the Rhino model>)
surface_2 = Surface(<surface referenced from the Rhino model>)
curve_23 = Curve(<curve referenced from the Rhino model>)
number_slider_2 = Slider(15000, range=0..100000)
curve_24 = Curve(<curve referenced from the Rhino model>)
brep_6 = Brep(<brep referenced from the Rhino model>)
volume_2 = Volume(Geometry=brep_6)  # -> Volume, Centroid
end_points = EndPoints(Curve=curve)  # -> Start, End
surface_3 = Surface(<surface referenced from the Rhino model>)
end_points_2 = EndPoints(Curve=curve_2)  # -> Start, End
end_points_3 = EndPoints(Curve=curve_8)  # -> Start, End
end_points_4 = EndPoints(Curve=curve_3)  # -> Start, End
curve_25 = Curve(<curve referenced from the Rhino model>)
brep_7 = Brep(<brep referenced from the Rhino model>)
surface_4 = Surface(<surface referenced from the Rhino model>)

random = Random(Range=Domain(0, 1), Number=1, Seed=2)
range = Range(Domain=Domain(0, 1), Steps=10)
series = Series(Start=0, Step=1, Count=10)

end_points_5 = EndPoints(Curve=curve_25)  # -> Start, End
network_surface = NetworkSurface(CurvesU=[curve_9, curve_11], CurvesV=[curve_12, curve_10], Continuity=2)
boundary_surfaces = BoundarySurfaces(Edges=[curve_4, curve_7, curve_5, curve_6])
_4point_surface = _4PointSurface(CornerA=point, CornerB=point_2, CornerC=point_3, CornerD=point_4)
construct_domain = ConstructDomain(DomainStart=Slider(3000, range=0..10000), DomainEnd=Slider(25000, range=0..100000))
vector_2pt = Vector2Pt(PointA=end_points.Start, PointB=end_points.End, Unitize=False)  # -> Vector, Length
divide_domain² = DivideDomain²(Domain=surface_2, UCount=Slider(7, range=0..10), VCount=Slider(8, range=0..10))
loft = Loft(
    Curves=[curve_21, curve_22, curve_20],
    Options={Adjust=False, Closed=False, LoftEnds=0, LoftSimp=0, LoftType=0, Rebuild=10, Refit=0.01})
vector_2pt_2 = Vector2Pt(PointA=end_points_2.Start, PointB=end_points_2.End, Unitize=False)  # -> Vector, Length
vector_2pt_3 = Vector2Pt(PointA=end_points_4.Start, PointB=end_points_4.End, Unitize=False)  # -> Vector, Length
divide_domain²_2 = DivideDomain²(Domain=surface_3, UCount=Slider(11, range=0..100), VCount=Slider(12, range=0..100))
construct_domain_2 = ConstructDomain(DomainStart=Slider(3000, range=0..10000), DomainEnd=Slider(25000, range=0..100000))
vector_2pt_4 = Vector2Pt(PointA=end_points_3.Start, PointB=end_points_3.End, Unitize=False)  # -> Vector, Length
unit_z = UnitZ(Factor=Slider(9086, range=0..10000))
series_2 = Series(Start=Slider(2000, range=0..10000), Step=Slider(2000, range=0..10000), Count=Slider(16, range=0..100))
series_3 = Series(Start=Slider(2000, range=0..10000), Step=Slider(2000, range=0..10000), Count=Slider(16, range=0..100))
divide_domain²_3 = DivideDomain²(Domain=surface_4, UCount=Slider(11, range=0..100), VCount=Slider(12, range=0..100))
divide_curve = DivideCurve(Curve=curve_23, Count=Slider(7, range=0..10), Kinks=False)  # -> Points, Tangents, Parameters
divide_curve_2 = DivideCurve(Curve=curve_24, Count=Slider(7, range=0..10), Kinks=False)  # -> Points, Tangents, Parameters
series_4 = Series(Start=Slider(1426, range=0..10000), Step=Slider(5000, range=0..10000), Count=Slider(7, range=0..10))
scale = Scale(Geometry=brep_5, Center=volume.Centroid, Factor=Slider(0.7, range=0..1))  # -> Geometry, Transform
vector_2pt_5 = Vector2Pt(PointA=end_points_5.Start, PointB=end_points_5.End, Unitize=False)  # -> Vector, Length
move = Move(Geometry=brep_7, Motion=vector_2pt_5.Vector)  # -> Geometry, Transform
rotate = Rotate(Geometry=brep_6, Angle=degrees(Slider(45, range=0..100)), Plane=volume_2.Centroid)  # -> Geometry, Transform
unit_z_2 = UnitZ(Factor=series_2)
unit_z_3 = UnitZ(Factor=series_3)
move_2 = Move(Geometry=curve_13, Motion=unit_z)  # -> Geometry, Transform
isotrim = Isotrim(Surface=surface_3, Domain=divide_domain²_2)
addition = Addition(A=number_slider, B=number_slider_2)
amplitude = Amplitude(Vector=vector_2pt_4.Vector, Amplitude=[number_slider, number_slider_2, addition])
amplitude_2 = Amplitude(Vector=vector_2pt_3.Vector, Amplitude=series_4)
isotrim_2 = Isotrim(Surface=surface_2, Domain=divide_domain²)
isotrim_3 = Isotrim(Surface=surface_4, Domain=divide_domain²_3)
range_2 = Range(Domain=construct_domain_2, Steps=Slider(7, range=0..10))
amplitude_3 = Amplitude(Vector=vector_2pt_2.Vector, Amplitude=range_2)
random_2 = Random(Range=construct_domain, Number=Slider(7, range=0..100), Seed=2)
amplitude_4 = Amplitude(Vector=vector_2pt.Vector, Amplitude=random_2)
move_3 = Move(Geometry=brep, Motion=amplitude_4)  # -> Geometry, Transform
move_4 = Move(Geometry=brep_2, Motion=amplitude_3)  # -> Geometry, Transform
move_5 = Move(Geometry=brep_3, Motion=amplitude_2)  # -> Geometry, Transform
move_6 = Move(Geometry=brep_4, Motion=amplitude)  # -> Geometry, Transform
line = Line(StartPoint=divide_curve.Points, EndPoint=divide_curve_2.Points)
area = Area(Geometry=isotrim_3)  # -> Area, Centroid
move_7 = Move(Geometry=curve_18, Motion=unit_z_2)  # -> Geometry, Transform
move_8 = Move(Geometry=curve_19, Motion=unit_z_3)  # -> Geometry, Transform
area_2 = Area(Geometry=isotrim)  # -> Area, Centroid
area_3 = Area(Geometry=move_2.Geometry)  # -> Area, Centroid
construct_domain_3 = ConstructDomain(DomainStart=Slider(0, range=0..100), DomainEnd=Slider(360, range=0..1000))
construct_domain_4 = ConstructDomain(DomainStart=Slider(0, range=0..100), DomainEnd=Slider(360, range=0..1000))
panel = Panel(series_4)
panel_2 = Panel(range_2)
panel_3 = Panel(random_2)
scale_2 = Scale(Geometry=isotrim_3, Center=area.Centroid, Factor=Slider(0.7, range=0..1))  # -> Geometry, Transform
scale_3 = Scale(Geometry=isotrim, Center=area_2.Centroid, Factor=Slider(0.789, range=0..1))  # -> Geometry, Transform
rotate_2 = Rotate(Geometry=move_2.Geometry, Angle=degrees(Slider(240, range=0..1000)), Plane=area_3.Centroid)  # -> Geometry, Transform
area_4 = Area(Geometry=move_7.Geometry)  # -> Area, Centroid
area_5 = Area(Geometry=move_8.Geometry)  # -> Area, Centroid
random_3 = Random(Range=construct_domain_3, Number=Slider(16, range=0..100), Seed=2)
range_3 = Range(Domain=construct_domain_4, Steps=Slider(15, range=0..100))
rotate_3 = Rotate(Geometry=scale_2.Geometry, Angle=degrees(Slider(173, range=0..1000)), Plane=area.Centroid)  # -> Geometry, Transform
loft_2 = Loft(
    Curves=[rotate_2.Geometry, curve_13],
    Options={Adjust=False, Closed=False, LoftEnds=0, LoftSimp=0, LoftType=0, Rebuild=10, Refit=0.01})
rotate_4 = Rotate(Geometry=move_7.Geometry, Angle=degrees(random_3), Plane=area_4.Centroid)  # -> Geometry, Transform
rotate_5 = Rotate(Geometry=move_8.Geometry, Angle=degrees(range_3), Plane=area_5.Centroid)  # -> Geometry, Transform
loft_3 = Loft(
    Curves=[rotate_4.Geometry, curve_18],
    Options={Adjust=False, Closed=False, LoftEnds=0, LoftSimp=0, LoftType=0, Rebuild=10, Refit=0.01})
loft_4 = Loft(
    Curves=[rotate_5.Geometry, curve_19],
    Options={Adjust=False, Closed=False, LoftEnds=0, LoftSimp=0, LoftType=0, Rebuild=10, Refit=0.01})
