# Grasshopper definition 1004-2.gh (Grasshopper 1.0.7)

number_slider = Slider(10, range=0..10)
curve = Curve(<curve referenced from the Rhino model>)
curve_2 = Curve(<curve referenced from the Rhino model>)
curve_3 = Curve(<curve referenced from the Rhino model>)
brep = Brep([<brep referenced from the Rhino model> x8])
panel = Panel(brep)
loft = Loft(
    Curves=[curve, curve_3, curve_2],
    Options={Adjust=False, Closed=False, LoftEnds=0, LoftSimp=0, LoftType=0, Rebuild=10, Refit=0.01})
rectangular = Rectangular(
    Plane=PlaneXY(0, 0, 0),
    SizeX=number_slider,
    SizeY=number_slider,
    ExtentX=Slider(7, range=0..10),
    ExtentY=Slider(9, range=0..10))  # -> Cells, Points
param_viewer = ParamViewer(rectangular.Cells)
divide_domain² = DivideDomain²(Domain=loft, UCount=Slider(11, range=0..100), VCount=Slider(12, range=0..100))

volume = Volume(Geometry=brep)  # -> Volume, Centroid
point_list = PointList(Points=volume.Centroid, Size=Slider(5, range=0..10))

isotrim = Isotrim(Surface=loft, Domain=divide_domain²)
construct_domain = ConstructDomain(DomainStart=Slider(0, range=0..100), DomainEnd=Slider(131, range=0..1000))

area = Area(Geometry=rectangular.Cells)  # -> Area, Centroid
point_list_2 = PointList(Points=area.Centroid, Size=Slider(5, range=0..10))

panel_2 = Panel(rectangular.Cells)
random = Random(Range=construct_domain, Number=Slider(50, range=0..100), Seed=Slider(23, range=0..100))

area_2 = Area(Geometry=isotrim)  # -> Area, Centroid
point_list_3 = PointList(Points=area_2.Centroid, Size=Slider(2, range=0..10))

list_item = ListItem(List=isotrim, Index=random, Wrap=True)
list_item_2 = ListItem(List=rectangular.Cells, Index=Slider(3, range=0..10), Wrap=True)
area_3 = Area(Geometry=list_item)  # -> Area, Centroid
construct_domain_2 = ConstructDomain(DomainStart=Slider(0.2, range=0..1), DomainEnd=Slider(0.8, range=0..1))
random_2 = Random(Range=construct_domain_2, Number=Slider(50, range=0..100), Seed=Slider(23, range=0..100))
scale = Scale(Geometry=list_item, Center=area_3.Centroid, Factor=random_2)  # -> Geometry, Transform
md_slider = MDSlider(
    SliderMode=0,
    slider_value=Point(0.4101279654, 0.5399430438, 0.5),
    x_domain=Domain(0, 1),
    y_domain=Domain(0, 1),
    z_domain=Domain(0, 1))
evaluate_surface = EvaluateSurface(Surface=reparameterize(scale.Geometry), Point=md_slider)  # -> Point, Normal, UDirection, VDirection, Frame

amplitude = Amplitude(Vector=evaluate_surface.Normal, Amplitude=Slider(10, range=0..100))
negative = Negative(Value=amplitude)
vector_display = VectorDisplay(Anchor=evaluate_surface.Point, Vector=negative)

amplitude_2 = Amplitude(Vector=evaluate_surface.Normal, Amplitude=Slider(5, range=0..100))
negative_2 = Negative(Value=amplitude_2)
extrude = Extrude(Base=scale.Geometry, Direction=negative_2)
