# Grasshopper definition 1011-1.gh (Grasshopper 1.0.7)

number_slider = Slider(10, range=0..10)
number_slider_2 = Slider(10, range=0..10)
rectangular = Rectangular(
    Plane=PlaneXY(0, 0, 0),
    SizeX=number_slider,
    SizeY=number_slider,
    ExtentX=Slider(7, range=0..10),
    ExtentY=Slider(8, range=0..10))  # -> Cells, Points
rectangular_2 = Rectangular(
    Plane=PlaneXY(0, 0, 0),
    SizeX=number_slider_2,
    SizeY=number_slider_2,
    ExtentX=Slider(7, range=0..10),
    ExtentY=Slider(8, range=0..10))  # -> Cells, Points
area = Area(Geometry=rectangular.Cells)  # -> Area, Centroid
graft_tree = GraftTree(Tree=rectangular.Cells, IncludeEmptyLists=True, IncludeNullItems=True)
area_2 = Area(Geometry=rectangular_2.Cells)  # -> Area, Centroid
flatten_tree = FlattenTree(Tree=rectangular_2.Cells, Path="{0}")
param_viewer = ParamViewer(graft_tree)
area_3 = Area(Geometry=flatten_tree)  # -> Area, Centroid
point_list = PointList(Points=area.Centroid, Size=Slider(5, range=0..10))
point_list_2 = PointList(Points=area_2.Centroid, Size=Slider(5, range=0..10))
area_4 = Area(Geometry=graft_tree)  # -> Area, Centroid
point_list_3 = PointList(Points=area_3.Centroid, Size=Slider(5, range=0..10))
point_list_4 = PointList(Points=area_4.Centroid, Size=Slider(5, range=0..10))
list_item = ListItem(List=rectangular_2.Cells, Index=Slider(3, range=0..10), Wrap=True)
