# Grasshopper definition 1016-1.gh (Grasshopper 1.0.7)

number_slider = Slider(10, range=0..10)
number_slider_2 = Slider(10, range=0..10)
number_slider_3 = Slider(10, range=0..10)
number_slider_4 = Slider(10, range=0..10)
point = Point(<point referenced from the Rhino model>)
point_2 = Point(<point referenced from the Rhino model>)
point_3 = Point(<point referenced from the Rhino model>)
rectangular = Rectangular(
    Plane=PlaneXY(0, 0, 0),
    SizeX=number_slider,
    SizeY=number_slider,
    ExtentX=Slider(7, range=0..10),
    ExtentY=Slider(8, range=0..10))  # -> Cells, Points
rectangular_2 = Rectangular(
    Plane=point,
    SizeX=number_slider_2,
    SizeY=number_slider_2,
    ExtentX=Slider(7, range=0..10),
    ExtentY=Slider(8, range=0..10))  # -> Cells, Points
rectangular_3 = Rectangular(
    Plane=point_2,
    SizeX=number_slider_3,
    SizeY=number_slider_3,
    ExtentX=Slider(7, range=0..10),
    ExtentY=Slider(8, range=0..10))  # -> Cells, Points
rectangular_4 = Rectangular(
    Plane=point_3,
    SizeX=number_slider_4,
    SizeY=number_slider_4,
    ExtentX=Slider(7, range=0..10),
    ExtentY=Slider(8, range=0..10))  # -> Cells, Points
area = Area(Geometry=rectangular_2.Cells)  # -> Area, Centroid
flatten_tree = FlattenTree(Tree=rectangular.Cells, Path="{0}")
graft_tree = GraftTree(Tree=rectangular.Cells, IncludeEmptyLists=True, IncludeNullItems=True)
area_2 = Area(Geometry=rectangular_3.Cells)  # -> Area, Centroid
area_3 = Area(Geometry=rectangular_4.Cells)  # -> Area, Centroid
panel = Panel(rectangular.Cells)
panel_2 = Panel(flatten_tree)
panel_3 = Panel(graft_tree)
scale = Scale(Geometry=rectangular_2.Cells, Center=area.Centroid, Factor=Slider(0.819, range=0..1))  # -> Geometry, Transform
scale_2 = Scale(Geometry=rectangular_3.Cells, Center=area_2.Centroid, Factor=Slider(0.819, range=0..1))  # -> Geometry, Transform
scale_3 = Scale(Geometry=rectangular_4.Cells, Center=area_3.Centroid, Factor=Slider(0.819, range=0..1))  # -> Geometry, Transform
graft_tree_2 = GraftTree(Tree=scale_3.Geometry, IncludeEmptyLists=True, IncludeNullItems=True)
flatten_tree_2 = FlattenTree(Tree=scale_2.Geometry, Path="{0}")
series = Series(Start=Slider(2, range=0..10), Step=Slider(2, range=0..10), Count=Slider(8, range=0..100))
unit_z = UnitZ(Factor=series)
series_2 = Series(Start=Slider(2, range=0..10), Step=Slider(2, range=0..10), Count=Slider(56, range=0..100))
unit_z_2 = UnitZ(Factor=series_2)
extrude = Extrude(Base=scale.Geometry, Direction=unit_z)
series_3 = Series(Start=Slider(2, range=0..10), Step=Slider(2, range=0..10), Count=Slider(56, range=0..100))
unit_z_3 = UnitZ(Factor=series_3)
extrude_2 = Extrude(Base=graft_tree_2, Direction=graft(unit_z_3))
extrude_3 = Extrude(Base=flatten_tree_2, Direction=unit_z_2)
