# Grasshopper definition 1023.gh (Grasshopper 1.0.7)

curve = Curve(<curve referenced from the Rhino model>)
unit_z = UnitZ(Factor=Slider(12, range=0..100))
move = Move(Geometry=curve, Motion=unit_z)  # -> Geometry, Transform
explode = Explode(Curve=move.Geometry, Recursive=True)  # -> Segments, Vertices
evaluate_curve = EvaluateCurve(Curve=reparameterize(explode.Segments), Parameter=Slider(0.5, range=0..1))  # -> Point, Tangent, Angle
interpolate = Interpolate(Vertices=evaluate_curve.Point, Degree=3, Periodic=Toggle(True), KnotStyle=1)  # -> Curve, Length, Domain

surface = Surface(<surface referenced from the Rhino model>)
surface_2 = Surface(<surface referenced from the Rhino model>)
divide_domain² = DivideDomain²(Domain=surface_2, UCount=Slider(9, range=0..100), VCount=Slider(16, range=0..100))
divide_domain²_2 = DivideDomain²(Domain=surface, UCount=Slider(9, range=0..100), VCount=Slider(16, range=0..100))
isotrim = Isotrim(Surface=surface_2, Domain=divide_domain²)
brep = Brep(<brep referenced from the Rhino model>)
isotrim_2 = Isotrim(Surface=surface, Domain=divide_domain²_2)
bounding_box = BoundingBox(Content=brep, Plane=PlaneXY(0, 0, 0))  # -> Box, Box_2
surface_box = SurfaceBox(Surface=surface_2, Domain=divide_domain², Height=Slider(15, range=0..100))
surface_box_2 = SurfaceBox(Surface=surface, Domain=divide_domain²_2, Height=Slider(15, range=0..100))
box_morph = BoxMorph(Geometry=brep, Reference=bounding_box.Box, Target=surface_box)

area = Area(Geometry=interpolate.Curve)  # -> Area, Centroid
scale = Scale(Geometry=interpolate.Curve, Center=area.Centroid, Factor=Slider(0.5, range=0..1))  # -> Geometry, Transform
unit_z_2 = UnitZ(Factor=Slider(11, range=0..100))
move_2 = Move(Geometry=scale.Geometry, Motion=unit_z_2)  # -> Geometry, Transform
negative = Negative(Value=Slider(2, range=0..10))
area_2 = Area(Geometry=move_2.Geometry)  # -> Area, Centroid
offset_curve = OffsetCurve(Curve=scale.Geometry, Distance=negative, Plane=PlaneXY(0, 0, 0), Corners=1)

scale_2 = Scale(Geometry=move_2.Geometry, Center=area_2.Centroid, Factor=Slider(1.7, range=0..10))  # -> Geometry, Transform
negative_2 = Negative(Value=Slider(3, range=0..100))
offset_curve_2 = OffsetCurve(Curve=scale_2.Geometry, Distance=negative_2, Plane=PlaneXY(0, 0, 0), Corners=1)

loft = Loft(
    Curves=flatten([curve, scale.Geometry, scale_2.Geometry]),
    Options={Adjust=False, Closed=False, LoftEnds=0, LoftSimp=0, LoftType=0, Rebuild=10, Refit=0.01})
loft_2 = Loft(
    Curves=flatten([offset_curve_2, scale_2.Geometry]),
    Options={Adjust=False, Closed=False, LoftEnds=0, LoftSimp=0, LoftType=0, Rebuild=10, Refit=0.01})
loft_3 = Loft(
    Curves=[offset_curve_2, offset_curve],
    Options={Adjust=False, Closed=False, LoftEnds=0, LoftSimp=0, LoftType=0, Rebuild=10, Refit=0.01})
brep_join = BrepJoin(Breps=flatten([loft, loft_2, loft_3]))  # -> Breps, Closed
bounding_box_2 = BoundingBox(Content=brep_join.Breps, Plane=PlaneXY(0, 0, 0))  # -> Box, Box_2
box_mapping = BoxMapping(Geometry=brep_join.Breps, Source=bounding_box_2.Box, Target=surface_box_2)  # -> Geometry, Transform
