# Grasshopper definition 1025-2.gh (Grasshopper 1.0.7)

point = Point(<point referenced from the Rhino model>)
sphere = Sphere(Base=point, Radius=Slider(5000, range=0..10000))
divide_domain² = DivideDomain²(Domain=sphere, UCount=Slider(11, range=0..100), VCount=Slider(12, range=0..100))
isotrim = Isotrim(Surface=sphere, Domain=divide_domain²)
construct_domain² = ConstructDomain²(
    UMin=Slider(0.123, range=0..1),
    UMax=Slider(0.897, range=0..1),
    VMin=Slider(0.123, range=0..1),
    VMax=Slider(0.897, range=0..1))

area = Area(Geometry=isotrim)  # -> Area, Centroid
scale = Scale(Geometry=isotrim, Center=area.Centroid, Factor=Slider(0.897, range=0..1))  # -> Geometry, Transform

isotrim_2 = Isotrim(Surface=reparameterize(isotrim), Domain=construct_domain²)
md_slider = MDSlider(SliderMode=0, slider_value=Point(0.5, 0.5, 0.5), x_domain=Domain(0, 1), y_domain=Domain(0, 1), z_domain=Domain(0, 1))
solid_difference = SolidDifference(BrepsA=isotrim, BrepsB=isotrim_2)
evaluate_surface = EvaluateSurface(Surface=reparameterize(solid_difference), Point=md_slider)  # -> Point, Normal, UDirection, VDirection, Frame
amplitude = Amplitude(Vector=evaluate_surface.Normal, Amplitude=Slider(150, range=0..1000))
extrude = Extrude(Base=solid_difference, Direction=amplitude)
