# Grasshopper definition 1025-3.gh (Grasshopper 1.0.7)

number_slider = Slider(500, range=0..1000)
curve = Curve(<curve referenced from the Rhino model>)
jitter = Jitter(Jitter=1, Seed=2)  # -> Values, Indices
point_in_brep = PointInBrep(Strict=False)
number_slider_2 = Slider(41, range=0..100)
populate_2d = Populate2D(Region=curve, Count=number_slider, Seed=1)
random = Random(Range=number_slider_2, Number=number_slider, Seed=2)
circle = Circle(Plane=populate_2d, Radius=number_slider_2)
