# Grasshopper definition 1030.gh (Grasshopper 1.0.7)
# plug-ins: LunchBox

surface = Surface(<surface referenced from the Rhino model>)
divide_domain² = DivideDomain²(Domain=surface, UCount=Slider(40, range=0..100), VCount=Slider(10, range=0..100))
isotrim = Isotrim(Surface=surface, Domain=divide_domain²)
random = Random(Range=Slider(400, range=0..1000), Number=Slider(150, range=0..1000), Seed=2)
cull_index = CullIndex(List=isotrim, Indices=random, Wrap=True)
random_split_list = RandomSplitList(MasterList=isotrim, Seed=2, Split=Slider(0.7, range=0..1))  # -> ListA, ListB
surface_2 = Surface(random_split_list.ListB)
surface_3 = Surface(random_split_list.ListA)
deconstruct_brep = DeconstructBrep(Brep=surface_3)  # -> Faces, Edges, Vertices
list_item = ListItem(List=deconstruct_brep.Vertices, Index=Slider(5, range=0..10), Wrap=True)
scale_nu = ScaleNU(
    Geometry=surface_3,
    Plane=flatten(list_item),
    ScaleX=Slider(0.17, range=0..1),
    ScaleY=Slider(0.4, range=0..1),
    ScaleZ=Slider(0.9, range=0..1))  # -> Geometry, Transform
md_slider = MDSlider(SliderMode=0, slider_value=Point(0.5, 0.5, 0.5), x_domain=Domain(0, 1), y_domain=Domain(0, 1), z_domain=Domain(0, 1))
random_split_list_2 = RandomSplitList(MasterList=isotrim, Seed=2, Split=Slider(0.4, range=0..1))  # -> ListA, ListB
evaluate_surface = EvaluateSurface(Surface=reparameterize(scale_nu.Geometry), Point=md_slider)  # -> Point, Normal, UDirection, VDirection, Frame
amplitude = Amplitude(Vector=evaluate_surface.Normal, Amplitude=Slider(200, range=0..1000))
amplitude_2 = Amplitude(Vector=evaluate_surface.Normal, Amplitude=Slider(100, range=0..100))
extrude = Extrude(Base=random_split_list_2.ListA, Direction=amplitude)
extrude_2 = Extrude(Base=random_split_list_2.ListB, Direction=amplitude_2)
amplitude_3 = Amplitude(Vector=evaluate_surface.Normal, Amplitude=Slider(500, range=0..1000))
extrude_3 = Extrude(Base=scale_nu.Geometry, Direction=amplitude_3)
