# Grasshopper definition 1101.gh (Grasshopper 1.0.7)
# plug-ins: LunchBox

surface = Surface(<surface referenced from the Rhino model>)
divide_domain² = DivideDomain²(Domain=surface, UCount=Slider(10, range=0..10), VCount=Slider(60, range=0..100))
isotrim = Isotrim(Surface=surface, Domain=divide_domain²)
random_split_list = RandomSplitList(MasterList=isotrim, Seed=2, Split=Slider(0.4, range=0..1))  # -> ListA, ListB
brep_edges = BrepEdges(Brep=random_split_list.ListA)  # -> Naked, Interior, NonManifold
graft_tree = GraftTree(Tree=random_split_list.ListA, IncludeEmptyLists=True, IncludeNullItems=True)
random_split_list_2 = RandomSplitList(MasterList=isotrim, Seed=Slider(2, range=0..10), Split=Slider(0.7, range=0..1))  # -> ListA, ListB
join_curves = JoinCurves(Curves=brep_edges.Naked, Preserve=False)
surface_2 = Surface(random_split_list_2.ListA)
surface_3 = Surface(random_split_list_2.ListB)
offset_on_srf = OffsetOnSrf(Curve=join_curves, Distance=Slider(50, range=0..100), Surface=graft_tree)
deconstruct_brep = DeconstructBrep(Brep=surface_2)  # -> Faces, Edges, Vertices
explode = Explode(Curve=offset_on_srf, Recursive=True)  # -> Segments, Vertices
construct_domain = ConstructDomain(DomainStart=Slider(0.01, range=0..0.01), DomainEnd=Slider(0.99, range=0..1))
list_item = ListItem(List=deconstruct_brep.Edges, Index=0, Wrap=True)
md_slider = MDSlider(SliderMode=0, slider_value=Point(0.5, 0.5, 0.5), x_domain=Domain(0, 1), y_domain=Domain(0, 1), z_domain=Domain(0, 1))
list_item_2 = ListItem(List=explode.Segments, Index="0", Wrap=True)  # -> Item, Item1, Item2, Item3
sub_curve = SubCurve(BaseCurve=reparameterize(list_item), Domain=construct_domain)
md_slider_2 = MDSlider(SliderMode=0, slider_value=Point(0.5, 0.5, 0.5), x_domain=Domain(0, 1), y_domain=Domain(0, 1), z_domain=Domain(0, 1))
edge_surface = EdgeSurface(CurveA=list_item_2.Item, CurveB=list_item_2.Item1, CurveC=list_item_2.Item2, CurveD=list_item_2.Item3)
evaluate_surface = EvaluateSurface(Surface=reparameterize(surface_2), Point=md_slider)  # -> Point, Normal, UDirection, VDirection, Frame
evaluate_surface_2 = EvaluateSurface(Surface=reparameterize(edge_surface), Point=md_slider_2)  # -> Point, Normal, UDirection, VDirection, Frame
amplitude = Amplitude(Vector=evaluate_surface.Normal, Amplitude=Slider(500, range=0..1000))
extrude = Extrude(Base=sub_curve, Direction=graft(amplitude))
amplitude_2 = Amplitude(Vector=evaluate_surface_2.Normal, Amplitude=Slider(100, range=0..100))
extrude_2 = Extrude(Base=edge_surface, Direction=amplitude_2)
unit_z = UnitZ(Factor=Slider(100, range=0..1000))
extrude_3 = Extrude(Base=extrude, Direction=unit_z)
