# Grasshopper definition 1106.gh (Grasshopper 1.0.7)
# plug-ins: LunchBox

surface = Surface(<surface referenced from the Rhino model>)
divide_domain² = DivideDomain²(Domain=surface, UCount=Slider(10, range=0..10), VCount=Slider(60, range=0..100))
curve = Curve(<curve referenced from the Rhino model>)
isotrim = Isotrim(Surface=surface, Domain=divide_domain²)
random_split_list = RandomSplitList(MasterList=isotrim, Seed=2, Split=Slider(0.4, range=0..1))  # -> ListA, ListB
unit_x = UnitX(Factor=Slider(80000, range=0..100000))
move = Move(Geometry=curve, Motion=unit_x)  # -> Geometry, Transform
curve_2 = Curve(<curve referenced from the Rhino model>)
deconstruct_brep = DeconstructBrep(Brep=surface)  # -> Faces, Edges, Vertices
series = Series(Start=0, Step=Slider(3000, range=0..10000), Count=Slider(20, range=0..100))
unit_z = UnitZ(Factor=series)
series_2 = Series(Start=0, Step=Slider(3000, range=0..10000), Count=Slider(20, range=0..100))
unit_z_2 = UnitZ(Factor=series_2)
brep_edges = BrepEdges(Brep=random_split_list.ListA)  # -> Naked, Interior, NonManifold
move_2 = Move(Geometry=curve_2, Motion=unit_z)  # -> Geometry, Transform
move_3 = Move(Geometry=move.Geometry, Motion=unit_z_2)  # -> Geometry, Transform
brep_edges_2 = BrepEdges(Brep=random_split_list.ListB)  # -> Naked, Interior, NonManifold
list_item = ListItem(List=deconstruct_brep.Edges, Index=Slider(0, range=0..10), Wrap=True)
graft_tree = GraftTree(Tree=random_split_list.ListA, IncludeEmptyLists=True, IncludeNullItems=True)
random_split_list_2 = RandomSplitList(MasterList=isotrim, Seed=Slider(2, range=0..10), Split=Slider(0.7, range=0..1))  # -> ListA, ListB
negative = Negative(Value=Slider(1000, range=0..1000))
graft_tree_2 = GraftTree(Tree=random_split_list.ListB, IncludeEmptyLists=True, IncludeNullItems=True)
join_curves = JoinCurves(Curves=brep_edges.Naked, Preserve=False)
join_curves_2 = JoinCurves(Curves=brep_edges_2.Naked, Preserve=False)
offset_curve = OffsetCurve(Curve=list_item, Distance=negative, Plane=PlaneXY(0, 0, 0), Corners=1)
list_length = ListLength(List=move_2.Geometry)
surface_2 = Surface(random_split_list_2.ListA)
list_length_2 = ListLength(List=move_3.Geometry)
surface_3 = Surface(random_split_list_2.ListB)
offset_on_srf = OffsetOnSrf(Curve=join_curves, Distance=Slider(50, range=0..100), Surface=graft_tree)
area = Area(Geometry=move_2.Geometry)  # -> Area, Centroid
area_2 = Area(Geometry=move_3.Geometry)  # -> Area, Centroid
deconstruct_brep_2 = DeconstructBrep(Brep=surface_2)  # -> Faces, Edges, Vertices
offset_on_srf_2 = OffsetOnSrf(Curve=join_curves_2, Distance=Slider(50, range=0..100), Surface=graft_tree_2)
subtraction = Subtraction(A=list_length, B="1")
subtraction_2 = Subtraction(A=list_length_2, B="1")
unit_z_3 = UnitZ(Factor=Slider(200, range=0..1000))
construct_domain = ConstructDomain(DomainStart=Slider(0, range=0..100), DomainEnd=Slider(60, range=0..100))
explode = Explode(Curve=offset_on_srf, Recursive=True)  # -> Segments, Vertices
extrude = Extrude(Base=offset_curve, Direction=unit_z_3)
construct_domain_2 = ConstructDomain(DomainStart=Slider(0, range=0..100), DomainEnd=Slider(60, range=0..100))
construct_domain_3 = ConstructDomain(DomainStart=Slider(0.01, range=0..0.01), DomainEnd=Slider(0.99, range=0..1))
offset_on_srf_3 = OffsetOnSrf(Curve=offset_on_srf_2, Distance=Slider(50, range=0..100), Surface=graft_tree_2)
list_item_2 = ListItem(List=deconstruct_brep_2.Edges, Index=0, Wrap=True)
cap_holes = CapHoles(Brep=extrude)
graft_tree_3 = GraftTree(Tree=offset_on_srf_2, IncludeEmptyLists=True, IncludeNullItems=True)
md_slider = MDSlider(SliderMode=0, slider_value=Point(0.5, 0.5, 0.5), x_domain=Domain(0, 1), y_domain=Domain(0, 1), z_domain=Domain(0, 1))
list_item_3 = ListItem(List=explode.Segments, Index="0", Wrap=True)  # -> Item, Item1, Item2, Item3
range = Range(Domain=construct_domain, Steps=subtraction)
range_2 = Range(Domain=construct_domain_2, Steps=subtraction_2)
sub_curve = SubCurve(BaseCurve=reparameterize(list_item_2), Domain=construct_domain_3)
series_3 = Series(Start=0, Step=Slider(3000, range=0..10000), Count=10)
unit_z_4 = UnitZ(Factor=series_3)
rotate = Rotate(Geometry=move_2.Geometry, Angle=degrees(range), Plane=area.Centroid)  # -> Geometry, Transform
explode_2 = Explode(Curve=offset_on_srf_3, Recursive=True)  # -> Segments, Vertices
rotate_2 = Rotate(Geometry=move_3.Geometry, Angle=degrees(range_2), Plane=area_2.Centroid)  # -> Geometry, Transform
move_4 = Move(Geometry=cap_holes, Motion=unit_z_4)  # -> Geometry, Transform
md_slider_2 = MDSlider(SliderMode=0, slider_value=Point(0.5, 0.5, 0.5), x_domain=Domain(0, 1), y_domain=Domain(0, 1), z_domain=Domain(0, 1))
edge_surface = EdgeSurface(CurveA=list_item_3.Item, CurveB=list_item_3.Item1, CurveC=list_item_3.Item2, CurveD=list_item_3.Item3)
md_slider_3 = MDSlider(SliderMode=0, slider_value=Point(0.5, 0.5, 0.5), x_domain=Domain(0, 1), y_domain=Domain(0, 1), z_domain=Domain(0, 1))
evaluate_surface = EvaluateSurface(Surface=reparameterize(surface_2), Point=md_slider)  # -> Point, Normal, UDirection, VDirection, Frame
loft = Loft(
    Curves=[graft_tree_3, offset_on_srf_3],
    Options={Adjust=False, Closed=False, LoftEnds=0, LoftSimp=0, LoftType=0, Rebuild=10, Refit=0.01})
list_item_4 = ListItem(List=explode_2.Segments, Index=0, Wrap=True)  # -> Item, Item1, Item2, Item3
loft_2 = Loft(Curves=rotate.Geometry, Options={Adjust=False, Closed=False, LoftEnds=0, LoftSimp=0, LoftType=0, Rebuild=10, Refit=0.01})
loft_3 = Loft(
    Curves=rotate_2.Geometry,
    Options={Adjust=False, Closed=False, LoftEnds=0, LoftSimp=0, LoftType=0, Rebuild=10, Refit=0.01})
evaluate_surface_2 = EvaluateSurface(Surface=reparameterize(edge_surface), Point=md_slider_2)  # -> Point, Normal, UDirection, VDirection, Frame
evaluate_surface_3 = EvaluateSurface(Surface=reparameterize(graft_tree_2), Point=md_slider_3)  # -> Point, Normal, UDirection, VDirection, Frame
divide_domain²_2 = DivideDomain²(Domain=loft_3, UCount=Slider(10, range=0..10), VCount=Slider(60, range=0..100))
amplitude = Amplitude(Vector=evaluate_surface.Normal, Amplitude=Slider(500, range=0..1000))
extrude_2 = Extrude(Base=sub_curve, Direction=graft(amplitude))
edge_surface_2 = EdgeSurface(CurveA=list_item_4.Item, CurveB=list_item_4.Item1, CurveC=list_item_4.Item2, CurveD=list_item_4.Item3)
amplitude_2 = Amplitude(Vector=evaluate_surface_2.Normal, Amplitude=Slider(100, range=0..100))
extrude_3 = Extrude(Base=edge_surface, Direction=amplitude_2)
isotrim_2 = Isotrim(Surface=loft_3, Domain=divide_domain²_2)
amplitude_3 = Amplitude(Vector=evaluate_surface_3.Point, Amplitude=Slider(100, range=0..100))
extrude_4 = Extrude(Base=loft, Direction=amplitude_3)
unit_z_5 = UnitZ(Factor=Slider(100, range=0..1000))
construct_domain² = ConstructDomain²(
    UMin=Slider(0.123, range=0..1),
    UMax=Slider(0.987, range=0..1),
    VMin=Slider(0.123, range=0..1),
    VMax=Slider(0.987, range=0..1))
isotrim_3 = Isotrim(Surface=reparameterize(isotrim_2), Domain=construct_domain²)
extrude_5 = Extrude(Base=extrude_2, Direction=unit_z_5)
surface_4 = Surface(loft_2)
divide_domain²_3 = DivideDomain²(Domain=surface_4, UCount=Slider(10, range=0..10), VCount=Slider(60, range=0..100))
isotrim_4 = Isotrim(Surface=surface_4, Domain=divide_domain²_3)
random_split_list_3 = RandomSplitList(MasterList=isotrim_4, Seed=2, Split=Slider(0.4, range=0..1))  # -> ListA, ListB
deconstruct_brep_3 = DeconstructBrep(Brep=surface_4)  # -> Faces, Edges, Vertices
brep_edges_3 = BrepEdges(Brep=random_split_list_3.ListA)  # -> Naked, Interior, NonManifold
brep_edges_4 = BrepEdges(Brep=random_split_list_3.ListB)  # -> Naked, Interior, NonManifold
list_item_5 = ListItem(List=deconstruct_brep_3.Edges, Index=Slider(2, range=0..10), Wrap=True)
graft_tree_4 = GraftTree(Tree=random_split_list_3.ListA, IncludeEmptyLists=True, IncludeNullItems=True)
random_split_list_4 = RandomSplitList(MasterList=isotrim_4, Seed=Slider(2, range=0..10), Split=Slider(0.7, range=0..1))  # -> ListA, ListB
negative_2 = Negative(Value=Slider(1000, range=0..1000))
graft_tree_5 = GraftTree(Tree=random_split_list_3.ListB, IncludeEmptyLists=True, IncludeNullItems=True)
join_curves_3 = JoinCurves(Curves=brep_edges_3.Naked, Preserve=False)
join_curves_4 = JoinCurves(Curves=brep_edges_4.Naked, Preserve=False)
offset_curve_2 = OffsetCurve(Curve=list_item_5, Distance=negative_2, Plane=PlaneXY(0, 0, 0), Corners=1)
surface_5 = Surface(random_split_list_4.ListA)
surface_6 = Surface(random_split_list_4.ListB)
offset_on_srf_4 = OffsetOnSrf(Curve=join_curves_3, Distance=Slider(50, range=0..100), Surface=graft_tree_4)
deconstruct_brep_4 = DeconstructBrep(Brep=surface_5)  # -> Faces, Edges, Vertices
offset_on_srf_5 = OffsetOnSrf(Curve=join_curves_4, Distance=Slider(50, range=0..100), Surface=graft_tree_5)
unit_z_6 = UnitZ(Factor=Slider(200, range=0..1000))
explode_3 = Explode(Curve=offset_on_srf_4, Recursive=True)  # -> Segments, Vertices
extrude_6 = Extrude(Base=offset_curve_2, Direction=unit_z_6)
construct_domain_4 = ConstructDomain(DomainStart=Slider(0.01, range=0..0.01), DomainEnd=Slider(0.99, range=0..1))
offset_on_srf_6 = OffsetOnSrf(Curve=offset_on_srf_5, Distance=Slider(50, range=0..100), Surface=graft_tree_5)
list_item_6 = ListItem(List=deconstruct_brep_4.Edges, Index=0, Wrap=True)
cap_holes_2 = CapHoles(Brep=extrude_6)
graft_tree_6 = GraftTree(Tree=offset_on_srf_5, IncludeEmptyLists=True, IncludeNullItems=True)
md_slider_4 = MDSlider(SliderMode=0, slider_value=Point(0.5, 0.5, 0.5), x_domain=Domain(0, 1), y_domain=Domain(0, 1), z_domain=Domain(0, 1))
list_item_7 = ListItem(List=explode_3.Segments, Index="0", Wrap=True)  # -> Item, Item1, Item2, Item3
sub_curve_2 = SubCurve(BaseCurve=reparameterize(list_item_6), Domain=construct_domain_4)
series_4 = Series(Start=0, Step=Slider(3000, range=0..10000), Count=Slider(18, range=0..100))
unit_z_7 = UnitZ(Factor=series_4)
explode_4 = Explode(Curve=offset_on_srf_6, Recursive=True)  # -> Segments, Vertices
move_5 = Move(Geometry=cap_holes_2, Motion=unit_z_7)  # -> Geometry, Transform
md_slider_5 = MDSlider(SliderMode=0, slider_value=Point(0.5, 0.5, 0.5), x_domain=Domain(0, 1), y_domain=Domain(0, 1), z_domain=Domain(0, 1))
edge_surface_3 = EdgeSurface(CurveA=list_item_7.Item, CurveB=list_item_7.Item1, CurveC=list_item_7.Item2, CurveD=list_item_7.Item3)
md_slider_6 = MDSlider(SliderMode=0, slider_value=Point(0.5, 0.5, 0.5), x_domain=Domain(0, 1), y_domain=Domain(0, 1), z_domain=Domain(0, 1))
evaluate_surface_4 = EvaluateSurface(Surface=reparameterize(surface_5), Point=md_slider_4)  # -> Point, Normal, UDirection, VDirection, Frame
loft_4 = Loft(
    Curves=[graft_tree_6, offset_on_srf_6],
    Options={Adjust=False, Closed=False, LoftEnds=0, LoftSimp=0, LoftType=0, Rebuild=10, Refit=0.01})
list_item_8 = ListItem(List=explode_4.Segments, Index=0, Wrap=True)  # -> Item, Item1, Item2, Item3
evaluate_surface_5 = EvaluateSurface(Surface=reparameterize(edge_surface_3), Point=md_slider_5)  # -> Point, Normal, UDirection, VDirection, Frame
area_3 = Area(Geometry=move_5.Geometry)  # -> Area, Centroid
evaluate_surface_6 = EvaluateSurface(Surface=reparameterize(graft_tree_5), Point=md_slider_6)  # -> Point, Normal, UDirection, VDirection, Frame
construct_domain_5 = ConstructDomain(DomainStart=Slider(0, range=0..100), DomainEnd=Slider(60, range=0..100))
amplitude_4 = Amplitude(Vector=evaluate_surface_4.Normal, Amplitude=Slider(500, range=0..1000))
extrude_7 = Extrude(Base=sub_curve_2, Direction=graft(amplitude_4))
edge_surface_4 = EdgeSurface(CurveA=list_item_8.Item, CurveB=list_item_8.Item1, CurveC=list_item_8.Item2, CurveD=list_item_8.Item3)
amplitude_5 = Amplitude(Vector=evaluate_surface_5.Normal, Amplitude=Slider(100, range=0..100))
extrude_8 = Extrude(Base=edge_surface_3, Direction=amplitude_5)
range_3 = Range(Domain=construct_domain_5, Steps=subtraction)
amplitude_6 = Amplitude(Vector=evaluate_surface_6.Point, Amplitude=Slider(100, range=0..100))
rotate_3 = Rotate(Geometry=move_5.Geometry, Angle=degrees(range_3), Plane=area_3.Centroid)  # -> Geometry, Transform
extrude_9 = Extrude(Base=loft_4, Direction=amplitude_6)
unit_z_8 = UnitZ(Factor=Slider(100, range=0..1000))
extrude_10 = Extrude(Base=extrude_7, Direction=unit_z_8)
