# Grasshopper definition 1108.gh (Grasshopper 1.0.7)

construct_point = ConstructPoint(XCoordinate=Slider(30, range=0..100), YCoordinate=Slider(50, range=0..100), ZCoordinate=Slider(30, range=0..100))

number_slider = Slider(20, range=0..100)
construct_domain = ConstructDomain(DomainStart=Slider(0, range=0..100), DomainEnd=Slider(50, range=0..1000))

curve = Curve(<curve referenced from the Rhino model>)
curve_2 = Curve(<curve referenced from the Rhino model>)
divide_curve = DivideCurve(Curve=curve, Count=Slider(11, range=0..100), Kinks=False)  # -> Points, Tangents, Parameters
divide_curve_2 = DivideCurve(Curve=curve_2, Count=Slider(11, range=0..100), Kinks=False)  # -> Points, Tangents, Parameters
cross_reference = CrossReference(ListA=divide_curve.Points, ListB=divide_curve_2.Points, CrossMode=1)  # -> ListA, ListB
line = Line(StartPoint=cross_reference.ListA, EndPoint=cross_reference.ListB)

range = Range(Domain=Slider(50, range=0..100), Steps=number_slider)
range_2 = Range(Domain=Domain(0, 1), Steps=number_slider)
graph_mapper = GraphMapper(
    range_2,
    x0=0,
    x1=1,
    y0=0,
    y1=1,
    container_name="Sine Summation",
    Equation0_px=[0.2, 0.5734724998],
    Equation0_py=[0.2, 0.3037316799],
    Equation1_px=[0.6815397143, 0.931297183],
    Equation1_py=[0.1872209907, 0.389051795])
graph_mapper_2 = GraphMapper(
    range_2,
    x0=0,
    x1=1,
    y0=0,
    y1=1,
    container_name="Sine Summation",
    Equation0_px=[0.2, 0.4035812616],
    Equation0_py=[0.2, 0.3175853491],
    Equation1_px=[0.4657424688, 0.9351700544],
    Equation1_py=[0.2082669735, 0.4504827857])
cross_reference_2 = CrossReference(ListA=range, ListB=range, CrossMode=1)  # -> ListA, ListB
cross_reference_3 = CrossReference(ListA=graph_mapper, ListB=graph_mapper_2, CrossMode=1)  # -> ListA, ListB
multiplication = Multiplication(A=cross_reference_3.ListA, B=cross_reference_3.ListB)
multiplication_2 = Multiplication(A=multiplication, B=Slider(100, range=0..100))
construct_point_2 = ConstructPoint(XCoordinate=cross_reference_2.ListA, YCoordinate=cross_reference_2.ListB, ZCoordinate=multiplication_2)
addition = Addition(A=number_slider, B=Slider(1, range=0..1))
surface_from_points = SurfaceFromPoints(Points=construct_point_2, UCount=addition, Interpolate=False)
number_slider_2 = Slider(6, range=0..10)
divide_domain² = DivideDomain²(Domain=surface_from_points, UCount=number_slider_2, VCount=number_slider_2)
isotrim = Isotrim(Surface=surface_from_points, Domain=divide_domain²)
construct_domain² = ConstructDomain²(UMin=Slider(0.1, range=0..1), UMax=Slider(0.9, range=0..1), VMin=Slider(0.1, range=0..1), VMax=Slider(0.9, range=0..1))
isotrim_2 = Isotrim(Surface=reparameterize(isotrim), Domain=construct_domain²)
area = Area(Geometry=isotrim_2)  # -> Area, Centroid
deconstruct = Deconstruct(Point=area.Centroid)  # -> XComponent, YComponent, ZComponent
bounds = Bounds(Numbers=deconstruct.ZComponent)
xy_plane = XYPlane(Origin=Point(0, 0, 0))
deconstruct_domain = DeconstructDomain(Domain=bounds)  # -> Start, End
brep_edges = BrepEdges(Brep=isotrim_2)  # -> Naked, Interior, NonManifold
project = Project(Geometry=isotrim_2, Plane=xy_plane)  # -> Geometry, Transform
gradient = Gradient(
    LowerLimit=deconstruct_domain.Start,
    UpperLimit=deconstruct_domain.End,
    Parameter=deconstruct.ZComponent,
    stops=[0: RGB(124, 185, 157), 0.377: RGB(234, 126, 0), 0.651: RGB(254, 244, 84), 0.751: RGB(173, 203, 249), 0.841: RGB(75, 107, 169), 0.915: RGB(234, 38, 0)])
unit_x = UnitX(Factor=Slider(100, range=0..100))
brep_edges_2 = BrepEdges(Brep=project.Geometry)  # -> Naked, Interior, NonManifold
join_curves = JoinCurves(Curves=brep_edges.Naked, Preserve=False)
join_curves_2 = JoinCurves(Curves=brep_edges_2.Naked, Preserve=False)
loft = Loft(
    Curves=[join_curves_2, join_curves],
    Options={Adjust=False, Closed=False, LoftEnds=0, LoftSimp=0, LoftType=0, Rebuild=10, Refit=0.01})  # -> flatten(Loft)
brep_join = BrepJoin(Breps=[project.Geometry, loft])  # -> Breps, Closed
move = Move(Geometry=[isotrim_2, brep_join.Breps], Motion=unit_x)  # -> Geometry, Transform
custom_preview = CustomPreview(Geometry=move.Geometry, Material=gradient)
brep_join_2 = BrepJoin(Breps=flatten([isotrim_2, loft, project.Geometry]))  # -> Breps, Closed
