# Grasshopper definition 1115-1.gh (Grasshopper 1.0.7)
# plug-ins: LunchBox

curve = Curve(<curve referenced from the Rhino model>)
point = Point(<point referenced from the Rhino model>)
populate_2d = Populate2D(Region=curve, Count=100, Seed=1)
closest_point = ClosestPoint(Point=point, Cloud=populate_2d)  # -> ClosestPoint, CPIndex, Distance
closest_points = ClosestPoints(Point=point, Cloud=populate_2d, Count=Slider(5, range=0..10))  # -> ClosestPoint, CPIndex, Distance
voronoi = Voronoi(Points=populate_2d, Boundary=curve, BruteForceOverride=False)

curve_2 = Curve(<curve referenced from the Rhino model>)
curve_3 = Curve(<curve referenced from the Rhino model>)
curve_4 = Curve(<curve referenced from the Rhino model>)
curve_5 = Curve(<curve referenced from the Rhino model>)
edge_surface = EdgeSurface(CurveA=curve_2, CurveB=curve_3, CurveC=curve_4, CurveD=curve_5)
hexagon_cells = HexagonCells(
    Surface=edge_surface,
    UDivisions=Slider(18, range=0..100),
    VDivisions=Slider(7, range=0..10),
    TParameter=Slider(0.25, range=0..1))  # -> HexagonCells, Centers
graft_tree = GraftTree(Tree=hexagon_cells.HexagonCells, IncludeEmptyLists=True, IncludeNullItems=True)
graft_tree_2 = GraftTree(Tree=hexagon_cells.HexagonCells, IncludeEmptyLists=True, IncludeNullItems=True)  # -> simplify(Tree)
bounding_box = BoundingBox(Content=hexagon_cells.HexagonCells, Plane=PlaneXY(0, 0, 0))  # -> Box, Box_2
patch = Patch(Curves=graft_tree, Spans=20, Flexibility=1, Trim=True)  # -> flatten(Patch)
volume = Volume(Geometry=bounding_box.Box)  # -> Volume, Centroid
surface_closest_point = SurfaceClosestPoint(Point=volume.Centroid, Surface=patch)  # -> Point, UVPoint, Distance
deconstruct = Deconstruct(Point=surface_closest_point.Point)  # -> XComponent, YComponent, ZComponent
bounds = Bounds(Numbers=deconstruct.ZComponent)
construct_domain = ConstructDomain(DomainStart=Slider(0.1, range=0..0.1), DomainEnd=Slider(0.7, range=0..1))
remap_numbers = RemapNumbers(Value=deconstruct.ZComponent, Source=bounds, Target=construct_domain)  # -> Mapped, Clipped
md_slider = MDSlider(SliderMode=0, slider_value=Point(0.5, 0.5, 0.5), x_domain=Domain(0, 1), y_domain=Domain(0, 1), z_domain=Domain(0, 1))
scale = Scale(Geometry=hexagon_cells.HexagonCells, Center=surface_closest_point.Point, Factor=Slider(0.9, range=0..1))  # -> Geometry, Transform
scale_2 = Scale(Geometry=hexagon_cells.HexagonCells, Center=surface_closest_point.Point, Factor=remap_numbers.Mapped)  # -> Geometry, Transform
graft_tree_3 = GraftTree(Tree=scale.Geometry, IncludeEmptyLists=True, IncludeNullItems=True)  # -> simplify(Tree)
evaluate_surface = EvaluateSurface(Surface=reparameterize(patch), Point=md_slider)  # -> Point, Normal, UDirection, VDirection, Frame
loft = Loft(
    Curves=[graft_tree_3, graft_tree_2],
    Options={Adjust=False, Closed=False, LoftEnds=0, LoftSimp=0, LoftType=0, Rebuild=10, Refit=0.01})
amplitude = Amplitude(Vector=evaluate_surface.Normal, Amplitude=Slider(2, range=0..1000))
absolute = Absolute(Value=amplitude)
negative = Negative(Value=absolute)
move = Move(Geometry=scale_2.Geometry, Motion=negative)  # -> Geometry, Transform
graft_tree_4 = GraftTree(Tree=move.Geometry, IncludeEmptyLists=True, IncludeNullItems=True)  # -> simplify(Tree)
loft_2 = Loft(
    Curves=[graft_tree_3, graft_tree_4],
    Options={Adjust=False, Closed=False, LoftEnds=0, LoftSimp=0, LoftType=0, Rebuild=10, Refit=0.01})
bounds_2 = Bounds(Numbers=deconstruct.ZComponent)
deconstruct_domain = DeconstructDomain(Domain=bounds_2)  # -> Start, End
gradient = Gradient(
    LowerLimit=deconstruct_domain.Start,
    UpperLimit=deconstruct_domain.End,
    Parameter=deconstruct.ZComponent,
    stops=[0: RGB(234, 38, 0), 0.25: RGB(234, 126, 0), 0.5: RGB(254, 244, 84), 0.75: RGB(173, 203, 249), 1: RGB(75, 107, 169)])
custom_preview = CustomPreview(Geometry=flatten(loft_2), Material=gradient)
