# Grasshopper definition 1115-2.gh (Grasshopper 1.0.7)
# plug-ins: LunchBox

curve = Curve(<curve referenced from the Rhino model>)
curve_2 = Curve(<curve referenced from the Rhino model>)
curve_3 = Curve(<curve referenced from the Rhino model>)
loft = Loft(
    Curves=[curve, curve_2, curve_3],
    Options={Adjust=False, Closed=False, LoftEnds=0, LoftSimp=0, LoftType=0, Rebuild=10, Refit=0.01})
number_slider = Slider(6, range=0..10)
surface = Surface(loft)
diamond_panels = DiamondPanels(Surface=surface, UDivisions=number_slider, VDivisions=number_slider)  # -> DiamondPanels, TriPanels
brep_edges = BrepEdges(Brep=diamond_panels.DiamondPanels)  # -> Naked, Interior, NonManifold
join_curves = JoinCurves(Curves=brep_edges.Naked, Preserve=False)
explode = Explode(Curve=join_curves, Recursive=True)  # -> Segments, Vertices
area = Area(Geometry=diamond_panels.DiamondPanels)  # -> Area, graft(Centroid)
evaluate_curve = EvaluateCurve(Curve=reparameterize(explode.Segments), Parameter=Slider(0.5, range=0..1))  # -> Point, Tangent, Angle
point_on_curve = PointOnCurve(explode.Segments, parameter=0.5)
vector_2pt = Vector2Pt(PointA=evaluate_curve.Point, PointB=area.Centroid, Unitize=False)  # -> Vector, Length
end_points = EndPoints(Curve=graft(explode.Segments))  # -> Start, End
vector_display = VectorDisplay(Anchor=evaluate_curve.Point, Vector=vector_2pt.Vector)
division = Division(A=vector_2pt.Vector, B=Slider(5, range=0..10))
move = Move(Geometry=evaluate_curve.Point, Motion=division)  # -> graft(Geometry), Transform
interpolate = Interpolate(Vertices=[end_points.Start, move.Geometry, end_points.End], Degree=3, Periodic=False, KnotStyle=1)  # -> flatten(Curve), Length, Domain
md_slider = MDSlider(SliderMode=0, slider_value=Point(0.5, 0.5, 0.5), x_domain=Domain(0, 1), y_domain=Domain(0, 1), z_domain=Domain(0, 1))
partition_list = PartitionList(List=interpolate.Curve, Size=Slider(4, range=0..10))
point = Point(area.Centroid)
patch = Patch(Curves=partition_list, Spans=20, Flexibility=1, Trim=True)
evaluate_surface = EvaluateSurface(Surface=reparameterize(patch), Point=md_slider)  # -> Point, Normal, UDirection, VDirection, Frame
amplitude = Amplitude(Vector=evaluate_surface.Normal, Amplitude=Slider(2, range=0..10))
move_2 = Move(Geometry=point, Motion=graft(amplitude))  # -> Geometry, Transform
patch_2 = Patch(
    Curves=partition_list,
    Points=move_2.Geometry,
    Spans=Slider(50, range=0..100),
    Flexibility=Slider(20, range=0..100),
    Trim=True)
