# Grasshopper definition 1120.gh (Grasshopper 1.0.7)
# plug-ins: LunchBox

curve = Curve(<curve referenced from the Rhino model>)
curve_2 = Curve(<curve referenced from the Rhino model>)
curve_3 = Curve(<curve referenced from the Rhino model>)
loft = Loft(
    Curves=[curve, curve_3, curve_2],
    Options={Adjust=False, Closed=False, LoftEnds=0, LoftSimp=0, LoftType=0, Rebuild=10, Refit=0.01})
number_slider = Slider(6, range=0..10)
surface = Surface(loft)
diamond_panels = DiamondPanels(Surface=surface, UDivisions=number_slider, VDivisions=number_slider)  # -> DiamondPanels, TriPanels
brep_edges = BrepEdges(Brep=diamond_panels.DiamondPanels)  # -> Naked, Interior, NonManifold
join_curves = JoinCurves(Curves=brep_edges.Naked, Preserve=False)
md_slider = MDSlider(SliderMode=0, slider_value=Point(0.5, 0.5, 0.5), x_domain=Domain(0, 1), y_domain=Domain(0, 1), z_domain=Domain(0, 1))
explode = Explode(Curve=join_curves, Recursive=True)  # -> Segments, Vertices
evaluate_surface = EvaluateSurface(Surface=reparameterize(join_curves), Point=md_slider)  # -> graft(Point), Normal, UDirection, VDirection, Frame
evaluate_curve = EvaluateCurve(Curve=reparameterize(explode.Segments), Parameter=Slider(0.5, range=0..1))  # -> Point, Tangent, Angle
point_on_curve = PointOnCurve(explode.Segments, parameter=0.5)
vector_2pt = Vector2Pt(PointA=evaluate_curve.Point, PointB=evaluate_surface.Point, Unitize=False)  # -> Vector, Length
end_points = EndPoints(Curve=graft(explode.Segments))  # -> Start, End
vector_display = VectorDisplay(Anchor=evaluate_curve.Point, Vector=vector_2pt.Vector)
division = Division(A=vector_2pt.Vector, B=Slider(5, range=0..10))
move = Move(Geometry=evaluate_curve.Point, Motion=division)  # -> graft(Geometry), Transform
interpolate = Interpolate(Vertices=[end_points.Start, move.Geometry, end_points.End], Degree=3, Periodic=False, KnotStyle=1)  # -> flatten(Curve), Length, Domain

partition_list = PartitionList(List=interpolate.Curve, Size=Slider(4, range=0..10))

end_points_2 = EndPoints(Curve=partition_list)  # -> Start, End
line = Line(StartPoint=end_points_2.Start, EndPoint=evaluate_surface.Point)
point_on_curve_2 = PointOnCurve(line, parameter=0.5)
end_points_3 = EndPoints(Curve=line)  # -> Start, End
vector_2pt_2 = Vector2Pt(PointA=point_on_curve_2, PointB=evaluate_curve.Point, Unitize=False)  # -> Vector, Length
number_slider_2 = Slider(5, range=0..10)
division_2 = Division(A=vector_2pt_2.Vector, B=number_slider_2)
shift_list = ShiftList(List=evaluate_curve.Point, Shift="-1", Wrap=True)
move_2 = Move(Geometry=point_on_curve_2, Motion=division_2)  # -> Geometry, Transform
vector_2pt_3 = Vector2Pt(PointA=point_on_curve_2, PointB=shift_list, Unitize=False)  # -> Vector, Length
division_3 = Division(A=vector_2pt_3.Vector, B=number_slider_2)
move_3 = Move(Geometry=point_on_curve_2, Motion=division_3)  # -> Geometry, Transform
graft_tree = GraftTree(Tree=simplify(end_points_3.Start), IncludeEmptyLists=True, IncludeNullItems=True)
graft_tree_2 = GraftTree(Tree=simplify(end_points_3.End), IncludeEmptyLists=True, IncludeNullItems=True)
graft_tree_3 = GraftTree(Tree=simplify(move_2.Geometry), IncludeEmptyLists=True, IncludeNullItems=True)
graft_tree_4 = GraftTree(Tree=simplify(move_3.Geometry), IncludeEmptyLists=True, IncludeNullItems=True)
interpolate_2 = Interpolate(Vertices=[graft_tree, graft_tree_3, graft_tree_2], Degree=3, Periodic=False, KnotStyle=1)  # -> Curve, Length, Domain
interpolate_3 = Interpolate(Vertices=[graft_tree, graft_tree_4, graft_tree_2], Degree=3, Periodic=False, KnotStyle=1)  # -> Curve, Length, Domain
merge = Merge(Data1=interpolate_2.Curve, Data2=interpolate_3.Curve)
flatten_tree = FlattenTree(Tree=merge, Path="{0}")
partition_list_2 = PartitionList(List=flatten_tree, Size=Slider(8, range=0..10))

md_slider_2 = MDSlider(SliderMode=0, slider_value=Point(0.5, 0.5, 0.5), x_domain=Domain(0, 1), y_domain=Domain(0, 1), z_domain=Domain(0, 1))
point = Point(evaluate_surface.Point)
patch = Patch(Curves=partition_list, Spans=20, Flexibility=1, Trim=True)
evaluate_surface_2 = EvaluateSurface(Surface=reparameterize(patch), Point=md_slider_2)  # -> Point, Normal, UDirection, VDirection, Frame
amplitude = Amplitude(Vector=evaluate_surface_2.Normal, Amplitude=Slider(2, range=0..10))
negative = Negative(Value=amplitude)
move_4 = Move(Geometry=point, Motion=graft(negative))  # -> Geometry, Transform
patch_2 = Patch(
    Curves=partition_list,
    Points=move_4.Geometry,
    Spans=Slider(50, range=0..100),
    Flexibility=Slider(20, range=0..100),
    Trim=True)

md_slider_3 = MDSlider(SliderMode=0, slider_value=Point(0.5, 0.5, 0.5), x_domain=Domain(0, 1), y_domain=Domain(0, 1), z_domain=Domain(0, 1))
evaluate_surface_3 = EvaluateSurface(Surface=reparameterize(patch_2), Point=md_slider_3)  # -> Point, Normal, UDirection, VDirection, Frame
project = Project(Curve=partition_list_2, Brep=patch_2, Direction=evaluate_surface_3.Normal)
