# Grasshopper definition 1122.gh (Grasshopper 1.0.7)
# plug-ins: Weaverbird

number_slider = Slider(200, range=0..1000)
number_slider_2 = Slider(200, range=0..1000)
point = Point(<point referenced from the Rhino model>)
point_2 = Point(<point referenced from the Rhino model>)

curve = Curve(<curve referenced from the Rhino model>)
populate_2d = Populate2D(Region=curve, Count=Slider(50, range=0..100), Seed=Slider(6, range=0..10))
voronoi = Voronoi(Points=populate_2d, Boundary=curve, BruteForceOverride=False)

rectangle = Rectangle(Plane=point, XSize=number_slider, YSize=number_slider, Radius=0)  # -> Rectangle, Length
rectangle_2 = Rectangle(Plane=point_2, XSize=number_slider_2, YSize=number_slider_2, Radius=0)  # -> Rectangle, Length
populate_2d_2 = Populate2D(Region=rectangle.Rectangle, Count=Slider(50, range=0..100), Seed=Slider(12, range=0..100))
populate_2d_3 = Populate2D(Region=rectangle_2.Rectangle, Count=Slider(50, range=0..100), Seed=Slider(12, range=0..100))
boundary_surfaces = BoundarySurfaces(Edges=rectangle.Rectangle)
boundary_surfaces_2 = BoundarySurfaces(Edges=rectangle_2.Rectangle)
voronoi_2 = Voronoi(Points=populate_2d_2, Boundary=rectangle.Rectangle, BruteForceOverride=False)
voronoi_3 = Voronoi(Points=populate_2d_3, Boundary=rectangle_2.Rectangle, BruteForceOverride=False)

number_slider_3 = Slider(10, range=0..10)
point_3 = Point(<point referenced from the Rhino model>)
rectangular = Rectangular(
    Plane=point_3,
    SizeX=Slider(30, range=0..100),
    SizeY=Slider(40, range=0..100),
    ExtentX=number_slider_3,
    ExtentY=number_slider_3)  # -> Cells, Points
curve_2 = Curve(<curve referenced from the Rhino model>)
area = Area(Geometry=rectangular.Cells)  # -> Area, flatten(Centroid)
voronoi_4 = Voronoi(Points=area.Centroid, Boundary=curve_2, BruteForceOverride=False)

area_2 = Area(Geometry=voronoi_2)  # -> Area, Centroid
area_3 = Area(Geometry=voronoi_3)  # -> Area, Centroid
scale = Scale(Geometry=voronoi_2, Center=area_2.Centroid, Factor=Slider(0.8, range=0..1))  # -> Geometry, Transform
scale_2 = Scale(Geometry=voronoi_3, Center=area_3.Centroid, Factor=Slider(0.8, range=0..1))  # -> Geometry, Transform
surface = Surface(<surface referenced from the Rhino model>)
surface_2 = Surface(<surface referenced from the Rhino model>)
map_to_surface = MapToSurface(Curve=scale.Geometry, Source=boundary_surfaces, Target=surface)
map_to_surface_2 = MapToSurface(Curve=scale_2.Geometry, Source=boundary_surfaces_2, Target=surface_2)
surface_split = SurfaceSplit(Surface=surface, Curves=map_to_surface)
surface_split_2 = SurfaceSplit(Surface=surface_2, Curves=map_to_surface_2)

brep = Brep(<brep referenced from the Rhino model>)
populate_3d = Populate3D(Region=brep, Count=Slider(50, range=0..100), Seed=Slider(5, range=0..10))
voronoi_3d = Voronoi3D(Points=populate_3d)  # -> Cells, Boundary
scale_3 = Scale(Geometry=voronoi_3d.Cells, Center=populate_3d, Factor=Slider(0.78, range=0..1))  # -> Geometry, Transform

list_item = ListItem(List=surface_split, Index=Slider(0, range=0..100), Wrap=True)
list_item_2 = ListItem(List=surface_split_2, Index=Slider(0, range=0..100), Wrap=True)
cull_index = CullIndex(List=surface_split, Indices="0", Wrap=True)
cull_index_2 = CullIndex(List=surface_split_2, Indices="0", Wrap=True)
area_4 = Area(Geometry=cull_index)  # -> Area, Centroid
area_5 = Area(Geometry=cull_index_2)  # -> Area, Centroid
brep_edges = BrepEdges(Brep=cull_index)  # -> Naked, Interior, NonManifold
brep_edges_2 = BrepEdges(Brep=cull_index_2)  # -> Naked, Interior, NonManifold
unit_y = UnitY(Factor=Slider(5, range=0..100))
negative = Negative(Value=unit_y)
unit_y_2 = UnitY(Factor=Slider(5, range=0..100))
negative_2 = Negative(Value=unit_y_2)
unit_y_3 = UnitY(Factor=Slider(15, range=0..100))
move = Move(Geometry=area_4.Centroid, Motion=unit_y_3)  # -> Geometry, Transform
unit_y_4 = UnitY(Factor=Slider(15, range=0..100))
move_2 = Move(Geometry=area_5.Centroid, Motion=unit_y_4)  # -> Geometry, Transform
graft_tree = GraftTree(Tree=move.Geometry, IncludeEmptyLists=True, IncludeNullItems=True)
graft_tree_2 = GraftTree(Tree=move_2.Geometry, IncludeEmptyLists=True, IncludeNullItems=True)
extrude = Extrude(Base=list_item, Direction=negative)
patch = Patch(Curves=brep_edges.Naked, Points=graft_tree, Spans=20, Flexibility=1, Trim=True)
extrude_2 = Extrude(Base=list_item_2, Direction=negative_2)
patch_2 = Patch(Curves=brep_edges_2.Naked, Points=graft_tree_2, Spans=20, Flexibility=1, Trim=True)
mesh = Mesh(extrude_2)
weaverbird_s_catmull_clark_subdivision = WeaverbirdsCatmullClarkSubdivision(MeshCurves=mesh, Level=Slider(3, range=0..10), SmoothNakedEdges=1)
