# Grasshopper definition 1127.gh (Grasshopper 1.0.7)

curve = Curve([<curve referenced from the Rhino model> x3])
loft = Loft(Curves=curve, Options={Adjust=False, Closed=False, LoftEnds=0, LoftSimp=0, LoftType=0, Rebuild=10, Refit=0.01})
unit_z = UnitZ(Factor=1)
contour = Contour(Shape=loft, Point=Point(0, 0, 0), Direction=unit_z, Distance=Slider(70, range=0..100))  # -> simplify(Contours)
curve_2 = Curve(<curve referenced from the Rhino model>)
horizontal_frames = HorizontalFrames(Curve=contour, Count=Slider(50, range=0..100))  # -> Frames, Parameters
horizontal_frames_2 = HorizontalFrames(Curve=curve_2, Count=Slider(15, range=0..100))  # -> Frames, Parameters
center_box = CenterBox(Base=horizontal_frames.Frames, X=Slider(215, range=0..1000), Y=Slider(102, range=0..1000), Z=Slider(65, range=0..1000))
unit_z_2 = UnitZ(Factor=Slider(65, range=0..100))
move = Move(Geometry=center_box, Motion=unit_z_2)  # -> Geometry, Transform
volume = Volume(Geometry=center_box)  # -> Volume, Centroid
scale = Scale(Geometry=move.Geometry, Center=volume.Centroid, Factor=0.5)  # -> simplify(Geometry), Transform
tree_statistics = TreeStatistics(Tree=scale.Geometry)  # -> Paths, Length, Count
panel = Panel("""true
false""")
deconstruct_path = DeconstructPath(Branch=tree_statistics.Paths)
panel_2 = Panel("""true
false""")
modulus = Modulus(A=deconstruct_path, B=Slider(2, range=0..10))
gate_xor = GateXor(A=panel_2, B=modulus)
cull_pattern = CullPattern(List=scale.Geometry, CullPattern=gate_xor)
