# Grasshopper definition 1129-1.gh (Grasshopper 1.0.7)
# plug-ins: Kangaroo2 Components

rectangle = Rectangle(Plane=PlaneXY(0, 0, 0), XSize=Slider(57, range=0..100), YSize=Slider(73, range=0..100), Radius=0)  # -> Rectangle, Length
mesh_plane = MeshPlane(Boundary=rectangle.Rectangle, WidthCount=Slider(26, range=0..100), HeightCount=Slider(23, range=0..100))  # -> Mesh, Area
meshcorners = MeshCorners(Mesh=mesh_plane.Mesh, Angle=2.35619449)
deconstruct_mesh = DeconstructMesh(Mesh=mesh_plane.Mesh)  # -> Vertices, Faces, Colours, Normals
mesh_edges = MeshEdges(Mesh=mesh_plane.Mesh)  # -> NakedEdges, InteriorEdges, NonManifoldEdges
unit_z = UnitZ(Factor=Slider(0.2, range=0..1))
load = Load(Point=deconstruct_mesh.Vertices, ForceVector=unit_z, Weighting=1)
anchor = Anchor(Point=meshcorners, Strength=Slider(1000, range=0..1000))
line = Line([mesh_edges.NakedEdges, mesh_edges.InteriorEdges])
length = Length(Curve=line)
length_line = LengthLine(Line=line, Length=length, Strength=10)
merge = Merge(Data1=load, Data2=length_line, Data3=anchor)
solver = Solver(GoalObjects=merge, Reset=Toggle(False), Threshold=1e-15, Tolerance=0.01, On=True)  # -> I, V, O
