# Grasshopper definition 1129-2.gh (Grasshopper 1.0.7)
# plug-ins: Kangaroo2 Components

number_slider = Slider(50, range=0..100)
rectangle = Rectangle(Plane=PlaneXY(0, 0, 0), XSize=number_slider, YSize=number_slider, Radius=0)  # -> Rectangle, Length
number_slider_2 = Slider(25, range=0..100)
md_slider = MDSlider(
    SliderMode=0,
    slider_value=Point(0.6991869298, 0.5, 0.5),
    x_domain=Domain(0, 1),
    y_domain=Domain(0, 1),
    z_domain=Domain(0, 1))
md_slider_2 = MDSlider(
    SliderMode=0,
    slider_value=Point(0.2613581215, 0.3656147282, 0.5),
    x_domain=Domain(0, 1),
    y_domain=Domain(0, 1),
    z_domain=Domain(0, 1))
md_slider_3 = MDSlider(
    SliderMode=0,
    slider_value=Point(0.7321483333, 0.1797530011, 0.5),
    x_domain=Domain(0, 1),
    y_domain=Domain(0, 1),
    z_domain=Domain(0, 1))
md_slider_4 = MDSlider(
    SliderMode=0,
    slider_value=Point(0.8211381494, 0.7764230123, 0.5),
    x_domain=Domain(0, 1),
    y_domain=Domain(0, 1),
    z_domain=Domain(0, 1))
md_slider_5 = MDSlider(
    SliderMode=0,
    slider_value=Point(0.3835486435, 0.7395987162, 0.5),
    x_domain=Domain(0, 1),
    y_domain=Domain(0, 1),
    z_domain=Domain(0, 1))
boundary_surfaces = BoundarySurfaces(Edges=rectangle.Rectangle)
mesh_surface = MeshSurface(Surface=rectangle.Rectangle, UCount=number_slider_2, VCount=number_slider_2, Overhang=True, Equalize=False)
evaluate_surface = EvaluateSurface(Surface=reparameterize(boundary_surfaces), Point=[md_slider, md_slider_2, md_slider_3, md_slider_4, md_slider_5])  # -> Point, Normal, UDirection, VDirection, Frame
deconstruct_mesh = DeconstructMesh(Mesh=mesh_surface)  # -> Vertices, Faces, Colours, Normals
mesh_edges = MeshEdges(Mesh=mesh_surface)  # -> NakedEdges, InteriorEdges, NonManifoldEdges
meshcorners = MeshCorners(Mesh=mesh_surface, Angle=2.35619449)
closest_point = ClosestPoint(Point=evaluate_surface.Point, Cloud=deconstruct_mesh.Vertices)  # -> ClosestPoint, CPIndex, Distance
show = Show(G=mesh_surface)
edgelengths = EdgeLengths(Mesh=mesh_surface, LengthFactor=Slider(1, range=0..1), Strength=1)
length = Length(Curve=mesh_edges.InteriorEdges)
anchor = Anchor(Point=meshcorners, Strength=10000)
gene_pool = GenePool(Decimals=2, Maximum=100, Minimum=0, Value=[27.87, 38.18, 14.8, 21.84, 0])
line = Line([mesh_edges.NakedEdges, mesh_edges.InteriorEdges])
unit_z = UnitZ(Factor=gene_pool)
move = Move(Geometry=closest_point.ClosestPoint, Motion=unit_z)  # -> Geometry, Transform
anchor_2 = Anchor(Point=closest_point.ClosestPoint, Target=move.Geometry, Strength=10000)
length_line = LengthLine(Line=line, Length=length, Strength=10)
merge = Merge(Data1=edgelengths, Data2=anchor, Data3=anchor_2, Data4=show)
solver = Solver(GoalObjects=merge, Reset=Toggle(False), Threshold=1e-15, Tolerance=0.01, On=True)  # -> I, V, O
flatten_tree = FlattenTree(Tree=solver.O, Path="{0}")
list_item = ListItem(List=flatten_tree, Index=0, Wrap=True)
