# Grasshopper definition 1204.gh (Grasshopper 1.0.7)
# plug-ins: Kangaroo2 Components

number_slider = Slider(50, range=0..100)
rectangle = Rectangle(Plane=PlaneXY(0, 0, 0), XSize=number_slider, YSize=number_slider, Radius=0)  # -> Rectangle, Length
number_slider_2 = Slider(25, range=0..100)
md_slider = MDSlider(
    SliderMode=0,
    slider_value=Point(0.6991869298, 0.5, 0.5),
    x_domain=Domain(0, 1),
    y_domain=Domain(0, 1),
    z_domain=Domain(0, 1))
md_slider_2 = MDSlider(
    SliderMode=0,
    slider_value=Point(0.2613581215, 0.3656147282, 0.5),
    x_domain=Domain(0, 1),
    y_domain=Domain(0, 1),
    z_domain=Domain(0, 1))
md_slider_3 = MDSlider(
    SliderMode=0,
    slider_value=Point(0.7321483333, 0.1797530011, 0.5),
    x_domain=Domain(0, 1),
    y_domain=Domain(0, 1),
    z_domain=Domain(0, 1))
md_slider_4 = MDSlider(
    SliderMode=0,
    slider_value=Point(0.8211381494, 0.7764230123, 0.5),
    x_domain=Domain(0, 1),
    y_domain=Domain(0, 1),
    z_domain=Domain(0, 1))
md_slider_5 = MDSlider(
    SliderMode=0,
    slider_value=Point(0.3835486435, 0.7395987162, 0.5),
    x_domain=Domain(0, 1),
    y_domain=Domain(0, 1),
    z_domain=Domain(0, 1))
boundary_surfaces = BoundarySurfaces(Edges=rectangle.Rectangle)
mesh_surface = MeshSurface(Surface=rectangle.Rectangle, UCount=number_slider_2, VCount=number_slider_2, Overhang=True, Equalize=False)
evaluate_surface = EvaluateSurface(Surface=reparameterize(boundary_surfaces), Point=[md_slider, md_slider_2, md_slider_3, md_slider_4, md_slider_5])  # -> Point, Normal, UDirection, VDirection, Frame
deconstruct_mesh = DeconstructMesh(Mesh=mesh_surface)  # -> Vertices, Faces, Colours, Normals
mesh_edges = MeshEdges(Mesh=mesh_surface)  # -> NakedEdges, InteriorEdges, NonManifoldEdges
meshcorners = MeshCorners(Mesh=mesh_surface, Angle=2.35619449)
closest_point = ClosestPoint(Point=evaluate_surface.Point, Cloud=deconstruct_mesh.Vertices)  # -> ClosestPoint, CPIndex, Distance
show = Show(G=mesh_surface)
edgelengths = EdgeLengths(Mesh=mesh_surface, LengthFactor=Slider(1, range=0..1), Strength=1)
length = Length(Curve=mesh_edges.InteriorEdges)
anchor = Anchor(Point=meshcorners, Strength=10000)
gene_pool = GenePool(Decimals=2, Maximum=100, Minimum=0, Value=[27.87, 38.18, 14.8, 21.84, 0])
line = Line([mesh_edges.NakedEdges, mesh_edges.InteriorEdges])
unit_z = UnitZ(Factor=gene_pool)
move = Move(Geometry=closest_point.ClosestPoint, Motion=unit_z)  # -> Geometry, Transform
anchor_2 = Anchor(Point=closest_point.ClosestPoint, Target=move.Geometry, Strength=10000)
length_line = LengthLine(Line=line, Length=length, Strength=10)
merge = Merge(Data1=edgelengths, Data2=anchor, Data3=anchor_2, Data4=show)
solver = Solver(GoalObjects=merge, Reset=Toggle(False), Threshold=1e-15, Tolerance=0.01, On=True)  # -> I, V, O
flatten_tree = FlattenTree(Tree=solver.O, Path="{0}")
list_item = ListItem(List=flatten_tree, Index=0, Wrap=True)

number_slider_3 = Slider(50, range=0..100)
point = Point(<point referenced from the Rhino model>)
rectangle_2 = Rectangle(Plane=point, XSize=number_slider_3, YSize=number_slider_3, Radius=0)  # -> Rectangle, Length
md_slider_6 = MDSlider(
    SliderMode=0,
    slider_value=Point(0.6991869298, 0.5, 0.5),
    x_domain=Domain(0, 1),
    y_domain=Domain(0, 1),
    z_domain=Domain(0, 1))
md_slider_7 = MDSlider(
    SliderMode=0,
    slider_value=Point(0.2613581215, 0.3656147282, 0.5),
    x_domain=Domain(0, 1),
    y_domain=Domain(0, 1),
    z_domain=Domain(0, 1))
md_slider_8 = MDSlider(
    SliderMode=0,
    slider_value=Point(0.7321483333, 0.1797530011, 0.5),
    x_domain=Domain(0, 1),
    y_domain=Domain(0, 1),
    z_domain=Domain(0, 1))
md_slider_9 = MDSlider(
    SliderMode=0,
    slider_value=Point(0.8211381494, 0.7764230123, 0.5),
    x_domain=Domain(0, 1),
    y_domain=Domain(0, 1),
    z_domain=Domain(0, 1))
md_slider_10 = MDSlider(
    SliderMode=0,
    slider_value=Point(0.3835486435, 0.7395987162, 0.5),
    x_domain=Domain(0, 1),
    y_domain=Domain(0, 1),
    z_domain=Domain(0, 1))
unit_z_2 = UnitZ(Factor=Slider(40, range=0..100))
move_2 = Move(Geometry=rectangle_2.Rectangle, Motion=unit_z_2)  # -> Geometry, Transform
number_slider_4 = Slider(25, range=0..100)
boundary_surfaces_2 = BoundarySurfaces(Edges=move_2.Geometry)
mesh_surface_2 = MeshSurface(Surface=move_2.Geometry, UCount=number_slider_4, VCount=number_slider_4, Overhang=True, Equalize=False)
evaluate_surface_2 = EvaluateSurface(Surface=reparameterize(boundary_surfaces_2), Point=[md_slider_6, md_slider_7, md_slider_8, md_slider_9, md_slider_10])  # -> Point, Normal, UDirection, VDirection, Frame
deconstruct_mesh_2 = DeconstructMesh(Mesh=mesh_surface_2)  # -> Vertices, Faces, Colours, Normals
unit_z_3 = UnitZ(Factor=1)
negative = Negative(Value=unit_z_3)
show_2 = Show(G=mesh_surface_2)
closest_point_2 = ClosestPoint(Point=evaluate_surface_2.Point, Cloud=deconstruct_mesh_2.Vertices)  # -> ClosestPoint, CPIndex, Distance
edgelengths_2 = EdgeLengths(Mesh=mesh_surface_2, LengthFactor=Slider(1, range=0..1), Strength=Slider(6.02, range=0..10))
load = Load(Point=deconstruct_mesh_2.Vertices, ForceVector=negative, Weighting=Slider(0.59, range=0..1))
anchor_3 = Anchor(Point=closest_point_2.ClosestPoint, Strength=Slider(1000, range=0..1000))
merge_2 = Merge(Data1=edgelengths_2, Data2=show_2, Data3=anchor_3, Data4=load)
bouncysolver = BouncySolver(GoalObjects=merge_2, Reset=Toggle(False), Threshold=1e-15, Tolerance=0.01, Damping=0.99, Iterations=10, On=True)  # -> I, V, O
geometry = Geometry(bouncysolver.O)

number_slider_5 = Slider(50, range=0..100)
point_2 = Point(<point referenced from the Rhino model>)
rectangle_3 = Rectangle(Plane=point_2, XSize=number_slider_5, YSize=number_slider_5, Radius=0)  # -> Rectangle, Length
number_slider_6 = Slider(25, range=0..100)
md_slider_11 = MDSlider(
    SliderMode=0,
    slider_value=Point(0.6991869298, 0.5, 0.5),
    x_domain=Domain(0, 1),
    y_domain=Domain(0, 1),
    z_domain=Domain(0, 1))
md_slider_12 = MDSlider(
    SliderMode=0,
    slider_value=Point(0.2613581215, 0.3656147282, 0.5),
    x_domain=Domain(0, 1),
    y_domain=Domain(0, 1),
    z_domain=Domain(0, 1))
md_slider_13 = MDSlider(
    SliderMode=0,
    slider_value=Point(0.7321483333, 0.1797530011, 0.5),
    x_domain=Domain(0, 1),
    y_domain=Domain(0, 1),
    z_domain=Domain(0, 1))
md_slider_14 = MDSlider(
    SliderMode=0,
    slider_value=Point(0.8211381494, 0.7764230123, 0.5),
    x_domain=Domain(0, 1),
    y_domain=Domain(0, 1),
    z_domain=Domain(0, 1))
md_slider_15 = MDSlider(
    SliderMode=0,
    slider_value=Point(0.3835486435, 0.7395987162, 0.5),
    x_domain=Domain(0, 1),
    y_domain=Domain(0, 1),
    z_domain=Domain(0, 1))
boundary_surfaces_3 = BoundarySurfaces(Edges=rectangle_3.Rectangle)
mesh_surface_3 = MeshSurface(Surface=rectangle_3.Rectangle, UCount=number_slider_6, VCount=number_slider_6, Overhang=True, Equalize=False)
evaluate_surface_3 = EvaluateSurface(
    Surface=reparameterize(boundary_surfaces_3),
    Point=[md_slider_11, md_slider_12, md_slider_13, md_slider_14, md_slider_15])  # -> Point, Normal, UDirection, VDirection, Frame
deconstruct_mesh_3 = DeconstructMesh(Mesh=mesh_surface_3)  # -> Vertices, Faces, Colours, Normals
unit_z_4 = UnitZ(Factor=1)
mesh_edges_2 = MeshEdges(Mesh=mesh_surface_3)  # -> NakedEdges, InteriorEdges, NonManifoldEdges
meshcorners_2 = MeshCorners(Mesh=mesh_surface_3, Angle=2.35619449)
closest_point_3 = ClosestPoint(Point=evaluate_surface_3.Point, Cloud=deconstruct_mesh_3.Vertices)  # -> ClosestPoint, CPIndex, Distance
show_3 = Show(G=mesh_surface_3)
load_2 = Load(Point=deconstruct_mesh_3.Vertices, ForceVector=unit_z_4, Weighting=Slider(0.22, range=0..1))
edgelengths_3 = EdgeLengths(Mesh=mesh_surface_3, LengthFactor=Slider(1, range=0..1), Strength=1)
length_2 = Length(Curve=mesh_edges_2.InteriorEdges)
anchor_4 = Anchor(Point=meshcorners_2, Strength=10000)
gene_pool_2 = GenePool(Decimals=2, Maximum=100, Minimum=0, Value=[0, 0, 0, 0, 0])
line_2 = Line([mesh_edges_2.NakedEdges, mesh_edges_2.InteriorEdges])
unit_z_5 = UnitZ(Factor=gene_pool_2)
move_3 = Move(Geometry=closest_point_3.ClosestPoint, Motion=unit_z_5)  # -> Geometry, Transform
anchor_5 = Anchor(Point=closest_point_3.ClosestPoint, Target=move_3.Geometry, Strength=10000)
length_line_2 = LengthLine(Line=line_2, Length=length_2, Strength=10)
merge_3 = Merge(Data1=edgelengths_3, Data2=anchor_4, Data3=anchor_5, Data4=show_3, Data5=load_2)
bouncysolver_2 = BouncySolver(GoalObjects=merge_3, Reset=Toggle(False), Threshold=1e-15, Tolerance=0.01, Damping=0.99, Iterations=10, On=True)  # -> I, V, O
flatten_tree_2 = FlattenTree(Tree=bouncysolver_2.O, Path="{0}")
list_item_2 = ListItem(List=flatten_tree_2, Index=0, Wrap=True)
