# Grasshopper definition 1206.gh (Grasshopper 1.0.7)

ellipse = Ellipse(Plane=PlaneXY(0, 0, 0), Radius1=Slider(3000, range=0..10000), Radius2=Slider(2000, range=0..10000))  # -> Ellipse, Focus1, Focus2
xz_plane = XZPlane(Origin=Point(0, 0, 0))
boundary_surfaces = BoundarySurfaces(Edges=ellipse.Ellipse)
plane_surface = PlaneSurface(Plane=xz_plane, XSize="-5000 to 5000", YSize="-5000 to 5000")
split_brep = SplitBrep(Brep=boundary_surfaces, Cutter=plane_surface)
list_item = ListItem(List=split_brep, Index="1", Wrap=True)
brep_edges = BrepEdges(Brep=list_item)  # -> Naked, Interior, NonManifold
list_item_2 = ListItem(List=brep_edges.Naked, Index=0, Wrap=True)

number_slider = Slider(100, range=0..100)
perp_frames = PerpFrames(Curve=list_item_2, Count=number_slider, Align=True)  # -> Frames, Parameters
addition = Addition(A=number_slider, B="1")
polygon = Polygon(Plane=perp_frames.Frames, Radius=Slider(750, range=0..1000), Segments=Slider(3, range=0..10), FilletRadius=0)  # -> Polygon, Length
series = Series(Start=0, Step=Slider(2.7, range=0..10), Count=addition)
rotate = Rotate(Geometry=polygon.Polygon, Angle=degrees(series), Plane=perp_frames.Frames)  # -> Geometry, Transform

number_slider_2 = Slider(12, range=0..100)

area = Area(Geometry=rotate.Geometry)  # -> Area, Centroid
scale = Scale(Geometry=rotate.Geometry, Center=area.Centroid, Factor=Slider(0.8, range=0..1))  # -> Geometry, Transform
divide_curve = DivideCurve(Curve=rotate.Geometry, Count=number_slider_2, Kinks=False)  # -> Points, Tangents, Parameters
divide_curve_2 = DivideCurve(Curve=scale.Geometry, Count=number_slider_2, Kinks=False)  # -> Points, Tangents, Parameters
dispatch = Dispatch(List=divide_curve_2.Points, DispatchPattern=[True, False])  # -> ListA, ListB
dispatch_2 = Dispatch(List=divide_curve.Points, DispatchPattern=[True, False])  # -> ListA, ListB
weave = Weave(Pattern=[0, 1], Stream0=dispatch_2.ListA, Stream1=dispatch.ListB, NullGaps=False)
nurbs_curve = NurbsCurve(Vertices=weave, Degree=3, Periodic=Toggle(True))  # -> Curve, Length, Domain

md_slider = MDSlider(SliderMode=0, slider_value=Point(0.5, 0.5, 0.5), x_domain=Domain(0, 1), y_domain=Domain(0, 1), z_domain=Domain(0, 1))
evaluate_surface = EvaluateSurface(Surface=reparameterize(nurbs_curve.Curve), Point=md_slider)  # -> Point, Normal, UDirection, VDirection, Frame
amplitude = Amplitude(Vector=evaluate_surface.Normal, Amplitude=Slider(30, range=0..100))
move = Move(Geometry=nurbs_curve.Curve, Motion=amplitude)  # -> Geometry, Transform
loft = Loft(
    Curves=[move.Geometry, nurbs_curve.Curve],
    Options={Adjust=False, Closed=False, LoftEnds=0, LoftSimp=0, LoftType=0, Rebuild=10, Refit=0.01})
cap_holes = CapHoles(Brep=loft)

xy_plane = XYPlane(Origin=Point(0, 0, 0))
plane_surface_2 = PlaneSurface(Plane=xy_plane, XSize="-5000 to 5000", YSize="-5000 to 5000")
split_brep_2 = SplitBrep(Brep=cap_holes, Cutter=plane_surface_2)
list_item_3 = ListItem(List=split_brep_2, Index=0, Wrap=True)
cap_holes_2 = CapHoles(Brep=list_item_3)
