# Grasshopper definition 1211-1.gh (Grasshopper 1.0.7)

ellipse = Ellipse(Plane=PlaneXY(0, 0, 0), Radius1=Slider(3000, range=0..10000), Radius2=Slider(2000, range=0..10000))  # -> Ellipse, Focus1, Focus2
xz_plane = XZPlane(Origin=Point(0, 0, 0))
boundary_surfaces = BoundarySurfaces(Edges=ellipse.Ellipse)
plane_surface = PlaneSurface(Plane=xz_plane, XSize="-5000 to 5000", YSize="-5000 to 5000")
split_brep = SplitBrep(Brep=boundary_surfaces, Cutter=plane_surface)
list_item = ListItem(List=split_brep, Index="1", Wrap=True)
brep_edges = BrepEdges(Brep=list_item)  # -> Naked, Interior, NonManifold
list_item_2 = ListItem(List=brep_edges.Naked, Index=0, Wrap=True)

curve = Curve(<curve referenced from the Rhino model>)

number_slider = Slider(100, range=0..100)
perp_frames = PerpFrames(Curve=curve, Count=number_slider, Align=True)  # -> Frames, Parameters
addition = Addition(A=number_slider, B="1")
polygon = Polygon(Plane=perp_frames.Frames, Radius=Slider(750, range=0..1000), Segments=Slider(3, range=0..10), FilletRadius=0)  # -> Polygon, Length
series = Series(Start=0, Step=Slider(2.7, range=0..10), Count=addition)
rotate = Rotate(Geometry=polygon.Polygon, Angle=degrees(series), Plane=perp_frames.Frames)  # -> Geometry, Transform

number_slider_2 = Slider(100, range=0..100)
perp_frames_2 = PerpFrames(Curve=list_item_2, Count=number_slider_2, Align=True)  # -> Frames, Parameters
addition_2 = Addition(A=number_slider_2, B="1")
polygon_2 = Polygon(Plane=perp_frames_2.Frames, Radius=Slider(750, range=0..1000), Segments=Slider(3, range=0..10), FilletRadius=0)  # -> Polygon, Length
series_2 = Series(Start=0, Step=Slider(2.7, range=0..10), Count=addition_2)
rotate_2 = Rotate(Geometry=polygon_2.Polygon, Angle=degrees(series_2), Plane=perp_frames_2.Frames)  # -> Geometry, Transform

number_slider_3 = Slider(12, range=0..100)

area = Area(Geometry=rotate.Geometry)  # -> Area, Centroid
scale = Scale(Geometry=rotate.Geometry, Center=area.Centroid, Factor=Slider(0.8, range=0..1))  # -> Geometry, Transform
divide_curve = DivideCurve(Curve=rotate.Geometry, Count=number_slider_3, Kinks=False)  # -> Points, Tangents, Parameters
divide_curve_2 = DivideCurve(Curve=scale.Geometry, Count=number_slider_3, Kinks=False)  # -> Points, Tangents, Parameters
dispatch = Dispatch(List=divide_curve_2.Points, DispatchPattern=[True, False])  # -> ListA, ListB
dispatch_2 = Dispatch(List=divide_curve.Points, DispatchPattern=[True, False])  # -> ListA, ListB
weave = Weave(Pattern=[0, 1], Stream0=dispatch.ListA, Stream1=dispatch_2.ListB, NullGaps=False)
nurbs_curve = NurbsCurve(Vertices=weave, Degree=3, Periodic=Toggle(True))  # -> Curve, Length, Domain

number_slider_4 = Slider(12, range=0..100)

area_2 = Area(Geometry=rotate_2.Geometry)  # -> Area, Centroid
scale_2 = Scale(Geometry=rotate_2.Geometry, Center=area_2.Centroid, Factor=Slider(0.8, range=0..1))  # -> Geometry, Transform
divide_curve_3 = DivideCurve(Curve=rotate_2.Geometry, Count=number_slider_4, Kinks=False)  # -> Points, Tangents, Parameters
divide_curve_4 = DivideCurve(Curve=scale_2.Geometry, Count=number_slider_4, Kinks=False)  # -> Points, Tangents, Parameters
dispatch_3 = Dispatch(List=divide_curve_4.Points, DispatchPattern=[True, False])  # -> ListA, ListB
dispatch_4 = Dispatch(List=divide_curve_3.Points, DispatchPattern=[True, False])  # -> ListA, ListB
weave_2 = Weave(Pattern=[0, 1], Stream0=dispatch_3.ListA, Stream1=dispatch_4.ListB, NullGaps=False)
nurbs_curve_2 = NurbsCurve(Vertices=weave_2, Degree=3, Periodic=Toggle(True))  # -> Curve, Length, Domain

md_slider = MDSlider(SliderMode=0, slider_value=Point(0.5, 0.5, 0.5), x_domain=Domain(0, 1), y_domain=Domain(0, 1), z_domain=Domain(0, 1))
evaluate_surface = EvaluateSurface(Surface=reparameterize(nurbs_curve.Curve), Point=md_slider)  # -> Point, Normal, UDirection, VDirection, Frame
amplitude = Amplitude(Vector=evaluate_surface.Normal, Amplitude=Slider(30, range=0..100))
move = Move(Geometry=nurbs_curve.Curve, Motion=amplitude)  # -> Geometry, Transform
loft = Loft(
    Curves=[move.Geometry, nurbs_curve.Curve],
    Options={Adjust=False, Closed=False, LoftEnds=0, LoftSimp=0, LoftType=0, Rebuild=10, Refit=0.01})
cap_holes = CapHoles(Brep=loft)

md_slider_2 = MDSlider(SliderMode=0, slider_value=Point(0.5, 0.5, 0.5), x_domain=Domain(0, 1), y_domain=Domain(0, 1), z_domain=Domain(0, 1))
evaluate_surface_2 = EvaluateSurface(Surface=reparameterize(nurbs_curve_2.Curve), Point=md_slider_2)  # -> Point, Normal, UDirection, VDirection, Frame
amplitude_2 = Amplitude(Vector=evaluate_surface_2.Normal, Amplitude=Slider(30, range=0..100))
move_2 = Move(Geometry=nurbs_curve_2.Curve, Motion=amplitude_2)  # -> Geometry, Transform
loft_2 = Loft(
    Curves=[move_2.Geometry, nurbs_curve_2.Curve],
    Options={Adjust=False, Closed=False, LoftEnds=0, LoftSimp=0, LoftType=0, Rebuild=10, Refit=0.01})
cap_holes_2 = CapHoles(Brep=loft_2)

xy_plane = XYPlane(Origin=Point(0, 0, 0))
plane_surface_2 = PlaneSurface(Plane=xy_plane, XSize="-5000 to 5000", YSize="-5000 to 5000")
split_brep_2 = SplitBrep(Brep=cap_holes, Cutter=plane_surface_2)
list_item_3 = ListItem(List=split_brep_2, Index=0, Wrap=True)
cap_holes_3 = CapHoles(Brep=list_item_3)

xy_plane_2 = XYPlane(Origin=Point(0, 0, 0))
plane_surface_3 = PlaneSurface(Plane=xy_plane_2, XSize="-5000 to 5000", YSize="-5000 to 5000")
split_brep_3 = SplitBrep(Brep=cap_holes_2, Cutter=plane_surface_3)
list_item_4 = ListItem(List=split_brep_3, Index=0, Wrap=True)
cap_holes_4 = CapHoles(Brep=list_item_4)

volume = Volume(Geometry=cap_holes_3)  # -> Volume, Centroid
interpolate = Interpolate(Vertices=flatten(volume.Centroid), Degree=3, Periodic=False, KnotStyle=1)  # -> Curve, Length, Domain
perp_frames_3 = PerpFrames(Curve=interpolate.Curve, Count=number_slider, Align=True)  # -> Frames, Parameters
polygon_3 = Polygon(Plane=perp_frames_3.Frames, Radius=Slider(90, range=0..100), Segments=Slider(3, range=0..10), FilletRadius=0)  # -> Polygon, Length
deconstruct_brep = DeconstructBrep(Brep=polygon_3.Polygon)  # -> Faces, Edges, Vertices
list_item_5 = ListItem(List=deconstruct_brep.Vertices, Index=0, Wrap=True)
list_item_6 = ListItem(List=deconstruct_brep.Vertices, Index="1", Wrap=True)
list_item_7 = ListItem(List=deconstruct_brep.Vertices, Index="2", Wrap=True)
interpolate_2 = Interpolate(Vertices=flatten(list_item_5), Degree=3, Periodic=False, KnotStyle=1)  # -> Curve, Length, Domain
interpolate_3 = Interpolate(Vertices=flatten(list_item_6), Degree=3, Periodic=False, KnotStyle=1)  # -> Curve, Length, Domain
interpolate_4 = Interpolate(Vertices=flatten(list_item_7), Degree=3, Periodic=False, KnotStyle=1)  # -> Curve, Length, Domain
pipe = Pipe(Curve=[interpolate_2.Curve, interpolate_3.Curve, interpolate_4.Curve], Radius=Slider(21, range=0..100), Caps=0)  # -> flatten(Pipe)
pipe_2 = Pipe(Curve=[interpolate_2.Curve, interpolate_3.Curve, interpolate_4.Curve], Radius=Slider(20, range=0..100), Caps=0)
solid_difference = SolidDifference(BrepsA=flatten(cap_holes_3), BrepsB=pipe)

volume_2 = Volume(Geometry=cap_holes_4)  # -> Volume, Centroid
interpolate_5 = Interpolate(Vertices=flatten(volume_2.Centroid), Degree=3, Periodic=False, KnotStyle=1)  # -> Curve, Length, Domain
perp_frames_4 = PerpFrames(Curve=interpolate_5.Curve, Count=number_slider_2, Align=True)  # -> Frames, Parameters
polygon_4 = Polygon(Plane=perp_frames_4.Frames, Radius=Slider(90, range=0..100), Segments=Slider(3, range=0..10), FilletRadius=0)  # -> Polygon, Length
deconstruct_brep_2 = DeconstructBrep(Brep=polygon_4.Polygon)  # -> Faces, Edges, Vertices
list_item_8 = ListItem(List=deconstruct_brep_2.Vertices, Index=0, Wrap=True)
list_item_9 = ListItem(List=deconstruct_brep_2.Vertices, Index="1", Wrap=True)
list_item_10 = ListItem(List=deconstruct_brep_2.Vertices, Index="2", Wrap=True)
interpolate_6 = Interpolate(Vertices=flatten(list_item_8), Degree=3, Periodic=False, KnotStyle=1)  # -> Curve, Length, Domain
interpolate_7 = Interpolate(Vertices=flatten(list_item_9), Degree=3, Periodic=False, KnotStyle=1)  # -> Curve, Length, Domain
interpolate_8 = Interpolate(Vertices=flatten(list_item_10), Degree=3, Periodic=False, KnotStyle=1)  # -> Curve, Length, Domain
pipe_3 = Pipe(Curve=[interpolate_6.Curve, interpolate_7.Curve, interpolate_8.Curve], Radius=Slider(21, range=0..100), Caps=0)  # -> flatten(Pipe)
pipe_4 = Pipe(Curve=[interpolate_6.Curve, interpolate_7.Curve, interpolate_8.Curve], Radius=Slider(20, range=0..100), Caps=0)
solid_difference_2 = SolidDifference(BrepsA=flatten(cap_holes_4), BrepsB=pipe_3)

merge = Merge(Data1=solid_difference, Data2=pipe_2)
merge_2 = Merge(Data1=solid_difference_2, Data2=pipe_4)
