# Grasshopper definition 1211-2.gh (Grasshopper 1.0.7)

number_slider = Slider(5, range=0..10)
curve = Curve(<curve referenced from the Rhino model>)
curve_2 = Curve(<curve referenced from the Rhino model>)
curve_3 = Curve(<curve referenced from the Rhino model>)
curve_4 = Curve(<curve referenced from the Rhino model>)
divide_curve = DivideCurve(Curve=curve_2, Count=number_slider, Kinks=False)  # -> Points, Tangents, Parameters
divide_curve_2 = DivideCurve(Curve=curve_3, Count=number_slider, Kinks=False)  # -> Points, Tangents, Parameters
divide_curve_3 = DivideCurve(Curve=curve, Count=number_slider, Kinks=False)  # -> Points, Tangents, Parameters
divide_curve_4 = DivideCurve(Curve=curve_4, Count=number_slider, Kinks=False)  # -> Points, Tangents, Parameters
panel = Panel("""0
2
1
3""")
weave = Weave(
    Pattern=panel,
    Stream0=divide_curve_2.Points,
    Stream1=divide_curve_3.Points,
    Stream2=divide_curve_4.Points,
    Stream3=divide_curve.Points,
    NullGaps=False)
interpolate = Interpolate(Vertices=weave, Degree=3, Periodic=False, KnotStyle=1)  # -> Curve, Length, Domain

surface = Surface(<surface referenced from the Rhino model>)
divide_surface = DivideSurface(Surface=surface, UCount=Slider(17, range=0..100), VCount=Slider(19, range=0..100))  # -> Points, Normals, Parameters
panel_2 = Panel("""false
true""")
cull_pattern = CullPattern(List=divide_surface.Normals, CullPattern=reverse(panel_2))
cull_pattern_2 = CullPattern(List=divide_surface.Normals, CullPattern=panel_2)
cull_pattern_3 = CullPattern(List=divide_surface.Points, CullPattern=reverse(panel_2))
cull_pattern_4 = CullPattern(List=divide_surface.Points, CullPattern=panel_2)
negative = Negative(Value=Slider(0.7, range=0..1))
amplitude = Amplitude(Vector=cull_pattern_2, Amplitude=Slider(0.7, range=0..1))
amplitude_2 = Amplitude(Vector=cull_pattern, Amplitude=negative)
move = Move(Geometry=cull_pattern_4, Motion=amplitude)  # -> Geometry, Transform
move_2 = Move(Geometry=cull_pattern_3, Motion=amplitude_2)  # -> Geometry, Transform
weave_2 = Weave(Pattern=[0, 1], Stream0=move_2.Geometry, Stream1=move.Geometry, NullGaps=False)
interpolate_2 = Interpolate(Vertices=weave_2, Degree=3, Periodic=False, KnotStyle=1)  # -> Curve, Length, Domain
