# Grasshopper definition 1213.gh (Grasshopper 1.0.7)

number_slider = Slider(5, range=0..10)
curve = Curve(<curve referenced from the Rhino model>)
curve_2 = Curve(<curve referenced from the Rhino model>)
curve_3 = Curve(<curve referenced from the Rhino model>)
curve_4 = Curve(<curve referenced from the Rhino model>)
divide_curve = DivideCurve(Curve=curve_2, Count=number_slider, Kinks=False)  # -> Points, Tangents, Parameters
divide_curve_2 = DivideCurve(Curve=curve_3, Count=number_slider, Kinks=False)  # -> Points, Tangents, Parameters
divide_curve_3 = DivideCurve(Curve=curve, Count=number_slider, Kinks=False)  # -> Points, Tangents, Parameters
divide_curve_4 = DivideCurve(Curve=curve_4, Count=number_slider, Kinks=False)  # -> Points, Tangents, Parameters
panel = Panel("""0
2
1
3""")
weave = Weave(
    Pattern=panel,
    Stream0=divide_curve_2.Points,
    Stream1=divide_curve_3.Points,
    Stream2=divide_curve_4.Points,
    Stream3=divide_curve.Points,
    NullGaps=False)
interpolate = Interpolate(Vertices=weave, Degree=3, Periodic=False, KnotStyle=1)  # -> Curve, Length, Domain

surface = Surface(<surface referenced from the Rhino model>)
surface_2 = Surface(<surface referenced from the Rhino model>)
divide_surface = DivideSurface(Surface=surface_2, UCount=Slider(17, range=0..100), VCount=Slider(19, range=0..100))  # -> Points, Normals, Parameters

flip_matrix = FlipMatrix(Data=divide_surface.Points)
flip_matrix_2 = FlipMatrix(Data=divide_surface.Normals)

panel_2 = Panel("""false
true""")

cull_pattern = CullPattern(List=flip_matrix_2, CullPattern=reverse(panel_2))
cull_pattern_2 = CullPattern(List=flip_matrix_2, CullPattern=panel_2)
cull_pattern_3 = CullPattern(List=flip_matrix, CullPattern=reverse(panel_2))
cull_pattern_4 = CullPattern(List=flip_matrix, CullPattern=panel_2)
amplitude = Amplitude(Vector=cull_pattern_2, Amplitude=Slider(0.7, range=0..1))
amplitude_2 = Amplitude(Vector=cull_pattern, Amplitude=Slider(0.7, range=0..1))
negative = Negative(Value=amplitude_2)
move = Move(Geometry=cull_pattern_4, Motion=amplitude)  # -> Geometry, Transform
move_2 = Move(Geometry=cull_pattern_3, Motion=negative)  # -> Geometry, Transform
weave_2 = Weave(Pattern=[0, 1], Stream0=move_2.Geometry, Stream1=move.Geometry, NullGaps=False)
interpolate_2 = Interpolate(Vertices=weave_2, Degree=3, Periodic=False, KnotStyle=1)  # -> Curve, Length, Domain

cull_pattern_5 = CullPattern(List=flip_matrix_2, CullPattern=reverse(panel_2))
cull_pattern_6 = CullPattern(List=flip_matrix_2, CullPattern=panel_2)
cull_pattern_7 = CullPattern(List=flip_matrix, CullPattern=reverse(panel_2))
cull_pattern_8 = CullPattern(List=flip_matrix, CullPattern=panel_2)
negative_2 = Negative(Value=Slider(0.7, range=0..1))
amplitude_3 = Amplitude(Vector=cull_pattern_6, Amplitude=negative_2)
amplitude_4 = Amplitude(Vector=cull_pattern_5, Amplitude=Slider(0.7, range=0..1))
move_3 = Move(Geometry=cull_pattern_8, Motion=amplitude_3)  # -> Geometry, Transform
move_4 = Move(Geometry=cull_pattern_7, Motion=amplitude_4)  # -> Geometry, Transform
weave_3 = Weave(Pattern=[0, 1], Stream0=move_4.Geometry, Stream1=move_3.Geometry, NullGaps=False)
interpolate_3 = Interpolate(Vertices=weave_3, Degree=3, Periodic=False, KnotStyle=1)  # -> Curve, Length, Domain

cull_pattern_9 = CullPattern(List=divide_surface.Normals, CullPattern=reverse(panel_2))
cull_pattern_10 = CullPattern(List=divide_surface.Normals, CullPattern=panel_2)
cull_pattern_11 = CullPattern(List=divide_surface.Points, CullPattern=reverse(panel_2))
cull_pattern_12 = CullPattern(List=divide_surface.Points, CullPattern=panel_2)
amplitude_5 = Amplitude(Vector=cull_pattern_10, Amplitude=Slider(0.7, range=0..1))
amplitude_6 = Amplitude(Vector=cull_pattern_9, Amplitude=Slider(0.7, range=0..1))
negative_3 = Negative(Value=amplitude_5)
move_5 = Move(Geometry=cull_pattern_12, Motion=negative_3)  # -> Geometry, Transform
move_6 = Move(Geometry=cull_pattern_11, Motion=amplitude_6)  # -> Geometry, Transform
weave_4 = Weave(Pattern=[0, 1], Stream0=move_6.Geometry, Stream1=move_5.Geometry, NullGaps=False)
interpolate_4 = Interpolate(Vertices=weave_4, Degree=3, Periodic=False, KnotStyle=1)  # -> Curve, Length, Domain

cull_pattern_13 = CullPattern(List=divide_surface.Normals, CullPattern=reverse(panel_2))
cull_pattern_14 = CullPattern(List=divide_surface.Normals, CullPattern=panel_2)
cull_pattern_15 = CullPattern(List=divide_surface.Points, CullPattern=reverse(panel_2))
cull_pattern_16 = CullPattern(List=divide_surface.Points, CullPattern=panel_2)
negative_4 = Negative(Value=Slider(0.7, range=0..1))
amplitude_7 = Amplitude(Vector=cull_pattern_14, Amplitude=Slider(0.7, range=0..1))
amplitude_8 = Amplitude(Vector=cull_pattern_13, Amplitude=negative_4)
move_7 = Move(Geometry=cull_pattern_16, Motion=amplitude_7)  # -> Geometry, Transform
move_8 = Move(Geometry=cull_pattern_15, Motion=amplitude_8)  # -> Geometry, Transform
weave_5 = Weave(Pattern=[0, 1], Stream0=move_8.Geometry, Stream1=move_7.Geometry, NullGaps=False)
interpolate_5 = Interpolate(Vertices=weave_5, Degree=3, Periodic=False, KnotStyle=1)  # -> Curve, Length, Domain

cull_pattern_17 = CullPattern(List=flatten(interpolate_2.Curve), CullPattern=panel_2)
cull_pattern_18 = CullPattern(List=flatten(interpolate_3.Curve), CullPattern=reverse(panel_2))
cull_pattern_19 = CullPattern(List=flatten(interpolate_4.Curve), CullPattern=panel_2)
cull_pattern_20 = CullPattern(List=flatten(interpolate_5.Curve), CullPattern=reverse(panel_2))
merge = Merge(Data1=cull_pattern_20, Data2=cull_pattern_19, Data3=cull_pattern_18, Data4=cull_pattern_17)
pipe = Pipe(Curve=merge, Radius=Slider(0.2, range=0..1), Caps=Slider(2, range=0..10))
