# Grasshopper definition 1218.gh (Grasshopper 1.0.7)

number_slider = Slider(100, range=0..100)
construct_point = ConstructPoint(XCoordinate=0, YCoordinate=0, ZCoordinate=0)
center_box = CenterBox(Base=construct_point, X=number_slider, Y=number_slider, Z=number_slider)
populate_3d = Populate3D(Region=center_box, Count=Slider(80, range=0..100), Seed=Slider(4, range=0..10))
vector_2pt = Vector2Pt(PointA=construct_point, PointB=populate_3d, Unitize=False)  # -> Vector, Length
brep = Brep(<brep referenced from the Rhino model>)
plane_normal = PlaneNormal(Origin=populate_3d, ZAxis=vector_2pt.Vector)
brep_plane = BrepPlane(Brep=brep, Plane=plane_normal)  # -> Curves, Points
