# Grasshopper definition 1220.gh (Grasshopper 1.0.7)

number_slider = Slider(25, range=0..100)
number_slider_2 = Slider(-300, range=-1000..1000)
range = Range(Domain=Domain(0, 1), Steps=number_slider)
construct_domain = ConstructDomain(DomainStart=Slider(-300, range=-1000..1000), DomainEnd=Slider(400, range=0..1000))
graph_mapper = GraphMapper(
    range,
    x0=0,
    x1=1,
    y0=0,
    y1=1,
    amplitude=0.3490569592,
    container_name="Perlin",
    decay=0.3725900054,
    frequency=0.1755441725,
    x_offset=0.5499404669,
    y_offset=0.5021048188)
range_2 = Range(Domain=construct_domain, Steps=number_slider)
multiplication = Multiplication(A=graph_mapper, B="175")
construct_point = ConstructPoint(XCoordinate=range_2, YCoordinate=0, ZCoordinate=multiplication)
interpolate = Interpolate(Vertices=construct_point, Degree=3, Periodic=False, KnotStyle=1)  # -> Curve, Length, Domain

curve = Curve(<curve referenced from the Rhino model>)
perp_frames = PerpFrames(Curve=curve, Count="8", Align=True)  # -> Frames, Parameters

xz_plane = XZPlane(Origin=Point(0, 0, 0))
orient = Orient(Geometry=interpolate.Curve, Source=xz_plane, Target=perp_frames.Frames)  # -> Geometry, Transform
random = Random(Range=Slider(7, range=0..10), Number=Slider(3, range=0..10), Seed=2)
list_item = ListItem(List=orient.Geometry, Index=random, Wrap=True)
point_on_curve = PointOnCurve(list_item, parameter=0.5)
construct_domain_2 = ConstructDomain(DomainStart=Slider(0.3, range=0..1), DomainEnd=Slider(0.9, range=0..1))
scale = Scale(Geometry=list_item, Center=point_on_curve, Factor=construct_domain_2)  # -> Geometry, Transform

cull_index = CullIndex(List=orient.Geometry, Indices=random, Wrap=True)
item_index = ItemIndex(List=orient.Geometry, Item=cull_index)
item_index_2 = ItemIndex(List=orient.Geometry, Item=list_item)
merge = Merge(Data1=[item_index_2, item_index])  # -> flatten(Result)
merge_2 = Merge(Data1=cull_index, Data2=scale.Geometry)  # -> flatten(Result)
sort_list = SortList(Keys=merge, ValuesValuesA=merge_2)  # -> Keys, ValuesValuesA
loft = Loft(
    Curves=sort_list.ValuesValuesA,
    Options={Adjust=False, Closed=False, LoftEnds=0, LoftSimp=0, LoftType=0, Rebuild=10, Refit=0.01})
