# Grasshopper definition 모델링 그래스하퍼.gh (Grasshopper 1.0.7)

curve = Curve(<curve referenced from the Rhino model>)
area = Area(Geometry=curve)  # -> Area, Centroid
offset_curve = OffsetCurve(Curve=curve, Distance=Slider(-400, range=-1000..1000), Plane=area.Centroid, Corners=1)
loft = Loft(
    Curves=flatten([curve, offset_curve]),
    Options={Adjust=False, Closed=False, LoftEnds=0, LoftSimp=0, LoftType=0, Rebuild=10, Refit=0.01})
number_slider = Slider(105500, range=0..500000)
unit_z = UnitZ(Factor=number_slider)
offset_curve_2 = OffsetCurve(Curve=offset_curve, Distance=Slider(-1050, range=-2000..2000), Plane=area.Centroid, Corners=1)
extrude = Extrude(Base=curve, Direction=unit_z)
extrude_2 = Extrude(Base=loft, Direction=unit_z)

negative = Negative(Value=Slider(550, range=0..1000))
negative_2 = Negative(Value=Slider(580, range=0..1000))
plane_surface = PlaneSurface(Plane=area.Centroid, XSize=Slider(1040, range=0..5000), YSize=Slider(1200, range=0..5000))
unit_x = UnitX(Factor=negative)
move = Move(Geometry=plane_surface, Motion=unit_x)  # -> Geometry, Transform
unit_y = UnitY(Factor=negative_2)
move_2 = Move(Geometry=move.Geometry, Motion=unit_y)  # -> Geometry, Transform
area_2 = Area(Geometry=move_2.Geometry)  # -> Area, Centroid
scale = Scale(Geometry=move_2.Geometry, Center=area_2.Centroid, Factor=Slider(10, range=0..10))  # -> Geometry, Transform
fillet = Fillet(Curve=scale.Geometry, Radius=Slider(1000, range=0..1000))
area_3 = Area(Geometry=fillet)  # -> Area, Centroid
scale_2 = Scale(Geometry=fillet, Center=area_3.Centroid, Factor=Slider(0.95, range=0..1))  # -> Geometry, Transform
boundary_surfaces = BoundarySurfaces(Edges=[fillet, scale_2.Geometry])
multiplication = Multiplication(A=Slider(4000, range=0..10000), B=Slider(22, range=0..100))
multiplication_2 = Multiplication(A=Slider(6500, range=0..10000), B=Slider(2, range=0..10))
addition = Addition(A=multiplication, B=multiplication_2)
unit_z_2 = UnitZ(Factor=addition)
extrude_3 = Extrude(Base=boundary_surfaces, Direction=unit_z_2)

point = Point(<point referenced from the Rhino model>)
length = Length(Curve=curve)
plane_surface_2 = PlaneSurface(Plane=point, XSize=length, YSize=number_slider)

md_slider = MDSlider(
    SliderMode=0,
    slider_value=Point(0.3215605573, 0.7352272592, 0.5),
    x_domain=Domain(0, 1),
    y_domain=Domain(0, 1),
    z_domain=Domain(0, 1))
md_slider_2 = MDSlider(
    SliderMode=0,
    slider_value=Point(0.4452252272, 0.2594366306, 0.5),
    x_domain=Domain(0, 1),
    y_domain=Domain(0, 1),
    z_domain=Domain(0, 1))
md_slider_3 = MDSlider(
    SliderMode=0,
    slider_value=Point(0.8460382601, 0.6498844798, 0.5),
    x_domain=Domain(0, 1),
    y_domain=Domain(0, 1),
    z_domain=Domain(0, 1))

explode = Explode(Curve=plane_surface_2, Recursive=True)  # -> Segments, Vertices
list_item = ListItem(List=explode.Segments, Index=0, Wrap=True)  # -> Item1, Item, Item1_2, Item2
number_slider_2 = Slider(5000, range=0..10000)
curve_2 = Curve(list_item.Item1)
curve_3 = Curve(list_item.Item)
curve_4 = Curve(list_item.Item1_2)
curve_5 = Curve(list_item.Item2)
unit_x_2 = UnitX(Factor=number_slider_2)
move_3 = Move(Geometry=curve_3, Motion=unit_x_2)  # -> Geometry, Transform
negative_3 = Negative(Value=number_slider_2)
unit_x_3 = UnitX(Factor=negative_3)
move_4 = Move(Geometry=curve_5, Motion=unit_x_3)  # -> Geometry, Transform
negative_4 = Negative(Value=Slider(8000, range=0..10000))
unit_y_2 = UnitY(Factor=negative_4)
move_5 = Move(Geometry=curve_2, Motion=unit_y_2)  # -> Geometry, Transform
edge_surface = EdgeSurface(CurveA=move_5.Geometry, CurveB=move_3.Geometry, CurveC=curve_4, CurveD=move_4.Geometry)

evaluate_surface = EvaluateSurface(Surface=reparameterize(edge_surface), Point=[md_slider_2, md_slider, md_slider_3])  # -> Point, Normal, UDirection, VDirection, Frame

plane_surface_3 = PlaneSurface(Plane=area_2.Centroid, XSize=Slider(150, range=0..1000), YSize=Slider(4300, range=0..100000))
unit_x_4 = UnitX(Factor=Slider(-500, range=-6000..10000))
move_6 = Move(Geometry=plane_surface_3, Motion=unit_x_4)  # -> Geometry, Transform
unit_y_3 = UnitY(Factor=Slider(-1050, range=-5700..10000))
move_7 = Move(Geometry=move_6.Geometry, Motion=unit_y_3)  # -> Geometry, Transform

plane_surface_4 = PlaneSurface(Plane=area_2.Centroid, XSize=Slider(7420, range=0..100000), YSize=Slider(150, range=0..1000))
negative_5 = Negative(Value=Slider(2480, range=0..10000))
unit_x_5 = UnitX(Factor=negative_5)
move_8 = Move(Geometry=plane_surface_4, Motion=unit_x_5)  # -> Geometry, Transform
unit_y_4 = UnitY(Factor=Slider(3250, range=0..10000))
move_9 = Move(Geometry=move_8.Geometry, Motion=unit_y_4)  # -> Geometry, Transform

plane_surface_5 = PlaneSurface(Plane=area_2.Centroid, XSize=Slider(6420, range=0..100000), YSize=Slider(150, range=0..1000))
negative_6 = Negative(Value=Slider(1480, range=0..10000))
unit_x_6 = UnitX(Factor=negative_6)
move_10 = Move(Geometry=plane_surface_5, Motion=unit_x_6)  # -> Geometry, Transform
unit_y_5 = UnitY(Factor=Slider(-3400, range=-5700..10000))
move_11 = Move(Geometry=move_10.Geometry, Motion=unit_y_5)  # -> Geometry, Transform

plane_surface_6 = PlaneSurface(Plane=area_2.Centroid, XSize=Slider(150, range=0..1000), YSize=Slider(2200, range=0..100000))
unit_x_7 = UnitX(Factor=Slider(-1250, range=-6000..10000))
move_12 = Move(Geometry=plane_surface_6, Motion=unit_x_7)  # -> Geometry, Transform
unit_y_6 = UnitY(Factor=Slider(-3250, range=-5700..10000))
move_13 = Move(Geometry=move_12.Geometry, Motion=unit_y_6)  # -> Geometry, Transform

plane_surface_7 = PlaneSurface(Plane=area_2.Centroid, XSize=Slider(150, range=0..1000), YSize=Slider(6500, range=0..100000))
unit_x_8 = UnitX(Factor=Slider(850, range=-6000..10000))
move_14 = Move(Geometry=plane_surface_7, Motion=unit_x_8)  # -> Geometry, Transform
unit_y_7 = UnitY(Factor=Slider(-3250, range=-5700..10000))
move_15 = Move(Geometry=move_14.Geometry, Motion=unit_y_7)  # -> Geometry, Transform

plane_surface_8 = PlaneSurface(Plane=area_2.Centroid, XSize=Slider(1950, range=0..100000), YSize=Slider(150, range=0..1000))
unit_x_9 = UnitX(Factor=Slider(-1100, range=-6000..10000))
move_16 = Move(Geometry=plane_surface_8, Motion=unit_x_9)  # -> Geometry, Transform
unit_y_8 = UnitY(Factor=Slider(-1200, range=-5700..10000))
move_17 = Move(Geometry=move_16.Geometry, Motion=unit_y_8)  # -> Geometry, Transform

plane_surface_9 = PlaneSurface(Plane=area_2.Centroid, XSize=Slider(150, range=0..1000), YSize=Slider(11400, range=0..100000))
negative_7 = Negative(Value=Slider(2630, range=0..10000))
unit_x_10 = UnitX(Factor=negative_7)
move_18 = Move(Geometry=plane_surface_9, Motion=unit_x_10)  # -> Geometry, Transform
negative_8 = Negative(Value=Slider(5700, range=0..10000))
unit_y_9 = UnitY(Factor=negative_8)
move_19 = Move(Geometry=move_18.Geometry, Motion=unit_y_9)  # -> Geometry, Transform

number_slider_3 = Slider(15000, range=0..100000)
plane_surface_10 = PlaneSurface(Plane=evaluate_surface.Point, XSize=number_slider_3, YSize=number_slider_3)
division = Division(A=number_slider_3, B=Slider(2, range=0..10))
negative_9 = Negative(Value=division)
unit_x_11 = UnitX(Factor=negative_9)
move_20 = Move(Geometry=plane_surface_10, Motion=unit_x_11)  # -> Geometry, Transform
unit_y_10 = UnitY(Factor=negative_9)
move_21 = Move(Geometry=move_20.Geometry, Motion=unit_y_10)  # -> Geometry, Transform
division_2 = Division(A=number_slider_3, B=Slider(5, range=0..10))
fillet_2 = Fillet(Curve=move_21.Geometry, Radius=division_2)
area_4 = Area(Geometry=fillet_2)  # -> Area, Centroid
rotate = Rotate(Geometry=fillet_2, Angle=degrees(Slider(45, range=0..100)), Plane=area_4.Centroid)  # -> Geometry, Transform

populate_2d = Populate2D(Region=edge_surface, Count=Slider(10, range=0..100), Seed=1)
populate_2d_2 = Populate2D(Region=edge_surface, Count=Slider(200, range=0..1000), Seed=Slider(7, range=0..10))
populate_2d_3 = Populate2D(Region=edge_surface, Count=Slider(500, range=0..1000), Seed=Slider(7, range=0..10))
populate_2d_4 = Populate2D(Region=edge_surface, Count=Slider(500, range=0..1000), Seed=Slider(5, range=0..10))

offset_curve_3 = OffsetCurve(Curve=offset_curve_2, Distance=Slider(75, range=0..1000), Plane=area.Centroid, Corners=1)
offset_curve_4 = OffsetCurve(Curve=offset_curve_3, Distance=Slider(75, range=0..1000), Plane=area.Centroid, Corners=1)
divide_curve = DivideCurve(Curve=offset_curve_3, Count=Slider(100, range=0..100), Kinks=False)  # -> Points, Tangents, Parameters
boundary_surfaces_2 = BoundarySurfaces(Edges=offset_curve_4)
boundary_surfaces_3 = BoundarySurfaces(Edges=offset_curve_2)
circle = Circle(Plane=divide_curve.Points, Radius=Slider(100, range=0..1000))
solid_difference = SolidDifference(BrepsA=boundary_surfaces_2, BrepsB=boundary_surfaces_3)
unit_z_3 = UnitZ(Factor=Slider(95200, range=0..100000))

negative_10 = Negative(Value=Slider(400, range=0..1000))
unit_z_4 = UnitZ(Factor=negative_10)
extrude_4 = Extrude(Base=offset_curve_2, Direction=unit_z_4)
cap_holes = CapHoles(Brep=extrude_4)
unit_z_5 = UnitZ(Factor=negative_10)
extrude_5 = Extrude(Base=scale_2.Geometry, Direction=unit_z_5)
cap_holes_2 = CapHoles(Brep=extrude_5)
solid_difference_2 = SolidDifference(BrepsA=cap_holes, BrepsB=cap_holes_2)

plane_surface_11 = PlaneSurface(Plane=area_2.Centroid, XSize=Slider(100, range=0..1000), YSize=Slider(2300, range=0..100000))
unit_x_12 = UnitX(Factor=Slider(2900, range=-6000..10000))
move_22 = Move(Geometry=plane_surface_11, Motion=unit_x_12)  # -> Geometry, Transform
unit_y_11 = UnitY(Factor=Slider(-5700, range=-5700..10000))
move_23 = Move(Geometry=move_22.Geometry, Motion=unit_y_11)  # -> Geometry, Transform

plane_surface_12 = PlaneSurface(Plane=area_2.Centroid, XSize=Slider(100, range=0..1000), YSize=Slider(2300, range=0..100000))
unit_x_13 = UnitX(Factor=Slider(2900, range=-6000..10000))
move_24 = Move(Geometry=plane_surface_12, Motion=unit_x_13)  # -> Geometry, Transform
unit_y_12 = UnitY(Factor=Slider(3400, range=-5700..10000))
move_25 = Move(Geometry=move_24.Geometry, Motion=unit_y_12)  # -> Geometry, Transform

plane_surface_13 = PlaneSurface(Plane=area_2.Centroid, XSize=Slider(1980, range=0..100000), YSize=Slider(150, range=0..1000))
unit_x_14 = UnitX(Factor=Slider(-2480, range=-6000..10000))
move_26 = Move(Geometry=plane_surface_13, Motion=unit_x_14)  # -> Geometry, Transform
unit_y_13 = UnitY(Factor=Slider(90, range=-5700..10000))
move_27 = Move(Geometry=move_26.Geometry, Motion=unit_y_13)  # -> Geometry, Transform

brep_join = BrepJoin(Breps=[move_19.Geometry, move_9.Geometry, move_11.Geometry, move_15.Geometry, move_13.Geometry, move_17.Geometry, move_7.Geometry, move_27.Geometry, move_23.Geometry, move_25.Geometry])  # -> Breps, Closed

extrude_6 = Extrude(Base=circle, Direction=unit_z_3)
extrude_7 = Extrude(Base=solid_difference, Direction=unit_z_3)

plane_surface_14 = PlaneSurface(Plane=area_2.Centroid, XSize=Slider(260, range=0..1000), YSize=Slider(900, range=0..100000))
unit_x_15 = UnitX(Factor=Slider(4940, range=-6000..10000))
move_28 = Move(Geometry=plane_surface_14, Motion=unit_x_15)  # -> Geometry, Transform
unit_y_14 = UnitY(Factor=[Slider(-4500, range=-7000..10000), Slider(-2200, range=-7000..10000), Slider(3500, range=-7000..10000), Slider(1200, range=-7000..10000)])
move_29 = Move(Geometry=move_28.Geometry, Motion=unit_y_14)  # -> Geometry, Transform

plane_surface_15 = PlaneSurface(Plane=area_2.Centroid, XSize=Slider(260, range=0..1000), YSize=Slider(1200, range=0..100000))
unit_x_16 = UnitX(Factor=Slider(-5200, range=-6000..10000))
move_30 = Move(Geometry=plane_surface_15, Motion=unit_x_16)  # -> Geometry, Transform
unit_y_15 = UnitY(Factor=[Slider(-4350, range=-7000..10000), Slider(-1950, range=-7000..10000), Slider(3250, range=-7000..10000), Slider(900, range=-7000..10000)])
move_31 = Move(Geometry=move_30.Geometry, Motion=unit_y_15)  # -> Geometry, Transform

plane_surface_16 = PlaneSurface(Plane=area_2.Centroid, XSize=Slider(1000, range=0..100000), YSize=Slider(300, range=0..1000))
unit_x_17 = UnitX(Factor=Slider(-2480, range=-6000..10000))
move_32 = Move(Geometry=plane_surface_16, Motion=unit_x_17)  # -> Geometry, Transform
unit_y_16 = UnitY(Factor=[Slider(5700, range=-7000..10000), Slider(-6000, range=-7000..10000)])
move_33 = Move(Geometry=move_32.Geometry, Motion=unit_y_16)  # -> Geometry, Transform

negative_11 = Negative(Value=Slider(400, range=0..1000))
unit_z_6 = UnitZ(Factor=negative_11)
extrude_8 = Extrude(Base=offset_curve, Direction=unit_z_6)
cap_holes_3 = CapHoles(Brep=extrude_8)
unit_z_7 = UnitZ(Factor=negative_11)
extrude_9 = Extrude(Base=scale_2.Geometry, Direction=unit_z_7)
cap_holes_4 = CapHoles(Brep=extrude_9)
solid_difference_3 = SolidDifference(BrepsA=cap_holes_3, BrepsB=cap_holes_4)

move_34 = Move(Geometry=fillet, Motion=unit_z_2)  # -> Geometry, Transform
unit_z_8 = UnitZ(Factor=Slider(100, range=0..100))
extrude_10 = Extrude(Base=move_34.Geometry, Direction=unit_z_8)
cap_holes_5 = CapHoles(Brep=extrude_10)

number_slider_4 = Slider(3000, range=0..10000)

number_slider_5 = Slider(3000, range=0..10000)
unit_z_9 = UnitZ(Factor=number_slider_4)
extrude_11 = Extrude(Base=rotate.Geometry, Direction=unit_z_9)
negative_12 = Negative(Value=Slider(1500, range=0..10000))
unit_z_10 = UnitZ(Factor=negative_12)
cap_holes_6 = CapHoles(Brep=extrude_11)
move_35 = Move(Geometry=cap_holes_6, Motion=unit_z_10)  # -> Geometry, Transform
area_5 = Area(Geometry=move_35.Geometry)  # -> Area, Centroid
scale_3 = Scale(Geometry=move_35.Geometry, Center=area_5.Centroid, Factor=Slider(1.5, range=0..10))  # -> Geometry, Transform

point_in_breps = PointInBreps(Brep=scale_3.Geometry, Point=populate_2d, Strict=False)  # -> Inside, Index
dispatch = Dispatch(List=populate_2d, DispatchPattern=point_in_breps.Inside)  # -> ListA, ListB
point_2 = Point(dispatch.ListA)
point_3 = Point(dispatch.ListB)

number_slider_6 = Slider(10000, range=0..100000)
plane_surface_17 = PlaneSurface(Plane=point_3, XSize=number_slider_6, YSize=number_slider_6)
division_3 = Division(A=number_slider_6, B=Slider(2, range=0..10))
negative_13 = Negative(Value=division_3)
unit_x_18 = UnitX(Factor=negative_13)
move_36 = Move(Geometry=plane_surface_17, Motion=unit_x_18)  # -> Geometry, Transform
unit_y_17 = UnitY(Factor=negative_13)
move_37 = Move(Geometry=move_36.Geometry, Motion=unit_y_17)  # -> Geometry, Transform
division_4 = Division(A=number_slider_6, B=Slider(5, range=0..10))
fillet_3 = Fillet(Curve=move_37.Geometry, Radius=division_4)
area_6 = Area(Geometry=fillet_3)  # -> Area, Centroid
rotate_2 = Rotate(Geometry=fillet_3, Angle=degrees(Slider(45, range=0..100)), Plane=area_6.Centroid)  # -> Geometry, Transform

unit_z_11 = UnitZ(Factor=number_slider_4)
extrude_12 = Extrude(Base=rotate_2.Geometry, Direction=unit_z_11)
negative_14 = Negative(Value=Slider(1500, range=0..10000))
unit_z_12 = UnitZ(Factor=negative_14)
cap_holes_7 = CapHoles(Brep=extrude_12)
move_38 = Move(Geometry=cap_holes_7, Motion=unit_z_12)  # -> Geometry, Transform
area_7 = Area(Geometry=move_38.Geometry)  # -> Area, Centroid
scale_4 = Scale(Geometry=move_38.Geometry, Center=area_7.Centroid, Factor=Slider(1.5, range=0..10))  # -> Geometry, Transform

point_in_breps_2 = PointInBreps(Brep=flatten([scale_4.Geometry, scale_3.Geometry]), Point=populate_2d_2, Strict=False)  # -> Inside, Index
dispatch_2 = Dispatch(List=populate_2d_2, DispatchPattern=point_in_breps_2.Inside)  # -> ListA, ListB
point_4 = Point(dispatch_2.ListA)
point_5 = Point(dispatch_2.ListB)

number_slider_7 = Slider(4500, range=0..100000)
plane_surface_18 = PlaneSurface(Plane=point_5, XSize=number_slider_7, YSize=number_slider_7)
division_5 = Division(A=number_slider_7, B=Slider(2, range=0..10))
negative_15 = Negative(Value=division_5)
unit_x_19 = UnitX(Factor=negative_15)
move_39 = Move(Geometry=plane_surface_18, Motion=unit_x_19)  # -> Geometry, Transform
unit_y_18 = UnitY(Factor=negative_15)
move_40 = Move(Geometry=move_39.Geometry, Motion=unit_y_18)  # -> Geometry, Transform
division_6 = Division(A=number_slider_7, B=Slider(5, range=0..10))
fillet_4 = Fillet(Curve=move_40.Geometry, Radius=division_6)
area_8 = Area(Geometry=fillet_4)  # -> Area, Centroid
rotate_3 = Rotate(Geometry=fillet_4, Angle=degrees(Slider(45, range=0..100)), Plane=area_8.Centroid)  # -> Geometry, Transform

unit_z_13 = UnitZ(Factor=number_slider_4)
extrude_13 = Extrude(Base=rotate_3.Geometry, Direction=unit_z_13)
negative_16 = Negative(Value=Slider(1500, range=0..10000))
unit_z_14 = UnitZ(Factor=negative_16)
cap_holes_8 = CapHoles(Brep=extrude_13)
move_41 = Move(Geometry=cap_holes_8, Motion=unit_z_14)  # -> Geometry, Transform
area_9 = Area(Geometry=move_41.Geometry)  # -> Area, Centroid
scale_5 = Scale(Geometry=move_41.Geometry, Center=area_9.Centroid, Factor=Slider(1.7, range=0..10))  # -> Geometry, Transform

point_in_breps_3 = PointInBreps(Brep=flatten([scale_4.Geometry, scale_3.Geometry, scale_5.Geometry]), Point=populate_2d_3, Strict=False)  # -> Inside, Index
dispatch_3 = Dispatch(List=populate_2d_3, DispatchPattern=point_in_breps_3.Inside)  # -> ListA, ListB
point_6 = Point(dispatch_3.ListA)
point_7 = Point(dispatch_3.ListB)

number_slider_8 = Slider(3000, range=0..100000)
plane_surface_19 = PlaneSurface(Plane=point_7, XSize=number_slider_8, YSize=number_slider_8)
division_7 = Division(A=number_slider_8, B=Slider(2, range=0..10))
negative_17 = Negative(Value=division_7)
unit_x_20 = UnitX(Factor=negative_17)
move_42 = Move(Geometry=plane_surface_19, Motion=unit_x_20)  # -> Geometry, Transform
unit_y_19 = UnitY(Factor=negative_17)
move_43 = Move(Geometry=move_42.Geometry, Motion=unit_y_19)  # -> Geometry, Transform
division_8 = Division(A=number_slider_8, B=Slider(5, range=0..10))
fillet_5 = Fillet(Curve=move_43.Geometry, Radius=division_8)
area_10 = Area(Geometry=fillet_5)  # -> Area, Centroid
rotate_4 = Rotate(Geometry=fillet_5, Angle=degrees(Slider(45, range=0..100)), Plane=area_10.Centroid)  # -> Geometry, Transform

unit_z_15 = UnitZ(Factor=number_slider_4)
extrude_14 = Extrude(Base=rotate_4.Geometry, Direction=unit_z_15)
negative_18 = Negative(Value=Slider(1500, range=0..10000))
unit_z_16 = UnitZ(Factor=negative_18)
cap_holes_9 = CapHoles(Brep=extrude_14)
move_44 = Move(Geometry=cap_holes_9, Motion=unit_z_16)  # -> Geometry, Transform
area_11 = Area(Geometry=move_44.Geometry)  # -> Area, Centroid
scale_6 = Scale(Geometry=move_44.Geometry, Center=area_11.Centroid, Factor=Slider(2, range=0..10))  # -> Geometry, Transform

point_in_breps_4 = PointInBreps(
    Brep=flatten([scale_4.Geometry, scale_3.Geometry, scale_5.Geometry, scale_6.Geometry]),
    Point=populate_2d_4,
    Strict=False)  # -> Inside, Index
dispatch_4 = Dispatch(List=populate_2d_4, DispatchPattern=point_in_breps_4.Inside)  # -> ListA, ListB
point_8 = Point(dispatch_4.ListA)
point_9 = Point(dispatch_4.ListB)

number_slider_9 = Slider(1500, range=0..100000)
plane_surface_20 = PlaneSurface(Plane=point_9, XSize=number_slider_9, YSize=number_slider_9)
division_9 = Division(A=number_slider_9, B=Slider(2, range=0..10))
negative_19 = Negative(Value=division_9)
unit_x_21 = UnitX(Factor=negative_19)
move_45 = Move(Geometry=plane_surface_20, Motion=unit_x_21)  # -> Geometry, Transform
unit_y_20 = UnitY(Factor=negative_19)
move_46 = Move(Geometry=move_45.Geometry, Motion=unit_y_20)  # -> Geometry, Transform
division_10 = Division(A=number_slider_9, B=Slider(5, range=0..10))
fillet_6 = Fillet(Curve=move_46.Geometry, Radius=division_10)
area_12 = Area(Geometry=fillet_6)  # -> Area, Centroid
rotate_5 = Rotate(Geometry=fillet_6, Angle=degrees(Slider(45, range=0..100)), Plane=area_12.Centroid)  # -> Geometry, Transform

unit_z_17 = UnitZ(Factor=number_slider_4)
extrude_15 = Extrude(Base=rotate_5.Geometry, Direction=unit_z_17)
negative_20 = Negative(Value=Slider(1500, range=0..10000))
unit_z_18 = UnitZ(Factor=negative_20)
cap_holes_10 = CapHoles(Brep=extrude_15)
move_47 = Move(Geometry=cap_holes_10, Motion=unit_z_18)  # -> Geometry, Transform
area_13 = Area(Geometry=move_47.Geometry)  # -> Area, Centroid
scale_7 = Scale(Geometry=move_47.Geometry, Center=area_13.Centroid, Factor=Slider(1.3, range=0..10))  # -> Geometry, Transform

unit_z_19 = UnitZ(Factor=Slider(95600, range=0..100000))
move_48 = Move(Geometry=solid_difference_3, Motion=unit_z_19)  # -> Geometry, Transform

unit_z_20 = UnitZ(Factor=Slider(4000, range=0..10000))
move_49 = Move(Geometry=solid_difference_2, Motion=unit_z_20)  # -> Geometry, Transform
unit_z_21 = UnitZ(Factor=Slider(2800, range=0..10000))
move_50 = Move(Geometry=move_49.Geometry, Motion=unit_z_21)  # -> Geometry, Transform
unit_z_22 = UnitZ(Factor=Slider(4000, range=0..10000))
unit_z_23 = UnitZ(Factor=Slider(88800, range=0..100000))
move_51 = Move(Geometry=move_50.Geometry, Motion=unit_z_23)  # -> Geometry, Transform
linear_array = LinearArray(Geometry=move_50.Geometry, Direction=unit_z_22, Count=Slider(22, range=0..100))  # -> Geometry, Transform
brep = Brep([linear_array.Geometry, move_49.Geometry, move_48.Geometry])

brep_join_2 = BrepJoin(Breps=[move_29.Geometry, move_33.Geometry, move_31.Geometry])  # -> Breps, Closed

extrude_16 = Extrude(Base=brep_join_2.Breps, Direction=unit_z_2)

extrude_17 = Extrude(Base=brep_join.Breps, Direction=unit_z_2)
solid_difference_4 = SolidDifference(BrepsA=extrude_3, BrepsB=extrude_16)
brep_join_3 = BrepJoin(Breps=[extrude_17, solid_difference_4])  # -> Breps, Closed
brep_2 = Brep(brep_join_3.Breps)

unit_z_24 = UnitZ(Factor=number_slider_4)
extrude_18 = Extrude(Base=plane_surface_2, Direction=unit_z_24)
brep_join_4 = BrepJoin(Breps=[cap_holes_10, cap_holes_9, cap_holes_8, cap_holes_7, cap_holes_6])  # -> Breps, Closed
solid_difference_5 = SolidDifference(BrepsA=extrude_18, BrepsB=brep_join_4.Breps)
solid_difference_6 = SolidDifference(BrepsA=extrude_18, BrepsB=solid_difference_5)
