# Grasshopper definition 2차 저장.gh (Grasshopper 1.0.7)

curve = Curve(<curve referenced from the Rhino model>)
area = Area(Geometry=curve)  # -> Area, Centroid
offset_curve = OffsetCurve(Curve=curve, Distance=Slider(-400, range=-1000..1000), Plane=area.Centroid, Corners=1)
loft = Loft(
    Curves=flatten([curve, offset_curve]),
    Options={Adjust=False, Closed=False, LoftEnds=0, LoftSimp=0, LoftType=0, Rebuild=10, Refit=0.01})
number_slider = Slider(105500, range=0..500000)
unit_z = UnitZ(Factor=number_slider)
extrude = Extrude(Base=curve, Direction=unit_z)
extrude_2 = Extrude(Base=loft, Direction=unit_z)

negative = Negative(Value=Slider(550, range=0..1000))
negative_2 = Negative(Value=Slider(580, range=0..1000))
plane_surface = PlaneSurface(Plane=area.Centroid, XSize=Slider(1040, range=0..5000), YSize=Slider(1200, range=0..5000))
unit_x = UnitX(Factor=negative)
move = Move(Geometry=plane_surface, Motion=unit_x)  # -> Geometry, Transform
unit_y = UnitY(Factor=negative_2)
move_2 = Move(Geometry=move.Geometry, Motion=unit_y)  # -> Geometry, Transform
area_2 = Area(Geometry=move_2.Geometry)  # -> Area, Centroid
scale = Scale(Geometry=move_2.Geometry, Center=area_2.Centroid, Factor=Slider(10, range=0..10))  # -> Geometry, Transform
fillet = Fillet(Curve=scale.Geometry, Radius=Slider(1000, range=0..1000))
area_3 = Area(Geometry=fillet)  # -> Area, Centroid
scale_2 = Scale(Geometry=fillet, Center=area_3.Centroid, Factor=Slider(0.95, range=0..1))  # -> Geometry, Transform

point = Point(<point referenced from the Rhino model>)
length = Length(Curve=curve)
plane_surface_2 = PlaneSurface(Plane=point, XSize=length, YSize=number_slider)

md_slider = MDSlider(
    SliderMode=0,
    slider_value=Point(0.3215605573, 0.7352272592, 0.5),
    x_domain=Domain(0, 1),
    y_domain=Domain(0, 1),
    z_domain=Domain(0, 1))
md_slider_2 = MDSlider(
    SliderMode=0,
    slider_value=Point(0.4452252272, 0.2594366306, 0.5),
    x_domain=Domain(0, 1),
    y_domain=Domain(0, 1),
    z_domain=Domain(0, 1))
md_slider_3 = MDSlider(
    SliderMode=0,
    slider_value=Point(0.8460382601, 0.6498844798, 0.5),
    x_domain=Domain(0, 1),
    y_domain=Domain(0, 1),
    z_domain=Domain(0, 1))

negative_3 = Negative(Value=Slider(400, range=0..1000))
unit_z_2 = UnitZ(Factor=negative_3)
extrude_3 = Extrude(Base=offset_curve, Direction=unit_z_2)
cap_holes = CapHoles(Brep=extrude_3)
unit_z_3 = UnitZ(Factor=negative_3)
extrude_4 = Extrude(Base=fillet, Direction=unit_z_3)
cap_holes_2 = CapHoles(Brep=extrude_4)
solid_difference = SolidDifference(BrepsA=cap_holes, BrepsB=cap_holes_2)

unit_z_4 = UnitZ(Factor=Slider(4000, range=0..10000))
move_3 = Move(Geometry=solid_difference, Motion=unit_z_4)  # -> Geometry, Transform
unit_z_5 = UnitZ(Factor=Slider(2800, range=0..10000))
move_4 = Move(Geometry=move_3.Geometry, Motion=unit_z_5)  # -> Geometry, Transform
unit_z_6 = UnitZ(Factor=Slider(4000, range=0..10000))
unit_z_7 = UnitZ(Factor=Slider(88800, range=0..100000))
move_5 = Move(Geometry=move_4.Geometry, Motion=unit_z_7)  # -> Geometry, Transform
linear_array = LinearArray(Geometry=move_4.Geometry, Direction=unit_z_6, Count=Slider(22, range=0..100))  # -> Geometry, Transform

loft_2 = Loft(
    Curves=[fillet, scale_2.Geometry],
    Options={Adjust=False, Closed=False, LoftEnds=0, LoftSimp=0, LoftType=0, Rebuild=10, Refit=0.01})
multiplication = Multiplication(A=Slider(4000, range=0..10000), B=Slider(22, range=0..100))
multiplication_2 = Multiplication(A=Slider(6500, range=0..10000), B=Slider(2, range=0..10))
addition = Addition(A=multiplication, B=multiplication_2)
unit_z_8 = UnitZ(Factor=addition)
extrude_5 = Extrude(Base=loft_2, Direction=unit_z_8)

number_slider_2 = Slider(3000, range=0..10000)
unit_z_9 = UnitZ(Factor=number_slider_2)
extrude_6 = Extrude(Base=plane_surface_2, Direction=unit_z_9)

explode = Explode(Curve=plane_surface_2, Recursive=True)  # -> Segments, Vertices
list_item = ListItem(List=explode.Segments, Index=0, Wrap=True)  # -> Item1, Item, Item1_2, Item2
number_slider_3 = Slider(5000, range=0..10000)
curve_2 = Curve(list_item.Item1)
curve_3 = Curve(list_item.Item)
curve_4 = Curve(list_item.Item1_2)
curve_5 = Curve(list_item.Item2)
number_slider_4 = Slider(6000, range=0..10000)
unit_x_2 = UnitX(Factor=number_slider_3)
move_6 = Move(Geometry=curve_3, Motion=unit_x_2)  # -> Geometry, Transform
negative_4 = Negative(Value=number_slider_3)
unit_x_3 = UnitX(Factor=negative_4)
move_7 = Move(Geometry=curve_5, Motion=unit_x_3)  # -> Geometry, Transform
negative_5 = Negative(Value=number_slider_4)
unit_y_2 = UnitY(Factor=negative_5)
move_8 = Move(Geometry=curve_2, Motion=unit_y_2)  # -> Geometry, Transform

unit_y_3 = UnitY(Factor=number_slider_4)
move_9 = Move(Geometry=curve_4, Motion=unit_y_3)  # -> Geometry, Transform

edge_surface = EdgeSurface(CurveA=move_8.Geometry, CurveB=move_6.Geometry, CurveC=move_9.Geometry, CurveD=move_7.Geometry)

evaluate_surface = EvaluateSurface(Surface=reparameterize(edge_surface), Point=[md_slider_2, md_slider, md_slider_3])  # -> Point, Normal, UDirection, VDirection, Frame

number_slider_5 = Slider(15000, range=0..100000)
plane_surface_3 = PlaneSurface(Plane=evaluate_surface.Point, XSize=number_slider_5, YSize=number_slider_5)
division = Division(A=number_slider_5, B=Slider(2, range=0..10))
negative_6 = Negative(Value=division)
unit_x_4 = UnitX(Factor=negative_6)
move_10 = Move(Geometry=plane_surface_3, Motion=unit_x_4)  # -> Geometry, Transform
unit_y_4 = UnitY(Factor=negative_6)
move_11 = Move(Geometry=move_10.Geometry, Motion=unit_y_4)  # -> Geometry, Transform
division_2 = Division(A=number_slider_5, B=Slider(5, range=0..10))
fillet_2 = Fillet(Curve=move_11.Geometry, Radius=division_2)
area_4 = Area(Geometry=fillet_2)  # -> Area, Centroid
rotate = Rotate(Geometry=fillet_2, Angle=degrees(Slider(45, range=0..100)), Plane=area_4.Centroid)  # -> Geometry, Transform

populate_2d = Populate2D(Region=edge_surface, Count=Slider(10, range=0..100), Seed=1)
populate_2d_2 = Populate2D(Region=edge_surface, Count=Slider(200, range=0..1000), Seed=Slider(7, range=0..10))
populate_2d_3 = Populate2D(Region=edge_surface, Count=Slider(500, range=0..1000), Seed=Slider(7, range=0..10))
populate_2d_4 = Populate2D(Region=edge_surface, Count=Slider(500, range=0..1000), Seed=Slider(5, range=0..10))

number_slider_6 = Slider(3000, range=0..10000)
unit_z_10 = UnitZ(Factor=number_slider_2)
extrude_7 = Extrude(Base=rotate.Geometry, Direction=unit_z_10)
negative_7 = Negative(Value=Slider(1500, range=0..10000))
unit_z_11 = UnitZ(Factor=negative_7)
cap_holes_3 = CapHoles(Brep=extrude_7)
move_12 = Move(Geometry=cap_holes_3, Motion=unit_z_11)  # -> Geometry, Transform
area_5 = Area(Geometry=move_12.Geometry)  # -> Area, Centroid
scale_3 = Scale(Geometry=move_12.Geometry, Center=area_5.Centroid, Factor=Slider(1.5, range=0..10))  # -> Geometry, Transform

point_in_breps = PointInBreps(Brep=scale_3.Geometry, Point=populate_2d, Strict=False)  # -> Inside, Index
dispatch = Dispatch(List=populate_2d, DispatchPattern=point_in_breps.Inside)  # -> ListA, ListB
point_2 = Point(dispatch.ListA)
point_3 = Point(dispatch.ListB)

number_slider_7 = Slider(10000, range=0..100000)
plane_surface_4 = PlaneSurface(Plane=point_3, XSize=number_slider_7, YSize=number_slider_7)
division_3 = Division(A=number_slider_7, B=Slider(2, range=0..10))
negative_8 = Negative(Value=division_3)
unit_x_5 = UnitX(Factor=negative_8)
move_13 = Move(Geometry=plane_surface_4, Motion=unit_x_5)  # -> Geometry, Transform
unit_y_5 = UnitY(Factor=negative_8)
move_14 = Move(Geometry=move_13.Geometry, Motion=unit_y_5)  # -> Geometry, Transform
division_4 = Division(A=number_slider_7, B=Slider(5, range=0..10))
fillet_3 = Fillet(Curve=move_14.Geometry, Radius=division_4)
area_6 = Area(Geometry=fillet_3)  # -> Area, Centroid
rotate_2 = Rotate(Geometry=fillet_3, Angle=degrees(Slider(45, range=0..100)), Plane=area_6.Centroid)  # -> Geometry, Transform

unit_z_12 = UnitZ(Factor=number_slider_2)
extrude_8 = Extrude(Base=rotate_2.Geometry, Direction=unit_z_12)
negative_9 = Negative(Value=Slider(1500, range=0..10000))
unit_z_13 = UnitZ(Factor=negative_9)
cap_holes_4 = CapHoles(Brep=extrude_8)
move_15 = Move(Geometry=cap_holes_4, Motion=unit_z_13)  # -> Geometry, Transform
area_7 = Area(Geometry=move_15.Geometry)  # -> Area, Centroid
scale_4 = Scale(Geometry=move_15.Geometry, Center=area_7.Centroid, Factor=Slider(1.5, range=0..10))  # -> Geometry, Transform

point_in_breps_2 = PointInBreps(Brep=flatten([scale_4.Geometry, scale_3.Geometry]), Point=populate_2d_2, Strict=False)  # -> Inside, Index
dispatch_2 = Dispatch(List=populate_2d_2, DispatchPattern=point_in_breps_2.Inside)  # -> ListA, ListB
point_4 = Point(dispatch_2.ListA)
point_5 = Point(dispatch_2.ListB)

number_slider_8 = Slider(4500, range=0..100000)
plane_surface_5 = PlaneSurface(Plane=point_5, XSize=number_slider_8, YSize=number_slider_8)
division_5 = Division(A=number_slider_8, B=Slider(2, range=0..10))
negative_10 = Negative(Value=division_5)
unit_x_6 = UnitX(Factor=negative_10)
move_16 = Move(Geometry=plane_surface_5, Motion=unit_x_6)  # -> Geometry, Transform
unit_y_6 = UnitY(Factor=negative_10)
move_17 = Move(Geometry=move_16.Geometry, Motion=unit_y_6)  # -> Geometry, Transform
division_6 = Division(A=number_slider_8, B=Slider(5, range=0..10))
fillet_4 = Fillet(Curve=move_17.Geometry, Radius=division_6)
area_8 = Area(Geometry=fillet_4)  # -> Area, Centroid
rotate_3 = Rotate(Geometry=fillet_4, Angle=degrees(Slider(45, range=0..100)), Plane=area_8.Centroid)  # -> Geometry, Transform

unit_z_14 = UnitZ(Factor=number_slider_2)
extrude_9 = Extrude(Base=rotate_3.Geometry, Direction=unit_z_14)
negative_11 = Negative(Value=Slider(1500, range=0..10000))
unit_z_15 = UnitZ(Factor=negative_11)
cap_holes_5 = CapHoles(Brep=extrude_9)
move_18 = Move(Geometry=cap_holes_5, Motion=unit_z_15)  # -> Geometry, Transform
area_9 = Area(Geometry=move_18.Geometry)  # -> Area, Centroid
scale_5 = Scale(Geometry=move_18.Geometry, Center=area_9.Centroid, Factor=Slider(1.7, range=0..10))  # -> Geometry, Transform

point_in_breps_3 = PointInBreps(Brep=flatten([scale_4.Geometry, scale_3.Geometry, scale_5.Geometry]), Point=populate_2d_3, Strict=False)  # -> Inside, Index
dispatch_3 = Dispatch(List=populate_2d_3, DispatchPattern=point_in_breps_3.Inside)  # -> ListA, ListB
point_6 = Point(dispatch_3.ListA)
point_7 = Point(dispatch_3.ListB)

number_slider_9 = Slider(3000, range=0..100000)
plane_surface_6 = PlaneSurface(Plane=point_7, XSize=number_slider_9, YSize=number_slider_9)
division_7 = Division(A=number_slider_9, B=Slider(2, range=0..10))
negative_12 = Negative(Value=division_7)
unit_x_7 = UnitX(Factor=negative_12)
move_19 = Move(Geometry=plane_surface_6, Motion=unit_x_7)  # -> Geometry, Transform
unit_y_7 = UnitY(Factor=negative_12)
move_20 = Move(Geometry=move_19.Geometry, Motion=unit_y_7)  # -> Geometry, Transform
division_8 = Division(A=number_slider_9, B=Slider(5, range=0..10))
fillet_5 = Fillet(Curve=move_20.Geometry, Radius=division_8)
area_10 = Area(Geometry=fillet_5)  # -> Area, Centroid
rotate_4 = Rotate(Geometry=fillet_5, Angle=degrees(Slider(45, range=0..100)), Plane=area_10.Centroid)  # -> Geometry, Transform

unit_z_16 = UnitZ(Factor=number_slider_2)
extrude_10 = Extrude(Base=rotate_4.Geometry, Direction=unit_z_16)
negative_13 = Negative(Value=Slider(1500, range=0..10000))
unit_z_17 = UnitZ(Factor=negative_13)
cap_holes_6 = CapHoles(Brep=extrude_10)
move_21 = Move(Geometry=cap_holes_6, Motion=unit_z_17)  # -> Geometry, Transform
area_11 = Area(Geometry=move_21.Geometry)  # -> Area, Centroid
scale_6 = Scale(Geometry=move_21.Geometry, Center=area_11.Centroid, Factor=Slider(2, range=0..10))  # -> Geometry, Transform

point_in_breps_4 = PointInBreps(
    Brep=flatten([scale_4.Geometry, scale_3.Geometry, scale_5.Geometry, scale_6.Geometry]),
    Point=populate_2d_4,
    Strict=False)  # -> Inside, Index
dispatch_4 = Dispatch(List=populate_2d_4, DispatchPattern=point_in_breps_4.Inside)  # -> ListA, ListB
point_8 = Point(dispatch_4.ListA)
point_9 = Point(dispatch_4.ListB)

number_slider_10 = Slider(1500, range=0..100000)
plane_surface_7 = PlaneSurface(Plane=point_9, XSize=number_slider_10, YSize=number_slider_10)
division_9 = Division(A=number_slider_10, B=Slider(2, range=0..10))
negative_14 = Negative(Value=division_9)
unit_x_8 = UnitX(Factor=negative_14)
move_22 = Move(Geometry=plane_surface_7, Motion=unit_x_8)  # -> Geometry, Transform
unit_y_8 = UnitY(Factor=negative_14)
move_23 = Move(Geometry=move_22.Geometry, Motion=unit_y_8)  # -> Geometry, Transform
division_10 = Division(A=number_slider_10, B=Slider(5, range=0..10))
fillet_6 = Fillet(Curve=move_23.Geometry, Radius=division_10)
area_12 = Area(Geometry=fillet_6)  # -> Area, Centroid
rotate_5 = Rotate(Geometry=fillet_6, Angle=degrees(Slider(45, range=0..100)), Plane=area_12.Centroid)  # -> Geometry, Transform

unit_z_18 = UnitZ(Factor=number_slider_2)
extrude_11 = Extrude(Base=rotate_5.Geometry, Direction=unit_z_18)
negative_15 = Negative(Value=Slider(1500, range=0..10000))
unit_z_19 = UnitZ(Factor=negative_15)
cap_holes_7 = CapHoles(Brep=extrude_11)
move_24 = Move(Geometry=cap_holes_7, Motion=unit_z_19)  # -> Geometry, Transform
area_13 = Area(Geometry=move_24.Geometry)  # -> Area, Centroid
scale_7 = Scale(Geometry=move_24.Geometry, Center=area_13.Centroid, Factor=Slider(1.3, range=0..10))  # -> Geometry, Transform

brep_join = BrepJoin(Breps=[cap_holes_7, cap_holes_6, cap_holes_5, cap_holes_4, cap_holes_3])  # -> Breps, Closed
solid_difference_2 = SolidDifference(BrepsA=extrude_6, BrepsB=brep_join.Breps)
solid_difference_3 = SolidDifference(BrepsA=extrude_6, BrepsB=solid_difference_2)
